# Grasshopper definition 20170310_taskbook_plane.gh (Grasshopper 0.9.76)

_201703010_现阶段工作 = Panel("""贴标签
运算器分布
案例编写""")
# 生成-->蓝色
# 解析-->黄色
# 数据-->白色
# 向量-->红色
# 预览-->紫色
panel = Panel("""数据组织
交错韵律
最小单元""")
sqgrid = Square(Plane=PlaneXY(0, 0, 0), Size=1, ExtentX=5, ExtentY=5)  # -> Cells, Points

path_mapper = PathMapper()
viewer = ParamViewer()

partition = PartitionList(Size=[3, 2])
tstat = TreeStatistics()  # -> Paths, Length, Count
shift = ShiftList(Shift=1, Wrap=True)
entwine = Entwine(FlattenInputs=True)
dup = DuplicateData(Number=2, Order=True)
item = ListItem(Index=0, Wrap=True)

area = Area()  # -> Area, Centroid
curvepoint = PointOnCurve(parameter=0.5)

points = PointList()
preview = CustomPreview(Shader={ambient=RGB(0, 0, 0), diffuse=RGB(255, 105, 180), emission=RGB(76, 32, 54), shine=0.5, specular=RGB(255, 255, 255), transparency=0})
vdis = VectorDisplay()

del = DelaunayMesh(Plane=PlaneXY(0, 0, 0))
pline = PolyLine(Closed=False)
ln = Line()

unit = UnitVector()
amp = Amplitude(Amplitude=1)

pt = Point()
pt_2 = Point(Point(29.98283659, -11.08061352, 0))

number_slider = Slider(10, range=0..10)
number_slider_2 = Slider(0.444, range=0..1)
multiplication = Multiplication(A=number_slider, B=number_slider_2)
rectangle = Rectangle(Plane=PlaneXY(0, 0, 0), XSize=multiplication, YSize=multiplication, Radius=0)  # -> Rectangle, Length
hexgrid = Hexagonal(Plane=PlaneXY(0, 0, 0), Size=number_slider_2, ExtentX=number_slider, ExtentY=number_slider)  # -> Cells, Points
boxrec = BoxRectangle(Rectangle=rectangle.Rectangle, Height=Slider(1.15, range=0..10))
pt_3 = Point(Point(2.814153104, 1.612465724, 1.10129804))
pop3d = Populate3D(Region=boxrec, Count=Slider(10, range=0..10), Seed=Slider(76.84, range=0..100))
vec2pt = Vector2Pt(PointA=hexgrid.Points, PointB=pop3d, Unitize=False)  # -> Vector, Length
circle = CircleCNR(Center=hexgrid.Points, Normal=vec2pt.Vector, Radius=number_slider_2)
offset = Offset(Curve=circle, Distance=Slider(-0.25, range=-10..1), Plane=PlaneXY(0, 0, 0), Corners=1)
boundary = BoundarySurfaces(Edges=offset)

pop2d = Populate2D(Region={Plane=PlaneXY(0, 0, 0), Size=Domain2(u=0..20, v=0..10)}, Count=100, Seed=1)
xy = XYPlane(Origin=pt_2)
unit_2 = UnitVector(Vector=xy)
cullpt = CullDuplicates(Points=pop2d, Tolerance=0.1, CullMode=3)  # -> Points, Indices, Valence
amp_2 = Amplitude(Vector=unit_2, Amplitude=Slider(0.813, range=0..1))
sqgrid_2 = Square(Plane=xy, Size=Slider(1.85, range=0..10), ExtentX=Slider(13, range=0..100), ExtentY=Slider(20, range=0..100))  # -> Cells, Points
area_2 = Area(Geometry=sqgrid_2.Cells)  # -> Area, Centroid
panel_2 = Panel(pop2d)
path_mapper_2 = PathMapper(sqgrid_2.Cells, source="{A;B;C}(i)", target="{c%2;i%2}")
move = Move(Geometry=area_2.Centroid, Motion=amp_2)  # -> Geometry, Transform
path_mapper_3 = PathMapper(move.Geometry, source="{A;B;C}(i)", target="{c%2;i%2}")
entwine_2 = Entwine(
    Branch00=ColourSwatch(SwatchColor=RGB(0, 255, 0)),
    Branch01=ColourSwatch(SwatchColor=RGB(0, 0, 0)),
    Branch02=ColourSwatch(SwatchColor=RGB(33, 88, 112)),
    Branch03=ColourSwatch(SwatchColor=RGB(235, 181, 181)),
    FlattenInputs=True)
sph = Sphere(Base=path_mapper_3, Radius=Slider(0.25, range=0..1))
points_2 = PointList(Points=path_mapper_3, Size=Slider(0.636, range=0..1))
preview_2 = CustomPreview(Geometry=sph, Shader=entwine_2)
cpoly = ControlPolygon(Curve=path_mapper_2)  # -> Polygon, Points
panel_3 = Panel("""0
2
2
0
1
3
3
1""")
shift_2 = ShiftList(List=cpoly.Points, Shift=-1, Wrap=False)
cullpt_2 = CullDuplicates(Points=cpoly.Points, Tolerance=0.1, CullMode=3)  # -> Points, Indices, Valence
preview_3 = CustomPreview(Geometry=sph, Shader=entwine_2)
partition_2 = PartitionList(List=panel_3, Size="2")
pt_4 = Point(shift_2)
tstat_2 = TreeStatistics(Tree=pt_4)  # -> Paths, Length, Count
division = Division(A=tstat_2.Count, B="4")
dup_2 = DuplicateData(Data=partition_2, Number=division, Order=True)
partition_3 = PartitionList(List=dup_2, Size="2")
item_2 = ListItem(List=pt_4, Index=partition_3, Wrap=True)
pline_2 = PolyLine(Vertices=item_2, Closed=False)  # -> simplify(Polyline)
path_mapper_4 = PathMapper(pline_2, source="{A;B;C}", target="{A;B}")
curvepoint_2 = PointOnCurve(pline_2, parameter=0.5)
unit_3 = UnitVector(Vector=path_mapper_4)
amp_3 = Amplitude(Vector=unit_3, Amplitude=Slider(0.68, range=0..1))
vdis_2 = VectorDisplay(Anchor=curvepoint_2, Vector=amp_3)
move_2 = Move(Geometry=path_mapper_3, Motion=amp_3)  # -> graft(Geometry), Transform
path_mapper_5 = PathMapper(pt_4, source="{A;B;C;D}", target="{A;B;C}")
ln_2 = Line(StartPoint=path_mapper_5, EndPoint=move_2.Geometry)
merge = Merge(Data1=move_2.Geometry, Data2=path_mapper_5)
del_2 = DelaunayMesh(Points=merge, Plane=xy)
viewer_2 = ParamViewer(path_mapper_5)
