# Grasshopper definition 160925_PE_points.gh (Grasshopper 0.9.76)

line = Line([Line((-28.43570879, -32.87535514, 0), (26.13975502, -11.96140003, 0)), Line((18.7700756, 6.164027732, 0), (13.19302091, -43.43192296, 0)), Line((-30.62669456, -19.7294405, 0), (35.30205917, -38.25322931, 0)), Line((2.835633616, -1.404832213, 0), (-1.54633793, -45.62290873, 0))])  # disabled
panel = Panel("1")  # disabled
linelist = Curve(line)  # disabled
lng = ListLength(List=linelist)  # disabled
subtraction = Subtraction(A=lng, B=panel)  # disabled
series = Series(Start=0, Step=1, Count=subtraction)  # disabled
addition = Addition(A=series, B=panel)  # disabled
item = ListItem(List=linelist, Index=series, Wrap=False)  # -> simplify(graft(Item)); disabled
shift = ShiftList(List=linelist, Shift=addition, Wrap=False)  # -> simplify(List); disabled
end = EndPoints(Curve=item)  # -> Start, End; disabled
end_2 = EndPoints(Curve=shift)  # -> Start, End; disabled

line_length = Panel("""3.2
5.1
6.3
4.2""")
panel_2 = Panel("""0
1
2
3""")
# Point:indicate a position in space
# Line:length,direction,position
# Point
# two ends of the line
# the intersection of two lines
# the meeting of lines at the corner of a space or volumn
# the center of field
md_slider = MDSlider(
    slider_value=Point(0.5132578379, 0.5396976122, 0.5),
    SliderMode=0,
    x_domain=Domain(-100, 100),
    y_domain=Domain(-100, 100),
    z_domain=Domain(0, 1))  # disabled
startpoint = Point(md_slider)  # disabled
line_length_2 = Number(line_length)
int = Integer(panel_2)
number_slider = Slider(0.52, range=0..100)  # disabled
number_slider_2 = Slider(2.4, range=0..100)  # disabled
number_slider_3 = Slider(7.61, range=0..100)  # disabled
number_slider_4 = Slider(6.19, range=0..100)  # disabled
item_2 = ListItem(List=["1,0", "0,1", "-1,0", "0,-1"], Index=int, Wrap=True)
item_3 = ListItem(List=line_length_2, Index=0, Wrap=True)
X = UnitX(Factor=1)
basicvector = Vector(item_2)
merge = Merge(Data1=number_slider, Data2=number_slider_2)  # disabled
merge_2 = Merge(Data1=number_slider_3, Data2=number_slider_4)  # disabled
amp = Amplitude(Vector=X, Amplitude=item_3)  # disabled
line_2 = LineSDL(Start=startpoint, Direction=X, Length=item_3)  # disabled
complex = ComplexComponents(Complex=startpoint)  # -> Real, Imaginary; disabled
pt = PointOriented(BasePlane=startpoint, UComponent=merge, VComponent=merge_2, WComponent=0)  # disabled
complex_2 = ComplexComponents(Complex=amp)  # -> Real, Imaginary; disabled
complex_3 = CreateComplex(Real=complex.Real, Imaginary=complex.Imaginary)  # disabled
complex_4 = CreateComplex(Real=complex_2.Real, Imaginary=complex_2.Imaginary)  # disabled
item_4 = ListItem(List=pt, Index=0, Wrap=True)  # -> Item, Item1; disabled
X_2 = UnitX(Factor=1)  # disabled
Y = UnitY(Factor=1)  # disabled
addition_2 = Addition(A=complex_3, B=complex_4)  # disabled
line_3 = LineSDL(Start=item_4.Item1, Direction=Y, Length=item_3)  # disabled
line_4 = LineSDL(Start=item_4.Item, Direction=X_2, Length=item_3)  # disabled
panel_3 = Panel(addition_2)  # disabled
panel_4 = Panel("""1,2
2,1""")  # disabled
panel_5 = Panel("""2.0,2.0,0.0
-0.5,4.0,0.0""")  # disabled
panel_6 = Panel(complex_3)  # disabled
startpoint_2 = Point(panel_4)  # disabled
vec = Vector(panel_5)  # disabled
addition_3 = Addition(A=startpoint_2, B=vec)  # disabled
vec2pt = Vector2Pt(PointA=startpoint_2, PointB=addition_3, Unitize=False)  # -> Vector, Length; disabled
ln = Line(StartPoint=startpoint_2, EndPoint=addition_3)  # disabled
endpoint = Point(addition_3)  # disabled

line_5 = Line([Line((-10.29725997, 2.159053388, 0), (-11.99011357, -47.17553699, 0)), Line((-27.95130457, -8.723576843, 0), (26.94551904, -6.547050797, 0)), Line((21.62512204, 3.368234525, 0), (19.44859599, -45.72451963, 0)), Line((-26.50028721, -30.24700108, 0), (26.46184658, -43.06432113, 0))])
panel_7 = Panel("""0
1
2
3""")
line_length_3 = Panel("""3.2
5.1
3.2
5.1""")
md_slider_2 = MDSlider(slider_value=Point(0.5, 0.5, 0.5), SliderMode=0, x_domain=Domain(0, 1), y_domain=Domain(0, 1), z_domain=Domain(0, 1))
# explore a point position in space
linelist_2 = Curve(line_5)
lng_2 = ListLength(List=linelist_2)
subtraction_2 = Subtraction(A=lng_2, B="1")
series_2 = Series(Start=0, Step=1, Count=subtraction_2)
line_length_4 = Number(line_length_3)
int_2 = Integer(panel_7)
addition_4 = Addition(A=series_2, B="1")
X_3 = UnitX(Factor=1)
Y_2 = UnitY(Factor=1)
item_5 = ListItem(List=["1,0", "0,1", "-1,0", "0,-1"], Index=int_2, Wrap=True)
item_6 = ListItem(List=linelist_2, Index=series_2, Wrap=False)  # -> simplify(graft(Item))
end_3 = EndPoints(Curve=linelist)  # -> Start, End; disabled
shift_2 = ShiftList(List=linelist_2, Shift=addition_4, Wrap=False)  # -> simplify(List)
item_7 = ListItem(List=line_length_4, Index=int_2, Wrap=True)
basicvector_2 = Vector(item_5)
vlen = VectorLength(Vector=Y_2)
vlen_2 = VectorLength(Vector=X_3)
subtraction_3 = Subtraction(A=end_3.End, B=end_3.Start)  # disabled
startpoint_3 = Point(end_3.Start)  # disabled
end_4 = EndPoints(Curve=item_6)  # -> Start, End
end_5 = EndPoints(Curve=shift_2)  # -> Start, End
amp_2 = Amplitude(Vector=basicvector_2, Amplitude=item_7)
vec_2 = Vector(subtraction_3)  # disabled
multiplication = Multiplication(A=X_3, B=Y_2)
multiplication_2 = Multiplication(A=vlen_2, B=vlen)
addition_5 = Addition(A=startpoint_3, B=vec_2)  # disabled
endpoint_2 = Point(addition_5)  # disabled
lng_3 = ListLength(List=addition_5)  # disabled
ma = MassAddition(Input=amp_2)  # -> Result, PartialResults
addition_6 = Addition(A=md_slider_2, B=ma.PartialResults)
end_6 = EndPoints(Curve=linelist_2)  # -> Start, End
lng_4 = ListLength(List=startpoint_3)  # disabled
division = Division(A=multiplication, B=multiplication_2)
panel_8 = Panel("1")  # disabled
pt_2 = Point(ma.PartialResults)
panel_9 = Panel(startpoint_3)  # disabled
panel_10 = Panel("1")  # disabled
subtraction_4 = Subtraction(A=lng_3, B=panel_8)  # disabled
complex_5 = ComplexComponents(Complex=ma.PartialResults)  # -> Real, Imaginary
subtraction_5 = Subtraction(A=lng_4, B=panel_10)  # disabled
subtraction_6 = Subtraction(A=end_6.End, B=end_6.Start)
pt_3 = Point(Point(2.150332984, 3.659643305, 0))
acos = ArcCosine(Value=division)
startpoint_4 = Point(end_6.Start)
vec_3 = Vector(subtraction_6)
complex_6 = ComplexComponents(Complex=pt_3)  # -> Real, Imaginary
series_3 = Series(Start=0, Step=1, Count=subtraction_5)  # disabled
series_4 = Series(Start=0, Step=1, Count=subtraction_4)  # disabled
concat = Concatenate(FragmentA=complex_5.Real, FragmentB=complex_5.Imaginary, JoinSeparator=",")
addition_7 = Addition(A=series_4, B=panel_8)  # disabled
addition_8 = Addition(A=startpoint_4, B=vec_3)
endpoint_3 = Point(addition_8)
addition_9 = Addition(A=series_3, B=panel_10)  # disabled
lng_5 = ListLength(List=addition_8)
lng_6 = ListLength(List=startpoint_4)
panel_11 = Panel(startpoint_4)
number_slider_5 = Slider(6, range=0..100)  # disabled
# describe space by (point;index) of vector
pline = PolyLine(Vertices=pt_2, Closed=True)
item_8 = ListItem(List=startpoint_3, Index=series_3, Wrap=False)  # -> simplify(graft(Item)); disabled
item_9 = ListItem(List=addition_5, Index=series_4, Wrap=False)  # -> simplify(graft(Item)); disabled
concat_2 = Concatenate(FragmentA=concat, FragmentB=int_2, JoinSeparator=";")
shift_3 = ShiftList(List=addition_5, Shift=addition_7, Wrap=False)  # -> simplify(List); disabled
shift_4 = ShiftList(List=startpoint_3, Shift=addition_9, Wrap=False)  # -> simplify(List); disabled
subtraction_7 = Subtraction(A=lng_5, B="1")
subtraction_8 = Subtraction(A=lng_6, B="1")
series_5 = Series(Start=0, Step=1, Count=subtraction_8)
series_6 = Series(Start=0, Step=1, Count=subtraction_7)
firstpt0 = Point(item_8)  # disabled
firstpt1 = Point(shift_4)  # disabled
endpt0 = Point(item_9)  # disabled
endpt1 = Point(shift_3)  # disabled
addition_10 = Addition(A=series_6, B="1")
addition_11 = Addition(A=series_5, B="1")
panel_12 = Panel(concat_2)
points = PointList(Points=flatten(firstpt0), Size=number_slider_5)  # disabled
item_10 = ListItem(List=startpoint_4, Index=series_5, Wrap=False)  # -> simplify(graft(Item))
item_11 = ListItem(List=addition_8, Index=series_6, Wrap=False)  # -> simplify(graft(Item))
shift_5 = ShiftList(List=addition_8, Shift=addition_10, Wrap=False)  # -> simplify(List)
shift_6 = ShiftList(List=startpoint_4, Shift=addition_11, Wrap=False)  # -> simplify(List)
complex_7 = ComplexComponents(Complex=endpt1)  # -> Real, Imaginary; disabled
complex_8 = ComplexComponents(Complex=firstpt1)  # -> Real, Imaginary; disabled
complex_9 = ComplexComponents(Complex=firstpt0)  # -> Real, Imaginary; disabled
complex_10 = ComplexComponents(Complex=endpt0)  # -> Real, Imaginary; disabled
x1 = Number("2")
y1 = Number("0")
x2 = Number("1")
y2 = Number("2")
subtraction_9 = Subtraction(A=complex_9.Real, B=complex_10.Real)  # disabled
subtraction_10 = Subtraction(A=complex_9.Imaginary, B=complex_10.Imaginary)  # disabled
subtraction_11 = Subtraction(A=complex_8.Real, B=complex_7.Real)  # disabled
firstpt0_2 = Point(item_10)
firstpt1_2 = Point(shift_6)
endpt0_2 = Point(item_11)
endpt1_2 = Point(shift_5)
subtraction_12 = Subtraction(A=complex_8.Imaginary, B=complex_7.Imaginary)  # disabled
points_2 = PointList(Points=flatten(firstpt0_2), Size=Slider(6, range=0..100))
subtraction_13 = Subtraction(A=x1, B=x2)
neg = Negative(Value=x1)
division_2 = Division(A=subtraction_10, B=subtraction_9)  # disabled
division_3 = Division(A=subtraction_12, B=subtraction_11)  # disabled
c = Number("1")
complex_11 = ComplexComponents(Complex=endpt1_2)  # -> Real, Imaginary
complex_12 = ComplexComponents(Complex=firstpt1_2)  # -> Real, Imaginary
complex_13 = ComplexComponents(Complex=firstpt0_2)  # -> Real, Imaginary
complex_14 = ComplexComponents(Complex=endpt0_2)  # -> Real, Imaginary
a1 = Number(Slider(2, range=0..10))
b1 = Number("-1")
c1 = Number("1")
a2 = Number("1")
b2 = Number("1")
c2 = Number("3")
equals = Equality(FirstNumber=subtraction_13, SecondNumber="0")  # -> Equality, Inequality
a = Number("1")
b = Number("0")
c_2 = Number(neg)
eval = Evaluate(F="-c/(x1*(x1-x2)/(y1-y2)+y1)", c=c, x1=x1, x2=x2, y1=y1, y2=y2)
k2 = Number(division_3)  # disabled
multiplication_3 = Multiplication(A=k2, B=complex_7.Real)  # disabled
k1 = Number(division_2)  # disabled
multiplication_4 = Multiplication(A=k1, B=complex_10.Real)  # disabled
subtraction_14 = Subtraction(A=complex_13.Real, B=complex_14.Real)
subtraction_15 = Subtraction(A=complex_13.Imaginary, B=complex_14.Imaginary)
subtraction_16 = Subtraction(A=complex_12.Real, B=complex_11.Real)
subtraction_17 = Subtraction(A=complex_12.Imaginary, B=complex_11.Imaginary)

panel_13 = Panel("""(b1*c2-b2*c1)/(a1*b2-a2*b1)
(a2*c1-a1*c2)/(a1*b2-a2*b1)""")
eval_2 = Evaluate(F=panel_13, a1=a1, b1=b1, c1=c1, a2=a2, b2=b2, c2=c2)

subtraction_18 = Subtraction(A=complex_10.Imaginary, B=multiplication_4)  # disabled
subtraction_19 = Subtraction(A=complex_7.Imaginary, B=multiplication_3)  # disabled
b_2 = Number(eval)
merge_3 = Merge(Data1=a, Data2=b, Data3=c_2)
division_4 = Division(A=subtraction_15, B=subtraction_14)
division_5 = Division(A=subtraction_17, B=subtraction_16)
subtraction_20 = Subtraction(A=k1, B=k2)  # disabled
b1_2 = Number(subtraction_18)  # disabled
eval_3 = Evaluate(F="b*(x1-x2)/(y1-y2)", b=b_2, x1=x1, x2=x2, y1=y1, y2=y2)
b2_2 = Number(subtraction_19)  # disabled
subtraction_21 = Subtraction(A=b2_2, B=b1_2)  # disabled
k2_2 = Number(division_5)
multiplication_5 = Multiplication(A=k2_2, B=complex_11.Real)
k1_2 = Number(division_4)
multiplication_6 = Multiplication(A=k1_2, B=complex_14.Real)
division_6 = Division(A=subtraction_21, B=subtraction_20)  # disabled

# ----
# 0 --> extend one line to intersect two lines
# 1 --> extend two lines
# 2 --> extend three lines
dom = ConstructDomain(DomainStart=complex_8.Real, DomainEnd=complex_7.Real)  # disabled
dom_2 = ConstructDomain(DomainStart=complex_9.Real, DomainEnd=complex_10.Real)  # disabled
inc = Includes(Value=division_6, Domain=dom_2)  # -> Includes, Deviation; disabled
inc_2 = Includes(Value=division_6, Domain=dom)  # -> Includes, Deviation; disabled
int_3 = Integer(inc.Includes)  # disabled
int_4 = Integer(inc_2.Includes)  # disabled
addition_12 = Addition(A=int_3, B=int_4)  # disabled
panel_14 = Panel("2")  # disabled
subtraction_22 = Subtraction(A=panel_14, B=addition_12)  # disabled
extendlinecount = Integer(subtraction_22)  # disabled

a_2 = Number(eval_3)
subtraction_23 = Subtraction(A=complex_14.Imaginary, B=multiplication_6)
subtraction_24 = Subtraction(A=complex_11.Imaginary, B=multiplication_5)
panel_15 = Panel(eval_2)
multiplication_7 = Multiplication(A=division_6, B=k2)  # disabled
merge_4 = Merge(Data1=a_2, Data2=b_2, Data3=c)
filter = StreamFilter(Gate=equals.Equality, Stream0=merge_4, Stream1=merge_3)
subtraction_25 = Subtraction(A=k1_2, B=k2_2)
b1_3 = Number(subtraction_23)
addition_13 = Addition(A=multiplication_7, B=b2_2)  # disabled
b2_3 = Number(subtraction_24)
dom_3 = ConstructDomain(DomainStart=complex_12.Real, DomainEnd=complex_11.Real)
dom_4 = ConstructDomain(DomainStart=complex_13.Real, DomainEnd=complex_14.Real)
subtraction_26 = Subtraction(A=b2_3, B=b1_3)
division_7 = Division(A=subtraction_26, B=subtraction_25)
sift = SiftPattern(List=addition_13, SiftPattern=extendlinecount)  # -> Output0, Output1, Output2; disabled
sift_2 = SiftPattern(List=division_6, SiftPattern=extendlinecount)  # -> Output0, Output1, Output2; disabled
xy = XYPlane(Origin=Point(0, 0, 0))  # disabled
panel_16 = Panel(filter)
inc_3 = Includes(Value=division_7, Domain=dom_4)  # -> Includes, Deviation
inc_4 = Includes(Value=division_7, Domain=dom_3)  # -> Includes, Deviation
multiplication_8 = Multiplication(A=division_7, B=k2_2)
int_5 = Integer(inc_3.Includes)
addition_14 = Addition(A=multiplication_8, B=b2_3)
int_6 = Integer(inc_4.Includes)
pt_4 = PointOriented(BasePlane=xy, UComponent=sift_2.Output0, VComponent=sift.Output0, WComponent=0)  # disabled
flatten = FlattenTree(Tree=pt_4, Path="{0}")  # disabled
addition_15 = Addition(A=int_5, B=int_6)
xy_2 = XYPlane(Origin=Point(0, 0, 0))
clean = CleanTree(RemoveNulls=True, RemoveInvalid=True, RemoveEmpty=False, Tree=flatten)  # disabled
# 0 --> extend one line to intersect two lines
# 1 --> extend two lines
# 2 --> extend three lines
subtraction_27 = Subtraction(A="2", B=addition_15)
extendlinecount_2 = Integer(subtraction_27)
sift_3 = SiftPattern(List=addition_14, SiftPattern=extendlinecount_2)  # -> Output0, Output1, Output2
sift_4 = SiftPattern(List=division_7, SiftPattern=extendlinecount_2)  # -> Output0, Output1, Output2
intersection_x = Number(division_6)  # disabled
intersection_y = Number(addition_13)  # disabled
pt_5 = PointOriented(BasePlane=xy_2, UComponent=sift_4.Output0, VComponent=sift_3.Output0, WComponent=0)
xy_3 = XYPlane(Origin=Point(0, 0, 0))  # disabled
flatten_2 = FlattenTree(Tree=pt_5, Path="{0}")
pt_6 = PointOriented(BasePlane=xy_3, UComponent=intersection_x, VComponent=intersection_y, WComponent=0)  # disabled
panel_17 = Panel(extendlinecount)  # disabled
clean_2 = CleanTree(RemoveNulls=True, RemoveInvalid=True, RemoveEmpty=False, Tree=flatten_2)
pt_7 = Point(Point(-2.015690168, -16.36521091, 0))
intersection_x_2 = Number(division_7)
intersection_y_2 = Number(addition_14)
sift_5 = SiftPattern(List=pt_6, SiftPattern=extendlinecount)  # -> Output0, Output1, Output2; disabled
xy_4 = XYPlane(Origin=Point(0, 0, 0))
partition = PartitionList(List=clean_2, Size="2")
bang = ExplodeTree(Data=partition)  # -> Branch0, Branch1
rev = ReverseList(List=bang.Branch1)
intersectionontwolines = Point(sift_5.Output0)  # disabled
intersectionononeline = Point(sift_5.Output1)  # disabled
intersectiononextend = Point(sift_5.Output2)  # disabled
pt_8 = PointOriented(BasePlane=xy_4, UComponent=intersection_x_2, VComponent=intersection_y_2, WComponent=0)
panel_18 = Panel(extendlinecount_2)
merge_5 = Merge(Data1=bang.Branch0, Data2=rev)  # -> flatten(Result)
sift_6 = SiftPattern(List=pt_8, SiftPattern=extendlinecount_2)  # -> Output0, Output1, Output2
pline_2 = PolyLine(Vertices=merge_5, Closed=True)
intersectionontwolines_2 = Point(sift_6.Output0)
intersectionononeline_2 = Point(sift_6.Output1)
intersectiononextend_2 = Point(sift_6.Output2)
panel_19 = Panel(merge_5)
