# Grasshopper definition 160929_PE_points_intersection_006_polyline_treeData.gh (Grasshopper 0.9.76)

panel = Panel("""1
3
4
2
6
7""")
panel_2 = Panel("3")
partition = PartitionList(List=panel, Size="3")  # -> simplify(Chunks)
series = Series(Start=0, Step=1, Count=10)
num = Number(partition)
panel_3 = Panel(num)
panel_4 = Panel("""001
002""")
series_2 = Series(Start="2", Step=1, Count="5")
num_2 = Number(["2", "4"])
panel_5 = Panel(series)
replace = ReplaceMembers(Set=graft(series), Find=num, Replace=graft(panel_4))
mindex = MemberIndex(Set=series_2, Member=num_2)  # -> simplify(Index), Count
panel_6 = Panel(replace)
panel_7 = Panel(series_2)
panel_8 = Panel(mindex.Index)

line = Line([Line((-28.43570879, -32.87535514, 0), (26.13975502, -11.96140003, 0)), Line((18.7700756, 6.164027732, 0), (13.19302091, -43.43192296, 0)), Line((-30.62669456, -19.7294405, 0), (35.30205917, -38.25322931, 0)), Line((2.835633616, -1.404832213, 0), (-1.54633793, -45.62290873, 0))])  # disabled
panel_9 = Panel("1")  # disabled
linelist = Curve(line)  # disabled
lng = ListLength(List=linelist)  # disabled
subtraction = Subtraction(A=lng, B=panel_9)  # disabled
series_3 = Series(Start=0, Step=1, Count=subtraction)  # disabled
addition = Addition(A=series_3, B=panel_9)  # disabled
item = ListItem(List=linelist, Index=series_3, Wrap=False)  # -> simplify(graft(Item)); disabled
shift = ShiftList(List=linelist, Shift=addition, Wrap=False)  # -> simplify(List); disabled
end = EndPoints(Curve=item)  # -> Start, End; disabled
end_2 = EndPoints(Curve=shift)  # -> Start, End; disabled

panel_10 = Panel("""0
1
0
1
2
3""")

line_length = Panel("""3.2
5.1
6.3
4.2""")
panel_11 = Panel("""0
1
2
3""")
# Point:indicate a position in space
# Line:length,direction,position
# Point
# two ends of the line
# the intersection of two lines
# the meeting of lines at the corner of a space or volumn
# the center of field
md_slider = MDSlider(
    slider_value=Point(0.5132578379, 0.5396976122, 0.5),
    SliderMode=0,
    x_domain=Domain(-100, 100),
    y_domain=Domain(-100, 100),
    z_domain=Domain(0, 1))  # disabled
startpoint = Point(md_slider)  # disabled
line_length_2 = Number(line_length)
int = Integer(panel_11)
number_slider = Slider(0.52, range=0..100)  # disabled
number_slider_2 = Slider(2.4, range=0..100)  # disabled
number_slider_3 = Slider(7.61, range=0..100)  # disabled
number_slider_4 = Slider(6.19, range=0..100)  # disabled
item_2 = ListItem(List=["1,0", "0,1", "-1,0", "0,-1"], Index=int, Wrap=True)
item_3 = ListItem(List=line_length_2, Index=0, Wrap=True)
X = UnitX(Factor=1)
basicvector = Vector(item_2)
merge = Merge(Data1=number_slider, Data2=number_slider_2)  # disabled
merge_2 = Merge(Data1=number_slider_3, Data2=number_slider_4)  # disabled
amp = Amplitude(Vector=X, Amplitude=item_3)  # disabled
line_2 = LineSDL(Start=startpoint, Direction=X, Length=item_3)  # disabled
complex = ComplexComponents(Complex=startpoint)  # -> Real, Imaginary; disabled
pt = PointOriented(BasePlane=startpoint, UComponent=merge, VComponent=merge_2, WComponent=0)  # disabled
complex_2 = ComplexComponents(Complex=amp)  # -> Real, Imaginary; disabled
complex_3 = CreateComplex(Real=complex.Real, Imaginary=complex.Imaginary)  # disabled
complex_4 = CreateComplex(Real=complex_2.Real, Imaginary=complex_2.Imaginary)  # disabled
item_4 = ListItem(List=pt, Index=0, Wrap=True)  # -> Item, Item1; disabled
X_2 = UnitX(Factor=1)  # disabled
Y = UnitY(Factor=1)  # disabled
addition_2 = Addition(A=complex_3, B=complex_4)  # disabled
line_3 = LineSDL(Start=item_4.Item1, Direction=Y, Length=item_3)  # disabled
line_4 = LineSDL(Start=item_4.Item, Direction=X_2, Length=item_3)  # disabled
panel_12 = Panel(addition_2)  # disabled
panel_13 = Panel("""1,2
2,1""")  # disabled
panel_14 = Panel("""2.0,2.0,0.0
-0.5,4.0,0.0""")  # disabled
panel_15 = Panel(complex_3)  # disabled
startpoint_2 = Point(panel_13)  # disabled
vec = Vector(panel_14)  # disabled
addition_3 = Addition(A=startpoint_2, B=vec)  # disabled
vec2pt = Vector2Pt(PointA=startpoint_2, PointB=addition_3, Unitize=False)  # -> Vector, Length; disabled
ln = Line(StartPoint=startpoint_2, EndPoint=addition_3)  # disabled
endpoint = Point(addition_3)  # disabled

line_length_3 = Panel("""3.2
5.1
3.2
5.1
6.4
10.2""")

Y_2 = UnitY(Factor=1)
X_3 = UnitX(Factor=1)
rev = Reverse(Vector=Y_2)
vlen = VectorLength(Vector=rev)
vlen_2 = VectorLength(Vector=X_3)
multiplication = Multiplication(A=X_3, B=rev)
multiplication_2 = Multiplication(A=vlen_2, B=vlen)
division = Division(A=multiplication, B=multiplication_2)
acos = ArcCosine(Value=division)

panel_16 = Panel("""0
1
2
3""")
line_length_4 = Panel("""3.2
5.1
3.2
5.1""")
md_slider_2 = MDSlider(
    slider_value=Point(0.4899997711, 0.4549980164, 0.5),
    SliderMode=0,
    x_domain=Domain(0, 1),
    y_domain=Domain(0, 1),
    z_domain=Domain(0, 1))
end_3 = EndPoints(Curve=linelist)  # -> Start, End; disabled
panel_17 = Panel("""用字符串的方法表示还差最后一步，那么先拆开来用判断的方法做
拆开的方法很繁琐，索性还是用字符串替换的方法
检查目前的替换方法是否可以简化
并且找出到各个边的距离最近点""")
subtraction_2 = Subtraction(A=end_3.End, B=end_3.Start)  # disabled
line_length_5 = Number(line_length_3)
panel_18 = Panel("""1,0
0,1
-1,0
0,-1""")
startpoint_3 = Point(end_3.Start)  # disabled
vec_2 = Vector(subtraction_2)  # disabled
vec_3 = Vector(panel_18)
int_2 = Integer(panel_10)
lng_2 = ListLength(List=int_2)
addition_4 = Addition(A=startpoint_3, B=vec_2)  # disabled
endpoint_2 = Point(addition_4)  # disabled
lng_3 = ListLength(List=addition_4)  # disabled
lng_4 = ListLength(List=startpoint_3)  # disabled
series_4 = Series(Start=0, Step=1, Count=lng_2)
panel_19 = Panel("1")  # disabled
panel_20 = Panel(startpoint_3)  # disabled
panel_21 = Panel("1")  # disabled
item_5 = ListItem(List=vec_3, Index=int_2, Wrap=True)
panel_22 = Panel(item_5)
subtraction_3 = Subtraction(A=lng_3, B=panel_19)  # disabled
subtraction_4 = Subtraction(A=lng_4, B=panel_21)  # disabled
item_6 = ListItem(List=line_length_5, Index=series_4, Wrap=True)
basicvectorunit = Vector(item_5)
series_5 = Series(Start=0, Step=1, Count=subtraction_4)  # disabled
series_6 = Series(Start=0, Step=1, Count=subtraction_3)  # disabled
amp_2 = Amplitude(Vector=basicvectorunit, Amplitude=item_6)
addition_5 = Addition(A=series_6, B=panel_19)  # disabled
addition_6 = Addition(A=series_5, B=panel_21)  # disabled
number_slider_5 = Slider(6, range=0..100)  # disabled
item_7 = ListItem(List=startpoint_3, Index=series_5, Wrap=False)  # -> simplify(graft(Item)); disabled
item_8 = ListItem(List=addition_4, Index=series_6, Wrap=False)  # -> simplify(graft(Item)); disabled
shift_2 = ShiftList(List=addition_4, Shift=addition_5, Wrap=False)  # -> simplify(List); disabled
shift_3 = ShiftList(List=startpoint_3, Shift=addition_6, Wrap=False)  # -> simplify(List); disabled
ma = MassAddition(Input=amp_2)  # -> Result, PartialResults
addition_7 = Addition(A=md_slider_2, B=ma.PartialResults)
pt_2 = Point(ma.PartialResults)
shift_4 = ShiftList(List=ma.PartialResults, Shift=-1, Wrap=True)
complex_5 = ComplexComponents(Complex=shift_4)  # -> Real, Imaginary
firstpt0 = Point(item_7)  # disabled
firstpt1 = Point(shift_3)  # disabled
endpt0 = Point(item_8)  # disabled
endpt1 = Point(shift_2)  # disabled
points = PointList(Points=flatten(firstpt0), Size=number_slider_5)  # disabled
# describe space by (point;index) of vector
concat = Concatenate(FragmentA=complex_5.Real, FragmentB=complex_5.Imaginary, JoinSeparator=",")
item_9 = ListItem(List=amp_2, Index=graft(series_4), Wrap=True)
complex_6 = ComplexComponents(Complex=endpt1)  # -> Real, Imaginary; disabled
complex_7 = ComplexComponents(Complex=firstpt1)  # -> Real, Imaginary; disabled
complex_8 = ComplexComponents(Complex=firstpt0)  # -> Real, Imaginary; disabled
complex_9 = ComplexComponents(Complex=endpt0)  # -> Real, Imaginary; disabled
pline = PolyLine(Vertices=pt_2, Closed=True)
concat_2 = Concatenate(FragmentA=concat, FragmentB=int_2, JoinSeparator=";")
item_10 = ListItem(List=concat_2, Index=series_4, Wrap=True)
split = TextSplit(Text=item_10, Separators=";")  # -> simplify(Result)
item_11 = ListItem(List=split, Index=0, Wrap=True)  # -> Item, Item1
pt_3 = Point(item_11.Item)
subtraction_5 = Subtraction(A=complex_8.Real, B=complex_9.Real)  # disabled
subtraction_6 = Subtraction(A=complex_8.Imaginary, B=complex_9.Imaginary)  # disabled
subtraction_7 = Subtraction(A=complex_7.Real, B=complex_6.Real)  # disabled
subtraction_8 = Subtraction(A=complex_7.Imaginary, B=complex_6.Imaginary)  # disabled
addition_8 = Addition(A=pt_3, B=item_9)
division_2 = Division(A=subtraction_6, B=subtraction_5)  # disabled
division_3 = Division(A=subtraction_8, B=subtraction_7)  # disabled
firstpt0_2 = Point(item_11.Item)
endpt0_2 = Point(addition_8)
panel_23 = Panel(concat_2)
k2 = Number(division_3)  # disabled
multiplication_3 = Multiplication(A=k2, B=complex_6.Real)  # disabled
k1 = Number(division_2)  # disabled
multiplication_4 = Multiplication(A=k1, B=complex_9.Real)  # disabled
complex_10 = ComplexComponents(Complex=endpt0_2)  # -> Real, Imaginary
complex_11 = ComplexComponents(Complex=firstpt0_2)  # -> Real, Imaginary
subtraction_9 = Subtraction(A=complex_9.Imaginary, B=multiplication_4)  # disabled
subtraction_10 = Subtraction(A=complex_6.Imaginary, B=multiplication_3)  # disabled
pt_4 = Point(Point(1.488717773, 12.13872048, 0))
subtraction_11 = Subtraction(A=k1, B=k2)  # disabled
b1 = Number(subtraction_9)  # disabled
subtraction_12 = Subtraction(A=complex_11.Imaginary, B=complex_10.Imaginary)
subtraction_13 = Subtraction(A=complex_11.Real, B=complex_10.Real)
b2 = Number(subtraction_10)  # disabled
complex_12 = ComplexComponents(Complex=pt_4)  # -> Real, Imaginary

y = Number(complex_12.Imaginary)
x = Number(complex_12.Real)
larger = LargerThan(FirstNumber=complex_11.Real, SecondNumber=x)  # -> LargerThan, OrEqualTo
larger_2 = LargerThan(FirstNumber=complex_11.Imaginary, SecondNumber=y)  # -> LargerThan, OrEqualTo
int_3 = Integer(larger.LargerThan)
int_4 = Integer(larger_2.LargerThan)
concat_3 = Concatenate(FragmentA=int_3, FragmentB=int_4)

# ---- group: vector match concept Error
panel_24 = Panel("""010
012
110
112""")
panel_25 = Panel("""101
103
111
113""")
panel_26 = Panel("""001
003
011
013""")
panel_27 = Panel("""000
002
100
102""")
merge_3 = Merge(Data1=panel_25, Data2=panel_24, Data3=panel_26, Data4=panel_27)
entwine = Entwine(Branch00=panel_25, Branch01=panel_24, Branch02=panel_26, Branch03=panel_27, FlattenInputs=True)  # -> simplify(Result)
concat_4 = Concatenate(FragmentA=concat_3, FragmentB=item_11.Item1)
flatten = FlattenTree(Tree=concat_4, Path="{0}")
mindex_2 = MemberIndex(Set=merge_3, Member=flatten)  # -> Index, Count
division_4 = Division(A=mindex_2.Index, B="4")
int_5 = Integer(division_4)
item_12 = ListItem(List=vec_3, Index=int_5, Wrap=True)

mindex_3 = MemberIndex(Set=entwine, Member=flatten)  # -> Index, Count
clean = CleanTree(RemoveNulls=True, RemoveInvalid=True, RemoveEmpty=True, Tree=mindex_3.Index)
tstat = TreeStatistics(Tree=clean)  # -> Paths, Length, Count
split_2 = TextSplit(Text=tstat.Paths, Separators=";")
item_13 = ListItem(List=split_2, Index="0", Wrap=True)
split_3 = TextSplit(Text=item_13, Separators="{")
item_14 = ListItem(List=split_3, Index="1", Wrap=True)  # -> simplify(Item)

equals = Equality(FirstNumber=graft(flatten), SecondNumber=merge_3)  # -> Equality, Inequality
mindex_4 = MemberIndex(Set=equals.Equality, Member=Toggle(True))  # -> Index, Count

# ----
subtraction_14 = Subtraction(A=b2, B=b1)  # disabled
division_5 = Division(A=subtraction_14, B=subtraction_11)  # disabled

# ----
# 0 --> extend one line to intersect two lines
# 1 --> extend two lines
# 2 --> extend three lines
dom = ConstructDomain(DomainStart=complex_7.Real, DomainEnd=complex_6.Real)  # disabled
dom_2 = ConstructDomain(DomainStart=complex_8.Real, DomainEnd=complex_9.Real)  # disabled
inc = Includes(Value=division_5, Domain=dom_2)  # -> Includes, Deviation; disabled
inc_2 = Includes(Value=division_5, Domain=dom)  # -> Includes, Deviation; disabled
int_6 = Integer(inc.Includes)  # disabled
int_7 = Integer(inc_2.Includes)  # disabled
addition_9 = Addition(A=int_6, B=int_7)  # disabled
panel_28 = Panel("2")  # disabled
subtraction_15 = Subtraction(A=panel_28, B=addition_9)  # disabled
extendlinecount = Integer(subtraction_15)  # disabled

division_6 = Division(A=subtraction_12, B=subtraction_13)
multiplication_5 = Multiplication(A=division_5, B=k2)  # disabled
k1_2 = Number(division_6)
multiplication_6 = Multiplication(A=k1_2, B=complex_10.Real)
addition_10 = Addition(A=multiplication_5, B=b2)  # disabled
subtraction_16 = Subtraction(A=complex_10.Imaginary, B=multiplication_6)
sift = SiftPattern(List=addition_10, SiftPattern=extendlinecount)  # -> Output0, Output1, Output2; disabled
sift_2 = SiftPattern(List=division_5, SiftPattern=extendlinecount)  # -> Output0, Output1, Output2; disabled
xy = XYPlane(Origin=Point(0, 0, 0))  # disabled
b1_2 = Number(subtraction_16)

# ----
# distances between points and space boundary
null = NullItem(Item=k1_2)  # -> NullFlags, InvalidFlags, Description
sift_3 = SiftPattern(List=pt_3, SiftPattern=null.NullFlags)  # -> Output0, Output1
complex_13 = ComplexComponents(Complex=sift_3.Output1)  # -> Real, Imaginary
eval = Evaluate(F="abs(k*x0-y0+b)/sqrt(k*k+1)", k=k1_2, b=b1_2, x0=complex_12.Real, y0=complex_12.Imaginary)
subtraction_17 = Subtraction(A=complex_12.Real, B=complex_13.Real)  # -> simplify(Result)
distance = Number(eval)
abs = Absolute(Value=subtraction_17)  # -> simplify(Result)
combine = CombineData(Input0=distance, Input1=abs)  # -> Result, Index

# ---- group: vector match method 1
concat_5 = Concatenate(FragmentA=concat_3, FragmentB=item_11.Item1)
flatten_2 = FlattenTree(Tree=concat_5, Path="{0}")
panel_29 = Panel("""000
002
100
102""")
panel_30 = Panel("""010
012
110
112""")
panel_31 = Panel("""101
103
111
113""")
panel_32 = Panel("""001
003
011
013""")
mindex_5 = MemberIndex(Set=panel_32, Member=flatten_2)  # -> Index, Count
mindex_6 = MemberIndex(Set=panel_29, Member=flatten_2)  # -> Index, Count
mindex_7 = MemberIndex(Set=panel_31, Member=flatten_2)  # -> Index, Count
mindex_8 = MemberIndex(Set=panel_30, Member=flatten_2)  # -> Index, Count
clean_2 = CleanTree(RemoveNulls=True, RemoveInvalid=True, RemoveEmpty=True, Tree=mindex_8.Index)
clean_3 = CleanTree(RemoveNulls=True, RemoveInvalid=True, RemoveEmpty=True, Tree=mindex_6.Index)
clean_4 = CleanTree(RemoveNulls=True, RemoveInvalid=True, RemoveEmpty=True, Tree=mindex_7.Index)
clean_5 = CleanTree(RemoveNulls=True, RemoveInvalid=True, RemoveEmpty=True, Tree=mindex_5.Index)
replace_2 = ReplaceItems(List=clean_4, Item="0", Indices="0", Wrap=False)
replace_3 = ReplaceItems(List=clean_2, Item="1", Indices="0", Wrap=False)
replace_4 = ReplaceItems(List=clean_5, Item="2", Indices="0", Wrap=False)
replace_5 = ReplaceItems(List=clean_3, Item="3", Indices="0", Wrap=False)
merge_4 = Merge(Data1=replace_2, Data2=replace_3, Data3=replace_4, Data4=replace_5)
item_15 = ListItem(List=vec_3, Index=merge_4, Wrap=True)
amp_3 = Amplitude(Vector=item_15, Amplitude=combine.Result)
vdis = VectorDisplay(Anchor=pt_4, Vector=amp_3)

# ---- group: vector match method 0 Error
# left-down;x-axis
# left-up;y-axis
a = Number(complex_11.Real)
b = Number(complex_11.Imaginary)
y_2 = Number(complex_12.Imaginary)
x_2 = Number(complex_12.Real)
item_16 = ListItem(List=vec_3, Index=item_11.Item1, Wrap=True)
smaller = SmallerThan(FirstNumber=b, SecondNumber=y_2)  # -> SmallerThan, OrEqualTo
not = GateNot(A=smaller.SmallerThan)
smaller_2 = SmallerThan(FirstNumber=a, SecondNumber=x_2)  # -> SmallerThan, OrEqualTo
and = GateAnd(A=smaller_2.SmallerThan, B=not)
equals_2 = Equality(FirstNumber="0", SecondNumber=graft(int_2))  # -> Equality, Inequality
equals_3 = Equality(FirstNumber="2", SecondNumber=graft(int_2))  # -> Equality, Inequality
and_2 = GateAnd(A=smaller_2.SmallerThan, B=smaller.SmallerThan)
equals_4 = Equality(FirstNumber="1", SecondNumber=graft(int_2))  # -> Equality, Inequality
equals_5 = Equality(FirstNumber="3", SecondNumber=graft(int_2))  # -> Equality, Inequality
or = GateOr(A=equals_2.Equality, B=equals_3.Equality)
or_2 = GateOr(A=equals_4.Equality, B=equals_5.Equality)
and_3 = GateAnd(A=or_2, B=and_2)
and_4 = GateAnd(A=or, B=and)
or_3 = GateOr(A=and_3, B=and_4)
sift_4 = SiftPattern(List=item_16, SiftPattern=or_3)  # -> Output0, Output1
pi = Pi(Factor="0.5")
Z = UnitZ(Factor=1)
neg = Negative(Value=pi)
vrot = Rotate(Vector=sift_4.Output0, Axis=Z, Angle=neg)
vrot_2 = Rotate(Vector=sift_4.Output1, Axis=Z, Angle=pi)
combine_2 = CombineData(Input0=vrot, Input1=vrot_2)  # -> Result, Index
amp_4 = Amplitude(Vector=combine_2.Result, Amplitude=combine.Result)
vdis_2 = VectorDisplay(Anchor=pt_4, Vector=amp_4)

# ----
# vectors between points and space boundary
panel_33 = Panel("0.5")  # disabled
item_17 = ListItem(List=vec_3, Index=item_11.Item1, Wrap=True)  # disabled
pi_2 = Pi(Factor=panel_33)  # disabled
neg_2 = Negative(Value=pi_2)  # disabled
Z_2 = UnitZ(Factor=1)  # disabled
vrot_3 = Rotate(Vector=item_17, Axis=Z_2, Angle=neg_2)  # disabled
amp_5 = Amplitude(Vector=vrot_3, Amplitude=combine.Result)  # disabled

pt_5 = PointOriented(BasePlane=xy, UComponent=sift_2.Output0, VComponent=sift.Output0, WComponent=0)  # disabled
panel_34 = Panel("abs(k*x0-y0+b)/sqrt(k*k+1)")
panel_35 = Panel("(k*x0-y0+b)/sqrt(k*k+1)")
panel_36 = Panel("-(k*x0-y0+b)/sqrt(k*k+1)")
flatten_3 = FlattenTree(Tree=pt_5, Path="{0}")  # disabled
clean_6 = CleanTree(RemoveNulls=True, RemoveInvalid=True, RemoveEmpty=False, Tree=flatten_3)  # disabled
intersection_x = Number(division_5)  # disabled
intersection_y = Number(addition_10)  # disabled
xy_2 = XYPlane(Origin=Point(0, 0, 0))  # disabled
pt_6 = PointOriented(BasePlane=xy_2, UComponent=intersection_x, VComponent=intersection_y, WComponent=0)  # disabled
panel_37 = Panel(extendlinecount)  # disabled
panel_38 = Panel(eval)
sift_5 = SiftPattern(List=pt_6, SiftPattern=extendlinecount)  # -> Output0, Output1, Output2; disabled
intersectionontwolines = Point(sift_5.Output0)  # disabled
intersectionononeline = Point(sift_5.Output1)  # disabled
intersectiononextend = Point(sift_5.Output2)  # disabled
panel_39 = Panel(combine.Result)
line_length_6 = Panel("""3.2
5.1
3.2
5.1
6.4
10.2""")
panel_40 = Panel("""0
1
0
1
2
3""")
panel_41 = Panel("多条线且含有多折线连线组织数据结构问题")
panel_42 = Panel("描述方法只是数据结构的不同，先用几何代表抽象的数据结构")
panel_43 = Panel("""x0,y0;0,1,2,3
x1,y0;0,3,2""")
md_slider_3 = MDSlider(
    slider_value=Point(0.5591201782, 0.4691162109, 0.5),
    SliderMode=0,
    x_domain=Domain(-1000, 1000),
    y_domain=Domain(-1000, 1000),
    z_domain=Domain(0, 1))
panel_44 = Panel("""0
1
2
3""")
line_length_7 = Panel("""3.2
5.1
3.2
5.1""")
crv = Curve([<curve referenced from the Rhino model> x3])
explode = Explode(Curve=crv, Recursive=True)  # -> Segments, Vertices
end_4 = EndPoints(Curve=crv)  # -> Start, End
line_length_8 = Number(line_length_7)
neg_3 = Negative(Value="1")

panel_45 = Panel("""1,0
0,1
-1,0
0,-1""")
vec_4 = Vector(panel_45)

int_8 = Integer(panel_44)
lng_5 = ListLength(List=int_8)
shift_5 = ShiftList(List=explode.Vertices, Shift="1", Wrap=False)
shift_6 = ShiftList(List=explode.Vertices, Shift=neg_3, Wrap=False)
series_7 = Series(Start=0, Step=1, Count=lng_5)
subtraction_18 = Subtraction(A=shift_5, B=shift_6)

# ----
# 首点坐标相对于第一点
graft = GraftTree(Tree=end_4.Start, IncludeEmptyLists=True, IncludeNullItems=True)  # -> simplify(Tree)
subtraction_19 = Subtraction(A=graft, B="{0,0,0}")  # -> flatten(Result)
item_18 = ListItem(List=subtraction_19, Index="0", Wrap=True)
subtraction_20 = Subtraction(A=graft, B=item_18)

item_19 = ListItem(List=vec_4, Index=int_8, Wrap=True)
# curve convert to direction and length
unit = UnitVector(Vector=subtraction_18)
item_20 = ListItem(List=line_length_8, Index=series_7, Wrap=True)
vec_5 = Vector(subtraction_18)
panel_46 = Panel(item_19)
len = Length(Curve=explode.Segments)  # -> simplify(Length)
pshift = ShiftPaths(Data=unit, Offset=-1)
basicvectorunit_2 = Vector(item_19)
mindex_9 = MemberIndex(Set=vec_4, Member=pshift)  # -> Index, Count
vdis_3 = VectorDisplay(Anchor=shift_6, Vector=vec_5)
amp_6 = Amplitude(Vector=basicvectorunit_2, Amplitude=item_20)
pshift_2 = ShiftPaths(Data=mindex_9.Index, Offset=-1)  # -> simplify(Data)
ma_2 = MassAddition(Input=amp_6)  # -> Result, PartialResults
addition_11 = Addition(A=md_slider_3, B=ma_2.PartialResults)
pt_7 = Point(addition_11)

vecdirection = Integer(pshift_2)
veclength = Number(len)
pt_8 = Point(graft)

startpoint_4 = Point(pt_8)
tstat_2 = TreeStatistics(Tree=startpoint_4)  # -> Paths, Length, Count
shift_7 = ShiftList(List=tstat_2.Paths, Shift="-1", Wrap=False)
shift_8 = ShiftList(List=tstat_2.Paths, Shift="1", Wrap=False)
branch = TreeBranch(Tree=startpoint_4, Path=shift_7, MaintainPaths=True)
branch_2 = TreeBranch(Tree=startpoint_4, Path=shift_8, MaintainPaths=True)
shift_9 = ShiftList(List=ma_2.PartialResults, Shift=-1, Wrap=True)
complex_14 = ComplexComponents(Complex=shift_9)  # -> Real, Imaginary
item_21 = ListItem(List=vec_4, Index=vecdirection, Wrap=True)
# describe space by (point;index) of vector
concat_6 = Concatenate(FragmentA=complex_14.Real, FragmentB=complex_14.Imaginary, JoinSeparator=",")
amp_7 = Amplitude(Vector=item_21, Amplitude=veclength)
vec_6 = Vector(amp_7)
ma_3 = MassAddition(Input=vec_6)  # -> Result, PartialResults
addition_12 = Addition(A=startpoint_4, B=ma_3.PartialResults)

endpoint_3 = Point(addition_12)
lng_6 = ListLength(List=startpoint_4)
lng_7 = ListLength(List=addition_12)
subtraction_21 = Subtraction(A=lng_7, B="1")
subtraction_22 = Subtraction(A=lng_6, B="1")
series_8 = Series(Start=0, Step=1, Count=subtraction_22)
series_9 = Series(Start=0, Step=1, Count=subtraction_21)
addition_13 = Addition(A=series_8, B="1")
addition_14 = Addition(A=series_9, B="1")
item_22 = ListItem(List=startpoint_4, Index=series_8, Wrap=False)  # -> simplify(graft(Item))
item_23 = ListItem(List=addition_12, Index=series_9, Wrap=False)  # -> simplify(graft(Item))
shift_10 = ShiftList(List=startpoint_4, Shift=addition_13, Wrap=False)  # -> simplify(List)
shift_11 = ShiftList(List=addition_12, Shift=addition_14, Wrap=False)  # -> simplify(List)

tstat_3 = TreeStatistics(Tree=addition_12)  # -> Paths, Length, Count
shift_12 = ShiftList(List=tstat_3.Paths, Shift="1", Wrap=False)
shift_13 = ShiftList(List=tstat_3.Paths, Shift="-1", Wrap=False)
# second Line
branch_3 = TreeBranch(Tree=addition_12, Path=shift_12, MaintainPaths=True)
# firstLine
branch_4 = TreeBranch(Tree=addition_12, Path=shift_13, MaintainPaths=True)
pline_2 = PolyLine(Vertices=pt_7, Closed=True)
ma_4 = MassAddition(Input=amp_7)  # -> Result, PartialResults
concat_7 = Concatenate(FragmentA=concat_6, FragmentB=int_8, JoinSeparator=";")
addition_15 = Addition(A=pt_8, B=ma_4.PartialResults)
panel_47 = Panel(amp_6)
ins = InsertItems(List=addition_15, Item=pt_8, Indices="0", Wrap=True)
pt_9 = Point(addition_15)
panel_48 = Panel(concat_7)
panel_49 = Panel(pt_8)
neg_4 = Negative(Value="1")
panel_50 = Panel(ins)
# each line first point
shift_14 = ShiftList(List=ins, Shift=neg_4, Wrap=False)  # -> simplify(List)

# ----
# tree data trial
# first point 和 end point 的数据结构组织的方式是同一种的
# 
# 先手工傻做，再寻找规律
# 
# 先不管结构如何，把他们放在一起，结构在外部运算，在替换成对的树形数据
# 上升数据结构后手工或者数列
# 上升后全部拍平处理
# 用stack+listItem对拍平的数据处理
# 
# 留下来的问题是数据结构的替换
# 手工
pt_10 = Point(shift_14)
graft_2 = GraftTree(Tree=pt_10, IncludeEmptyLists=True, IncludeNullItems=True)

flatten_4 = FlattenTree(Tree=graft_2, Path="{0}")
tstat_4 = TreeStatistics(Tree=pt_10)  # -> Paths, Length, Count
tstat_5 = TreeStatistics(Tree=graft_2)  # -> Paths, Length, Count
ma_5 = MassAddition(Input=tstat_4.Length)  # -> Result, PartialResults
series_10 = Series(Start=0, Step=1, Count=tstat_5.Count)
stack = StackData(Data=ma_5.PartialResults, Stack=tstat_4.Length)
shift_15 = ShiftList(List=series_10, Shift=stack, Wrap=False)
item_24 = ListItem(List=flatten_4, Index=shift_15, Wrap=True)  # -> simplify(Item)

bang = ExplodeTree(Data=graft_2)  # -> Branch0, Branch1, Branch2, Branch3, Branch4, Branch5; disabled
merge_5 = Merge(Data1=bang.Branch1, Data2=bang.Branch2, Data3=bang.Branch3, Data4=bang.Branch4, Data5=bang.Branch5)  # disabled
entwine_2 = Entwine(
    Branch00=merge_5,
    Branch01=bang.Branch5,
    Branch02=bang.Branch5,
    Branch03=bang.Branch5,
    Branch04=bang.Branch5,
    FlattenInputs=True)  # disabled

viewer = ParamViewer()
replace_6 = ReplacePaths(Data=item_24, Search=viewer)

panel_51 = Panel(graft_2)
# each line end point
shift_16 = ShiftList(List=ins, Shift="1", Wrap=False)  # -> simplify(List)
graft_3 = GraftTree(Tree=shift_14, IncludeEmptyLists=True, IncludeNullItems=True)

flatten_5 = FlattenTree(Tree=graft_3, Path="{0}")
tstat_6 = TreeStatistics(Tree=shift_14)  # -> Paths, Length, Count
tstat_7 = TreeStatistics(Tree=graft_3)  # -> Paths, Length, Count
ma_6 = MassAddition(Input=tstat_6.Length)  # -> Result, PartialResults
series_11 = Series(Start=0, Step=1, Count=tstat_7.Count)
stack_2 = StackData(Data=ma_6.PartialResults, Stack=tstat_6.Length)
shift_17 = ShiftList(List=series_11, Shift=stack_2, Wrap=False)
item_25 = ListItem(List=flatten_5, Index=shift_17, Wrap=True)  # -> simplify(Item)
viewer_2 = ParamViewer()
replace_7 = ReplacePaths(Data=item_25, Search=viewer_2)

graft_4 = GraftTree(Tree=shift_16, IncludeEmptyLists=True, IncludeNullItems=True)

# ----
# kernel tree data
flatten_6 = FlattenTree(Tree=graft_4, Path="{0}")
tstat_8 = TreeStatistics(Tree=shift_16)  # -> Paths, Length, Count
tstat_9 = TreeStatistics(Tree=graft_4)  # -> Paths, Length, Count
ma_7 = MassAddition(Input=tstat_8.Length)  # -> Result, PartialResults
series_12 = Series(Start=0, Step=1, Count=tstat_9.Count)
stack_3 = StackData(Data=ma_7.PartialResults, Stack=tstat_8.Length)
shift_18 = ShiftList(List=series_12, Shift=stack_3, Wrap=False)
item_26 = ListItem(List=flatten_6, Index=shift_18, Wrap=True)  # -> simplify(Item)
viewer_3 = ParamViewer()
replace_8 = ReplacePaths(Data=item_26, Search=viewer_3)

panel_52 = Panel(item_24)
addition_16 = Addition(A=pt_8)

firstpt_line0 = Point(graft_3)
firstpt_line1 = Point(item_25)
endpt_line0 = Point(graft_4)
endpt_line1 = Point(item_26)

# ----
# explore a point position in space
# 0 --> extend one line to intersect two lines
# 1 --> extend two lines
# 2 --> extend three lines
line_5 = Line([Line((-24.40860271, -49.55265212, 0), (8.180806958, -33.66531491, 0)), Line((-1.799699753, -27.75848441, 0), (-1.799699753, -50.36738737, 0))])  # disabled
panel_53 = Panel("1")  # disabled
linelist_2 = Curve(line_5)  # disabled
lng_8 = ListLength(List=linelist_2)  # disabled
subtraction_23 = Subtraction(A=lng_8, B=panel_53)  # disabled
series_13 = Series(Start=0, Step=1, Count=subtraction_23)  # disabled
addition_17 = Addition(A=series_13, B=panel_53)  # disabled
item_27 = ListItem(List=linelist_2, Index=series_13, Wrap=False)  # -> simplify(graft(Item)); disabled
shift_19 = ShiftList(List=linelist_2, Shift=addition_17, Wrap=False)  # -> simplify(List); disabled
end_5 = EndPoints(Curve=item_27)  # -> Start, End; disabled
end_6 = EndPoints(Curve=shift_19)  # -> Start, End; disabled
end_7 = EndPoints(Curve=linelist_2)  # -> Start, End; disabled
panel_54 = Panel("1")  # disabled
panel_55 = Panel("1")  # disabled
number_slider_6 = Slider(6, range=0..100)  # disabled
panel_56 = Panel("0")  # disabled
panel_57 = Panel("0")  # disabled
panel_58 = Panel("处理k不存在的情况")  # disabled
equals_6 = Equality()  # -> Equality, Inequality; disabled
panel_59 = Panel("2")  # disabled
xy_3 = XYPlane(Origin=Point(0, 0, 0))  # disabled

subtraction_24 = Subtraction(A=end_7.End, B=end_7.Start)  # disabled
startpoint_5 = Point(end_7.Start)  # disabled

vec_7 = Vector(subtraction_24)  # disabled
addition_18 = Addition(A=startpoint_5, B=vec_7)  # disabled
endpoint_4 = Point(addition_18)  # disabled
lng_9 = ListLength(List=addition_18)  # disabled
lng_10 = ListLength(List=startpoint_5)  # disabled
panel_60 = Panel(startpoint_5)  # disabled
subtraction_25 = Subtraction(A=lng_9, B=panel_54)  # disabled
subtraction_26 = Subtraction(A=lng_10, B=panel_55)  # disabled
series_14 = Series(Start=0, Step=1, Count=subtraction_26)  # disabled
series_15 = Series(Start=0, Step=1, Count=subtraction_25)  # disabled
addition_19 = Addition(A=series_15, B=panel_54)  # disabled
addition_20 = Addition(A=series_14, B=panel_55)  # disabled
item_28 = ListItem(List=startpoint_5, Index=series_14, Wrap=False)  # -> simplify(graft(Item)); disabled
item_29 = ListItem(List=addition_18, Index=series_15, Wrap=False)  # -> simplify(graft(Item)); disabled
shift_20 = ShiftList(List=addition_18, Shift=addition_19, Wrap=False)  # -> simplify(List); disabled
shift_21 = ShiftList(List=startpoint_5, Shift=addition_20, Wrap=False)  # -> simplify(List); disabled
firstpt1_2 = Point(shift_21)  # disabled
firstpt0_3 = Point(item_28)  # disabled
endpt0_3 = Point(item_29)  # disabled
endpt1_2 = Point(shift_20)  # disabled
points_2 = PointList(Points=flatten(firstpt0_3), Size=number_slider_6)  # disabled
panel_61 = Panel(firstpt0_3)  # disabled
complex_15 = ComplexComponents(Complex=firstpt1_2)  # -> Real, Imaginary; disabled
complex_16 = ComplexComponents(Complex=endpt1_2)  # -> Real, Imaginary; disabled
complex_17 = ComplexComponents(Complex=firstpt0_3)  # -> Real, Imaginary; disabled
complex_18 = ComplexComponents(Complex=endpt0_3)  # -> Real, Imaginary; disabled
subtraction_27 = Subtraction(A=complex_15.Imaginary, B=complex_16.Imaginary)  # disabled
subtraction_28 = Subtraction(A=complex_17.Real, B=complex_18.Real)  # disabled
equals_7 = Equality(FirstNumber=subtraction_28, SecondNumber=panel_57)  # -> Equality, Inequality; disabled
sift_6 = SiftPattern(List=complex_17.Real, SiftPattern=equals_7.Equality)  # -> Output0, Output1; disabled
subtraction_29 = Subtraction(A=complex_15.Real, B=complex_16.Real)  # disabled
equals_8 = Equality(FirstNumber=subtraction_29, SecondNumber=panel_56)  # -> Equality, Inequality; disabled
sift_7 = SiftPattern(List=complex_16.Real, SiftPattern=equals_8.Equality)  # -> Output0, Output1; disabled
subtraction_30 = Subtraction(A=complex_17.Imaginary, B=complex_18.Imaginary)  # disabled
combine_3 = CombineData(Input0=sift_6.Output1, Input1=sift_7.Output1)  # -> Result, Index; disabled
panel_62 = Panel(complex_17.Real)  # disabled
division_7 = Division(A=subtraction_27, B=subtraction_29)  # disabled
division_8 = Division(A=subtraction_30, B=subtraction_28)  # disabled
panel_63 = Panel(subtraction_29)  # disabled
panel_64 = Panel(equals_8.Equality)  # disabled
k1_3 = Number(division_8)  # disabled
multiplication_7 = Multiplication(A=k1_3, B=complex_18.Real)  # disabled
k2_2 = Number(division_7)  # disabled
multiplication_8 = Multiplication(A=k2_2, B=complex_16.Real)  # disabled
subtraction_31 = Subtraction(A=complex_18.Imaginary, B=multiplication_7)  # disabled
panel_65 = Panel(k1_3)  # disabled
subtraction_32 = Subtraction(A=complex_16.Imaginary, B=multiplication_8)  # disabled
subtraction_33 = Subtraction(A=k1_3, B=k2_2)  # disabled
b1_3 = Number(subtraction_31)  # disabled
dom_3 = ConstructDomain(DomainStart=complex_17.Real, DomainEnd=complex_18.Real)  # disabled
b2_2 = Number(subtraction_32)  # disabled
dom_4 = ConstructDomain(DomainStart=complex_15.Real, DomainEnd=complex_16.Real)  # disabled
subtraction_34 = Subtraction(A=b2_2, B=b1_3)  # disabled
nullrep = ReplaceNulls(Items=k1_3, Replacements=complex_17.Real)  # -> Items, Count; disabled
division_9 = Division(A=subtraction_34, B=subtraction_33)  # disabled
panel_66 = Panel(division_9)  # disabled
inc_3 = Includes(Value=division_9, Domain=dom_3)  # -> Includes, Deviation; disabled
inc_4 = Includes(Value=division_9, Domain=dom_4)  # -> Includes, Deviation; disabled
multiplication_9 = Multiplication(A=division_9, B=k2_2)  # disabled
panel_67 = Panel(nullrep.Items)  # disabled
nullrep_2 = ReplaceNulls(Items=division_9, Replacements=combine_3.Result)  # -> Items, Count; disabled
int_9 = Integer(inc_3.Includes)  # disabled
int_10 = Integer(inc_4.Includes)  # disabled
addition_21 = Addition(A=multiplication_9, B=b2_2)  # disabled
addition_22 = Addition(A=int_9, B=int_10)  # disabled
subtraction_35 = Subtraction(A=panel_59, B=addition_22)  # disabled
extendlinecount_2 = Integer(subtraction_35)  # disabled
intersection_x_2 = Number(division_9)  # disabled
intersection_y_2 = Number(addition_21)  # disabled
pt_11 = PointOriented(BasePlane=xy_3, UComponent=intersection_x_2, VComponent=intersection_y_2, WComponent=0)  # disabled
panel_68 = Panel(extendlinecount_2)  # disabled
sift_8 = SiftPattern(List=pt_11, SiftPattern=extendlinecount_2)  # -> Output0, Output1, Output2; disabled
intersectionontwolines_2 = Point(sift_8.Output0)  # disabled
intersectionononeline_2 = Point(sift_8.Output1)  # disabled
intersectiononextend_2 = Point(sift_8.Output2)  # disabled

xy_4 = XYPlane(Origin=Point(0, 0, 0))  # disabled
sift_9 = SiftPattern(List=division_9, SiftPattern=extendlinecount_2)  # -> Output0, Output1, Output2; disabled
sift_10 = SiftPattern(List=addition_21, SiftPattern=extendlinecount_2)  # -> Output0, Output1, Output2; disabled
pt_12 = PointOriented(BasePlane=xy_4, UComponent=sift_9.Output0, VComponent=sift_10.Output0, WComponent=0)  # disabled
flatten_7 = FlattenTree(Tree=pt_12, Path="{0}")  # disabled
clean_7 = CleanTree(RemoveNulls=True, RemoveInvalid=True, RemoveEmpty=False, Tree=flatten_7)  # disabled
pt_13 = Point(Point(-2.015690168, -16.36521091, 0))  # disabled
panel_69 = Panel("2")  # disabled
partition_2 = PartitionList(List=clean_7, Size=panel_69)  # disabled
bang_2 = ExplodeTree(Data=partition_2)  # -> Branch0, Branch1; disabled
rev_2 = ReverseList(List=bang_2.Branch1)  # disabled
merge_6 = Merge(Data1=bang_2.Branch0, Data2=rev_2)  # -> flatten(Result); disabled
pline_3 = PolyLine(Vertices=merge_6, Closed=True)  # disabled

# ---- group: vector match method 1 simplify
# 问题在于，当某一path缺少时，替换的内容仍然会配对，造成数据多余错误
# 要探测出缺少的路径
# statistics-->DePath
# 最后拍平后替换路径
entwine_3 = Entwine(Branch00=panel_25, Branch01=panel_24, Branch02=panel_26, Branch03=panel_27, FlattenInputs=True)  # -> simplify(Result)
flatten_8 = FlattenTree(Tree=concat_5, Path="{0}")
mindex_10 = MemberIndex(Set=entwine_3, Member=flatten_8)  # -> Index, Count
clean_8 = CleanTree(RemoveNulls=True, RemoveInvalid=True, RemoveEmpty=True, Tree=mindex_10.Index)
pshift_3 = ShiftPaths(Data=clean_8, Offset=-1)
viewer_4 = ParamViewer(clean_8)

tstat_10 = TreeStatistics(Tree=pshift_3)  # -> Paths, Length, Count
dpath = DeconstructPath(Branch=tstat_10.Paths)  # -> simplify(Indices)

graft_5 = GraftTree(Tree=tstat_10.Length, IncludeEmptyLists=True, IncludeNullItems=True)
series_16 = Series(Start=0, Step=1, Count=graft_5)
int_11 = Integer(simplify(series_16))
replace_9 = ReplaceItems(List=pshift_3, Item=dpath, Indices=int_11, Wrap=False)
graft_6 = GraftTree(Tree=flatten(replace_9), IncludeEmptyLists=True, IncludeNullItems=True)
viewer_5 = ParamViewer(graft_6)
replace_10 = ReplacePaths(Data=graft_6, Search=viewer_5, Replace=viewer_4)
pshift_4 = ShiftPaths(Data=replace_10, Offset="1")
item_30 = ListItem(List=vec_3, Index=pshift_4, Wrap=True)
amp_8 = Amplitude(Vector=item_30, Amplitude=combine.Result)
vdis_4 = VectorDisplay(Anchor=pt_4, Vector=amp_8)

# ----
# explore a point position in space
line_6 = Line([Line((116.8886853, -62.41954745, 0), (118.2848879, -62.25808184, 0)), Line((118.0569364, -61.76418704, 0), (118.0474385, -63.06540989, 0)), Line((117.4680619, -62.22008994, 0), (118.5318353, -62.76147462, 0))])
linelist_3 = Curve(line_6)
lng_11 = ListLength(List=linelist_3)
subtraction_36 = Subtraction(A=lng_11, B="1")
series_17 = Series(Start=0, Step=1, Count=subtraction_36)
addition_23 = Addition(A=series_17, B="1")
item_31 = ListItem(List=linelist_3, Index=series_17, Wrap=False)  # -> simplify(graft(Item))
shift_22 = ShiftList(List=linelist_3, Shift=addition_23, Wrap=False)  # -> simplify(List)
end_8 = EndPoints(Curve=item_31)  # -> Start, End
end_9 = EndPoints(Curve=shift_22)  # -> Start, End
end_10 = EndPoints(Curve=linelist_3)  # -> Start, End
subtraction_37 = Subtraction(A=end_10.End, B=end_10.Start)
panel_70 = Panel("""处理k不存在的情况

写成函数
把坐标在相减后就分开来算""")
xy_5 = XYPlane(Origin=Point(0, 0, 0))

startpoint_6 = Point(end_10.Start)
vec_8 = Vector(subtraction_37)

panel_71 = Panel(startpoint_6)

addition_24 = Addition(A=startpoint_6, B=vec_8)
endpoint_5 = Point(addition_24)
lng_12 = ListLength(List=addition_24)
lng_13 = ListLength(List=startpoint_6)
panel_72 = Panel(vec_8)
subtraction_38 = Subtraction(A=lng_12, B="1")
subtraction_39 = Subtraction(A=lng_13, B="1")
series_18 = Series(Start=0, Step=1, Count=subtraction_39)
series_19 = Series(Start=0, Step=1, Count=subtraction_38)
addition_25 = Addition(A=series_18, B="1")
addition_26 = Addition(A=series_19, B="1")
item_32 = ListItem(List=startpoint_6, Index=series_18, Wrap=False)  # -> simplify(graft(Item))
item_33 = ListItem(List=addition_24, Index=series_19, Wrap=False)  # -> simplify(graft(Item))
shift_23 = ShiftList(List=addition_24, Shift=addition_26, Wrap=False)  # -> simplify(List)
shift_24 = ShiftList(List=startpoint_6, Shift=addition_25, Wrap=False)  # -> simplify(List)

panel_73 = Panel(shift_23)

firstpt_line0_2 = Point(item_32)
firstpt_line1_2 = Point(shift_24)
endpt1_line1 = Point(shift_23)
endpt_line0_2 = Point(item_33)

panel_74 = Panel(endpt_line0_2)
panel_75 = Panel(firstpt_line1_2)

points_3 = PointList(Points=flatten(firstpt_line0_2), Size=Slider(6, range=0..100))
panel_76 = Panel(firstpt_line0_2)

complex_19 = ComplexComponents(Complex=firstpt_line1_2)  # -> Real, Imaginary
complex_20 = ComplexComponents(Complex=endpt1_line1)  # -> Real, Imaginary
complex_21 = ComplexComponents(Complex=endpt_line0_2)  # -> Real, Imaginary
complex_22 = ComplexComponents(Complex=firstpt_line0_2)  # -> Real, Imaginary
subtraction_40 = Subtraction(A=complex_19.Imaginary, B=complex_20.Imaginary)
subtraction_41 = Subtraction(A=complex_19.Real, B=complex_20.Real)
subtraction_42 = Subtraction(A=complex_22.Real, B=complex_21.Real)
subtraction_43 = Subtraction(A=complex_22.Imaginary, B=complex_21.Imaginary)
division_10 = Division(A=subtraction_40, B=subtraction_41)
division_11 = Division(A=subtraction_43, B=subtraction_42)
k1_4 = Number(division_11)
k2_3 = Number(division_10)
multiplication_10 = Multiplication(A=k2_3, B=complex_19.Real)
subtraction_44 = Subtraction(A=complex_19.Imaginary, B=multiplication_10)
b2_3 = Number(subtraction_44)
subtraction_45 = Subtraction(A=k1_4, B=k2_3)

multiplication_11 = Multiplication(A=k1_4, B=complex_22.Real)
subtraction_46 = Subtraction(A=complex_22.Imaginary, B=multiplication_11)

equals_9 = Equality(FirstNumber=subtraction_41, SecondNumber="0")  # -> Equality, Inequality
equals_10 = Equality(FirstNumber=subtraction_42, SecondNumber="0")  # -> Equality, Inequality
sift_11 = SiftPattern(List=complex_20.Real, SiftPattern=equals_9.Equality)  # -> Output0, Output1
sift_12 = SiftPattern(List=complex_22.Real, SiftPattern=equals_10.Equality)  # -> Output0, Output1
or_4 = GateOr(A=equals_10.Equality, B=equals_9.Equality)
combine_4 = CombineData(Input0=sift_12.Output1, Input1=sift_11.Output1)  # -> Result, Index
sift_13 = SiftPattern(List=k2_3, SiftPattern=equals_9.Equality)  # -> Output0, Output1
sift_14 = SiftPattern(List=b2_3, SiftPattern=equals_9.Equality)  # -> Output0, Output1
sift_15 = SiftPattern(List=k1_4, SiftPattern=equals_10.Equality)  # -> Output0, Output1
combine_5 = CombineData(Input0=sift_15.Output0, Input1=sift_13.Output0)  # -> Result, Index
a_2 = Number(combine_4.Result)
k = Number(combine_5.Result)
multiplication_12 = Multiplication(A=a_2, B=k)
intersection_x_3 = Number(a_2)

b1_4 = Number(subtraction_46)
subtraction_47 = Subtraction(A=b2_3, B=b1_4)
division_12 = Division(A=subtraction_47, B=subtraction_45)
multiplication_13 = Multiplication(A=division_12, B=k2_3)
addition_27 = Addition(A=multiplication_13, B=b2_3)
sift_16 = SiftPattern(List=addition_27, SiftPattern=or_4)  # -> Output0, Output1

sift_17 = SiftPattern(List=b1_4, SiftPattern=equals_10.Equality)  # -> Output0, Output1
combine_6 = CombineData(Input0=sift_17.Output0, Input1=sift_14.Output0)  # -> Result, Index
b_2 = Number(combine_6.Result)
sift_18 = SiftPattern(List=b_2, SiftPattern=or_4)  # -> Output0, Output1
addition_28 = Addition(A=multiplication_12, B=sift_18.Output1)
intersection_y_3 = Number(addition_28)

combine_7 = CombineData(Input0=sift_16.Output0, Input1=intersection_y_3)  # -> Result, Index
combine_8 = CombineData(Input0=division_12, Input1=intersection_x_3)  # -> Result, Index

# ----
# 0 --> extend one line to intersect two lines
# 1 --> extend two lines
# 2 --> extend three lines
dom_5 = ConstructDomain(DomainStart=complex_19.Real, DomainEnd=complex_20.Real)
dom_6 = ConstructDomain(DomainStart=complex_22.Real, DomainEnd=complex_21.Real)
inc_5 = Includes(Value=combine_8.Result, Domain=dom_6)  # -> Includes, Deviation
inc_6 = Includes(Value=combine_8.Result, Domain=dom_5)  # -> Includes, Deviation
int_12 = Integer(inc_5.Includes)
int_13 = Integer(inc_6.Includes)
addition_29 = Addition(A=int_12, B=int_13)
subtraction_48 = Subtraction(A="2", B=addition_29)
extendlinecount_3 = Integer(subtraction_48)

panel_77 = Panel(equals_10.Equality)
intersection_x_4 = Number(combine_8.Result)
intersection_y_4 = Number(combine_7.Result)
pt_14 = PointOriented(BasePlane=xy_5, UComponent=intersection_x_4, VComponent=intersection_y_4, WComponent=0)
panel_78 = Panel(pt_14)
sift_19 = SiftPattern(List=pt_14, SiftPattern=extendlinecount_3)  # -> Output0, Output1, Output2
intersectionontwolines_3 = Point(sift_19.Output0)
intersectionononeline_3 = Point(sift_19.Output1)
intersectiononextend_3 = Point(sift_19.Output2)
panel_79 = Panel(extendlinecount_3)
panel_80 = Panel(intersectionontwolines_3)

firstpt0_4 = Point(firstpt_line0)
firstpt1_3 = Point(firstpt_line1)
endpt0_4 = Point(endpt_line0)
endpt1_3 = Point(endpt_line1)
points_4 = PointList(Points=flatten(firstpt0_4), Size=Slider(0.291, range=0..3))
complex_23 = ComplexComponents(Complex=firstpt1_3)  # -> Real, Imaginary
complex_24 = ComplexComponents(Complex=endpt1_3)  # -> Real, Imaginary
complex_25 = ComplexComponents(Complex=endpt0_4)  # -> Real, Imaginary
complex_26 = ComplexComponents(Complex=firstpt0_4)  # -> Real, Imaginary
subtraction_49 = Subtraction(A=complex_23.Imaginary, B=complex_24.Imaginary)
subtraction_50 = Subtraction(A=complex_23.Real, B=complex_24.Real)
equals_11 = Equality(FirstNumber=subtraction_50, SecondNumber="0")  # -> Equality, Inequality
sift_20 = SiftPattern(List=complex_24.Real, SiftPattern=equals_11.Equality)  # -> Output0, Output1
subtraction_51 = Subtraction(A=complex_26.Imaginary, B=complex_25.Imaginary)
subtraction_52 = Subtraction(A=complex_26.Real, B=complex_25.Real)
equals_12 = Equality(FirstNumber=subtraction_52, SecondNumber="0")  # -> Equality, Inequality
sift_21 = SiftPattern(List=complex_26.Real, SiftPattern=equals_12.Equality)  # -> Output0, Output1
or_5 = GateOr(A=equals_12.Equality, B=equals_11.Equality)
combine_9 = CombineData(Input0=sift_21.Output1, Input1=sift_20.Output1)  # -> Result, Index
division_13 = Division(A=subtraction_49, B=subtraction_50)
division_14 = Division(A=subtraction_51, B=subtraction_52)
k2_4 = Number(division_13)
multiplication_14 = Multiplication(A=k2_4, B=complex_23.Real)
sift_22 = SiftPattern(List=k2_4, SiftPattern=equals_11.Equality)  # -> Output0, Output1
subtraction_53 = Subtraction(A=complex_23.Imaginary, B=multiplication_14)
k1_5 = Number(division_14)
multiplication_15 = Multiplication(A=k1_5, B=complex_26.Real)
sift_23 = SiftPattern(List=k1_5, SiftPattern=equals_12.Equality)  # -> Output0, Output1
subtraction_54 = Subtraction(A=complex_26.Imaginary, B=multiplication_15)
combine_10 = CombineData(Input0=sift_23.Output0, Input1=sift_22.Output0)  # -> Result, Index
b1_5 = Number(subtraction_54)
sift_24 = SiftPattern(List=b1_5, SiftPattern=equals_12.Equality)  # -> Output0, Output1
b2_4 = Number(subtraction_53)
sift_25 = SiftPattern(List=b2_4, SiftPattern=equals_11.Equality)  # -> Output0, Output1
combine_11 = CombineData(Input0=sift_24.Output0, Input1=sift_25.Output0)  # -> Result, Index
subtraction_55 = Subtraction(A=b2_4, B=b1_5)
b_3 = Number(combine_11.Result)
a_3 = Number(combine_9.Result)
k_2 = Number(combine_10.Result)
subtraction_56 = Subtraction(A=k1_5, B=k2_4)
sift_26 = SiftPattern(List=b_3, SiftPattern=or_5)  # -> Output0, Output1
multiplication_16 = Multiplication(A=a_3, B=k_2)
division_15 = Division(A=subtraction_55, B=subtraction_56)
multiplication_17 = Multiplication(A=division_15, B=k2_4)
addition_30 = Addition(A=multiplication_17, B=b2_4)
sift_27 = SiftPattern(List=addition_30, SiftPattern=or_5)  # -> Output0, Output1
addition_31 = Addition(A=multiplication_16, B=sift_26.Output1)
intersection_x_5 = Number(a_3)
intersection_y_5 = Number(addition_31)
combine_12 = CombineData(Input0=sift_27.Output0, Input1=intersection_y_5)  # -> Result, Index
combine_13 = CombineData(Input0=division_15, Input1=intersection_x_5)  # -> Result, Index
intersection_x_6 = Number(combine_13.Result)
intersection_y_6 = Number(combine_12.Result)
xy_6 = XYPlane(Origin=Point(0, 0, 0))
pt_15 = PointOriented(BasePlane=xy_6, UComponent=intersection_x_6, VComponent=intersection_y_6, WComponent=0)

panel_82 = Panel(k1_5)

# ----
# 0 --> extend one line to intersect two lines
# 1 --> extend two lines
# 2 --> extend three lines
dom_7 = ConstructDomain(DomainStart=complex_23.Real, DomainEnd=complex_24.Real)
dom_8 = ConstructDomain(DomainStart=complex_26.Real, DomainEnd=complex_25.Real)
inc_7 = Includes(Value=combine_13.Result, Domain=dom_8)  # -> Includes, Deviation
inc_8 = Includes(Value=combine_13.Result, Domain=dom_7)  # -> Includes, Deviation
int_14 = Integer(inc_7.Includes)
int_15 = Integer(inc_8.Includes)
addition_32 = Addition(A=int_14, B=int_15)
subtraction_57 = Subtraction(A="2", B=addition_32)
extendlinecount_4 = Integer(subtraction_57)

panel_83 = Panel(pt_15)

sift_28 = SiftPattern(List=pt_15, SiftPattern=extendlinecount_4)  # -> Output0, Output1, Output2
intersectionontwolines_4 = Point(sift_28.Output0)
intersectionononeline_4 = Point(sift_28.Output1)
intersectiononextend_4 = Point(sift_28.Output2)
panel_84 = Panel(extendlinecount_4)
panel_85 = Panel(intersectionontwolines_4)
