# Grasshopper definition 20161023_PE_points_intersection_014_lineDatabase_reconstructPath.gh (Grasshopper 0.9.76)

databaseparameters = Panel("""A
B
C
k
a
b
x0_pt0
y0_pt0
x1_pt1
y1_pt1
A0_intersectionLine0
B0_intersectionLine0
C0_intersectionLine0
A1_intersectionLine1
B1_intersectionLine1
C1_intersectionLine1
m_intersection
A2_parallelLine
B2_parallelLine
C2_parallelLine
angle
distance(p)
u_vector
v_vector
nu_normalVector
nv_normalVector""")
databaseparameters_2 = Panel("""A
B
C
k
a
b
pt0(x0,y0)
pt1(x1,y1)
intersection_line0(A0,B0,C0)
intersection_line1(A1,B1,C1)
intersection_m
parallel_line(A2,B2,C2)
angle
distance(p)
vector(u,v)
normal_vector(nu,nv)""")
panel = Panel("""0;0;0_3.2/1_1.0/3_2.2/5_4.0
1;0;2_2.5/3_4.0/4_8.2/5_1.2/7_2,3.2
2;0;1_2.2/7_2,1.9/11_3.222
3;0;4_8.2/6_4,2.2/14_2.442,3.442
4;0;4_8.2/6_1.2,4.2/14_3.56,4.23
5;0;3_3.2/6_1.2,4.2
6;0;0_2/2_2.3/1_3.2
7;0;6_3.2,1.2/7_1.2,3.2
8;0;8_3.2,2.2,1.2/9_3.4,1.3,1.2/10_2
9;0;6_2.2,3.1/11_4,3,2.2
10;0;12_3.221/13_4
11;0;6_3.21,2.22/15_4.23,5.43""")
panel_2 = Panel("""0;0;0_3.2/1_1.0/3_2.2/5_4.0
1;0;2_2.5/3_4.0/4_8.2/5_1.2/8_2/9_3.2
2;0;1_2.2/8_2/9_1.9/11_3.222
3;0;4_8.2/6_4/7_2.2/22_2.442/23_3.442
4;0;4_8.2/6_1.2/7_4.2/22_3.56/23_4.23
5;0;3_3.2/6_1.2/7_4.2
6;0;0_2/2_2.3/1_3.2
7;0;6_3.2/7_1.2/8_1.2/9_3.2
8;0;10_3.2/11_2.2/12_1.2/13_3.4/14_1.3/15_1.2/16_2
9;0;6_2.2/7_3.1/17_4/18_3/19_2.2
10;0;20_3.221/21_4
11;0;6_3.21/7_2.22/24_4.23/25_5.43""")
debug01_constraintsituation_a_0 = Panel("""0;0;0_3.2/1_1.0/3_2.2/5_4.0
1;0;2_2.5/3_4.0/4_8.2/5_1.2/8_2/9_3.2
2;0;1_2.2/8_2/9_1.9/11_3.222
3;0;4_8.2/6_4/7_2.2/22_2.442/23_3.442
4;0;4_8.2/6_1.2/7_4.2/22_3.56/23_4.23
5;0;3_3.2/6_1.2/7_4.2
6;0;0_2/2_2.3/1_3.2
7;0;6_3.2/7_1.2/8_1.2/9_3.2
8;0;10_3.2/11_2.2/12_1.2/13_3.4/14_1.3/15_1.2/16_2
9;0;6_2.2/7_3.1/17_4/18_3/19_2.2
10;0;20_3.221/21_4
11;0;6_3.21/7_2.22/24_4.23/25_5.43
12;0;0_0/1_1.2/2_3.1""")
databaseparameters_3 = Panel("""A
B
C
k
a
b
x0_pt0
y0_pt0
x1_pt1
y1_pt1
A0_intersectionLine0
B0_intersectionLine0
C0_intersectionLine0
A1_intersectionLine1
B1_intersectionLine1
C1_intersectionLine1
m_intersection
A2_parallelLine
B2_parallelLine
C2_parallelLine
angle
distance(p)
u_vector
n_vector
nu_normalVector
nv_normalVector""")
panel_4 = Panel("""0;0;0_3.2/1_1.0/3_2.2/5_4.0
1;0;2_2.5/3_4.0/4_8.2/5_1.2/7_2,3.2
2;0;1_2.2/7_2,1.9/11_3.222
3;0;4_8.2/6_4,2.2/14_2.442,3.442""")
databasefunctions = Panel("""Ax+By+C=0,A!=0 and B!=0
y-y0=k(x-x0),k!=empty
x/a+y/b=1,a!=0andb!=0
y=kx+b,k!=empty
(y-y1)(y2-y1)=(x-x1)(x2-x1),x1!=x2andy1!=y2
f1(x,y)*m+f2(x,y)=0
f(x,y)-f(x0,y0)=0
x*cos(angle)+y*sin(angle)-p=0,angle=!k*pi
(x-x0)/u=(y-y0)/v,u!=0andv!=0
nu*(x-x0)+nv(y-y0)=0,nv!=0andnu!=0""")

# ----
# feed data and store data
panel_5 = Panel("/")
txt = Text(panel)
# log:
# 20161017
# 给定相应的数据，去匹配相应的算法
# 考虑是否要反馈数据
# path在后面匹配时，相同path的被放在一起，真tm尴尬...
# 完成一个基本的模板，明天按照这样继续做下去
# 20161018
# 算法和对应的参数进行匹配
# 对数据结构的处理进行简化，避免重复计算
# 数据的过滤和储存方式
split = TextSplit(Text=txt, Separators=";")
item = ListItem(List=split, Index=0, Wrap=True)  # -> Item, Item1, Item2
split_2 = TextSplit(Text=item.Item2, Separators=panel_5)
split_3 = TextSplit(Text=split_2, Separators="_")
item_2 = ListItem(List=split_3, Index=0, Wrap=True)  # -> simplify(Item), Item1
pshift = ShiftPaths(Data=item_2.Item, Offset=-1)
split_4 = TextSplit(Text=item_2.Item1, Separators=",")  # -> simplify(Result)
tstat = TreeStatistics(Tree=pshift)  # -> Paths, Length, Count
initialparasdepathlist = Integer(pshift)
initiallinecount = Integer(tstat.Count)
graft = GraftTree(Tree=tstat.Length, IncludeEmptyLists=True, IncludeNullItems=True)  # -> simplify(Tree)
initialparascounts = Integer(graft)
# log:
# 20161010
# 设计向量方向与数据结构之间的映射关系
# 数据结构用集合运算然后替换
# 替换树形结构的时候需要拍平
# 无论什么情况都留出0123正交的位置为Null
# 如果0123存在，没关系，不存在，插入一个空值
# 20161011
# 角度和path之间的映射关系，以及角度的识别:
# 分解basic line的path得到位置位置关系
# 先正交的位置关系，后自由的位置关系
# 考虑先组合line还是先分解path在配对
# 如何识别path知道非正交的相反的向量
# 增强path的排序的算法前馈，可通过path运算直接得到向量关系
# 运用path提取相应的两条交线
# 20161012
# debug时候replacePath爆红
# 精度问题导致set不能去掉原本偏差相同的角度
# 20161017
# 找到了两根交线的关系，先把他放在这，具体怎么用不继续做下去，先考虑其他的大的情况
# 20161018
# 算法和对应的参数进行匹配
# 对数据结构的处理进行简化，避免重复计算
# 数据的过滤和储存方式
# 20161023
# 对线的识别方法以及数据的缺省情况
# 数据分流计算的方法是否合适
# 重建数据结构，把他铺平
stack = StackData(Data=item.Item, Stack=initialparascounts)
stack_2 = StackData(Data=item.Item1, Stack=initialparascounts)
graft_2 = GraftTree(Tree=stack_2, IncludeEmptyLists=True, IncludeNullItems=True)
graft_3 = GraftTree(Tree=stack, IncludeEmptyLists=True, IncludeNullItems=True)
int = Integer(simplify(graft_3))
int_2 = Integer(simplify(item_2.Item))
int_3 = Integer(simplify(graft_2))
merge = Merge(Data1=int, Data2=int_3, Data3=int_2)
path = ConstructPath(Indices=merge)
flatten = FlattenTree(Tree=path, Path="{0}")
initialparaspaths = DataPath(path)
viewer = ParamViewer(split_4)
replace = ReplacePaths(Data=split_4, Search=viewer, Replace=flatten)
data = Data(replace)

# ----
# log:
# 20161023
# 对线的识别方法以及数据的缺省情况
# 数据分流计算的方法是否合适：
# 进行f(x)的修改
# 重建数据结构，把他铺平
# 对bug进行检测加入合适的限制条件
# 补充缺省值的接口
txt_2 = Text(debug01_constraintsituation_a_0)
# construct the method of feeding data
split_5 = TextSplit(Text=txt_2, Separators=";")

# ----
# log:
# 20161010
# 设计向量方向与数据结构之间的映射关系
# 数据结构用集合运算然后替换
# 替换树形结构的时候需要拍平
# 无论什么情况都留出0123正交的位置为Null
# 如果0123存在，没关系，不存在，插入一个空值
# 20161011
# 角度和path之间的映射关系，以及角度的识别
# 线交的算法与path之间多对多的关系
pi = Pi(Factor="2")
# {0,0}-->0/2*pi
# 0/2*pi <= a< 1/2*pi
# {1,0}-->1/2*pi
# 1/2*pi <= a < 2/2*pi
# {2,0}-->2/2*pi
# 2/2*pi <= a < 3/2*pi
# {3,0}-->3/2*pi
# 3/2*pi <= a < 4/2*pi
# log:
# 20161010
# 如果0123存在，没关系，不存在，插入一个空值
# 光是插入一个空值也是不行，修改标签运算的算法使其更合理:原因是set的时候把null去掉了
# 应该是插入不是替换
# 不是插入一个Null就能解决问题的，问题处在了member的寻找上，寻找时候把null数据给删除了，结果找不到对应的path
random = Random(Range=pi, Number="20", Seed=Slider(33.222, range=0..100))

item_3 = ListItem(List=split_5, Index=0, Wrap=True)  # -> Item, Item1, Item2
split_6 = TextSplit(Text=item_3.Item2, Separators="/")
split_7 = TextSplit(Text=split_6, Separators="_")
item_4 = ListItem(List=split_7, Index=0, Wrap=True)  # -> simplify(Item), Item1

pi_2 = Pi(Factor=1)
ins = InsertItems(List=random, Item=pi_2, Indices="0", Wrap=True)

# ----
# kernel intersection algorithm 002_siftPoint
panel_6 = Panel("""0
0.4
1
1.5
1.5
1.92

2.05
2.1
2.4
2.3
2.3
2.1
3
3.12
3.11
3.12""")
databasemapping = Panel("""0,1,2;(0!=zero)and(1!=zero)
3,6,7;
4,5;(4!=zero)and(5!=zero)
3,5;
6,7,8,9;(6!=8)and(7!=9)
10,11,12,13,14,15,16;
6,7,17,18,19;
20,21;20=!k*pi,k=1,2,3..
22,23;(22!=zero)and(23!=zero)
24,25;(24!=zero)and(25!=zero)""")
pshift_2 = ShiftPaths(Data=item_4.Item, Offset=-1)
split_8 = TextSplit(Text=item_4.Item1, Separators=",")  # -> simplify(Result)
# Point:indicate a position in space
# Line:length,direction,position
# Point
# two ends of the line
# the intersection of two lines
# the meeting of lines at the corner of a space or volumn
# the center of field
panel_7 = Panel("""0
0.4
1
1.5
1.5
1.92

2.05
2.1
2.4
2.3
2.3
2.1
3
3.12
3.11
3.12""")
tstat_2 = TreeStatistics(Tree=pshift_2)  # -> Paths, Length, Count

# ----
# mapping between angle and path
# {0;0} --> 0
# {1;0} --> 1/2*pi
# {2;0} --> pi
# {3;0} --> 3/2*pi
# 当向量中不存在某正交方向时候为Null
# vectorPath00_can't identify reverse vectors
panel_8 = Panel("2")
pi_3 = Pi(Factor=panel_8)
num = Number(panel_6)
remap = RemapNumbers(Value=num, Source="4", Target=pi_3)  # -> Mapped, Clipped
pi_4 = Pi(Factor=1)
sort = SortList(Keys=remap.Mapped)  # -> Keys, ValuesA
division = Division(A=pi_4, B="2")
series = Series(Start=0, Step=division, Count="5")
consec = ConsecutiveDomains(Numbers=series, Additive=False)  # -> simplify(Domains)
domain = Domain(graft(consec))
angle = Number(sort.Keys)
dedomain = DeconstructDomain(Domain=domain)  # -> Start, End
larger = LargerThan(FirstNumber=angle, SecondNumber=dedomain.Start)  # -> LargerThan, OrEqualTo
smaller = SmallerThan(FirstNumber=angle, SecondNumber=dedomain.End)  # -> SmallerThan, OrEqualTo
and = GateAnd(A=larger.OrEqualTo, B=smaller.SmallerThan)
sift = SiftPattern(List=angle, SiftPattern=and)  # -> Output0, Output1
clean = CleanTree(RemoveNulls=True, RemoveInvalid=True, RemoveEmpty=False, Tree=sift.Output1)  # -> simplify(Tree)
item_5 = ListItem(List=clean, Index="0", Wrap=True)
equals = Equality(FirstNumber=item_5, SecondNumber=simplify(dedomain.Start))  # -> Equality, Inequality
int_4 = Integer(equals.Inequality)
ins_2 = InsertItems(List=clean, Indices="0", Wrap=True)
neg = Negative(Value=int_4)
cull_i = CullIndex(List=ins_2, Indices=neg, Wrap=False)  # -> simplify(List)
num_2 = Number(cull_i)
cset = CreateSet(List=num_2)  # -> Set, Map
addition = Addition(A=cset.Map, B=int_4)
tstat_3 = TreeStatistics(Tree=addition)  # -> Paths, Length, Count
dpath = DeconstructPath(Branch=tstat_3.Paths)
graft_4 = GraftTree(Tree=addition, IncludeEmptyLists=True, IncludeNullItems=True)
stack_3 = StackData(Data=dpath, Stack=graft(tstat_3.Length))
graft_5 = GraftTree(Tree=cull_i, IncludeEmptyLists=True, IncludeNullItems=True)
graft_6 = GraftTree(Tree=stack_3, IncludeEmptyLists=True, IncludeNullItems=True)  # -> simplify(Tree)
ins_3 = InsertItems(List=graft_6, Item=graft_4, Indices="-1", Wrap=True)
path_2 = ConstructPath(Indices=ins_3)  # -> simplify(Branch)
viewer_2 = ParamViewer(graft_5)
flatten_2 = FlattenTree(Tree=path_2, Path="{0}")
flatten_3 = FlattenTree(Tree=cull_i, Path="{0}")
replace_2 = ReplacePaths(Data=graft_5, Search=viewer_2, Replace=flatten_2)
graft_7 = GraftTree(Tree=sort.Keys, IncludeEmptyLists=True, IncludeNullItems=True)  # -> simplify(Tree)
keysearch = KeyValueSearch(Keys=flatten_3, Values=flatten_2, Search=graft_7)

panel_9 = Panel("""0
1
2
3
2
2
3
1
2
1
0
0
2
0
1
3""")
# feed data and store data
initialparasdepathlist_2 = Integer(pshift_2)
initiallinecount_2 = Integer(tstat_2.Count)
graft_8 = GraftTree(Tree=tstat_2.Length, IncludeEmptyLists=True, IncludeNullItems=True)  # -> simplify(Tree)
databasemapping_2 = Panel("""0,1,2;(0!=zero)and(1!=zero)
3,6;
4,5;(4!=zero)and(5!=zero)
3,5;
6,7;(6[0]!=6[1])and(7[0]!=7[1])
8,9,10;
6,11;
12,13;12=!k*pi,k=1,2,3..
6,14;(14[0]!=zero)and(14[1]!=zero)
6,15;(15[0]!=zero)and(15[1]!=zero)""")
initialparascounts_2 = Integer(graft_8)

# ----
# log:
# 20161011
# 增强path的排序的算法前馈，可通过path运算直接得到向量关系:
# 排序前后问题：
# 先精确控制还是先离散问题
# 应该是把排序前的原始数据进行path替换，而不是排序之后的数据：结果竟然是一样的。。。！
# 20161017
# 修改好排序过后path下为空值产生的错误
# vectorPath01
# mapping between angle and path
# {0;0} --> 0
# {1;0} --> 1/2*pi
# {2;0} --> pi
# {3;0} --> 3/2*pi
# 无所谓正交向量存不存在
panel_10 = Panel("""0
1
0
1.3
3
1
2.3
2""")
jitter = Jitter(List=panel_9, Jitter=1, Seed=2)  # -> Values, Indices
pi_5 = Pi(Factor=1)
pi_6 = Pi(Factor="2")
num_3 = Number(jitter.Values)
division_2 = Division(A=pi_5, B="2")
# log:
# 20161010
# 不是插入一个Null就能解决问题的，问题处在了member的寻找上，寻找时候把null数据给删除了，结果找不到对应的path:
# 找到替换的member的运算器
# 发现前馈需要一大堆的运算器，先做成后馈
panel_11 = Panel("5")
remap_2 = RemapNumbers(Value=num_3, Source="4", Target=pi_6)  # -> Mapped, Clipped
series_2 = Series(Start=0, Step=division_2, Count=panel_11)
consec_2 = ConsecutiveDomains(Numbers=series_2, Additive=False)  # -> simplify(Domains)
angle_2 = Number(remap_2.Mapped)
domain_2 = Domain(graft(consec_2))
dedomain_2 = DeconstructDomain(Domain=domain_2)  # -> simplify(Start), simplify(End)
larger_2 = LargerThan(FirstNumber=angle_2, SecondNumber=dedomain_2.Start)  # -> LargerThan, OrEqualTo
smaller_2 = SmallerThan(FirstNumber=angle_2, SecondNumber=dedomain_2.End)  # -> SmallerThan, OrEqualTo
and_2 = GateAnd(A=larger_2.OrEqualTo, B=smaller_2.SmallerThan)
sift_2 = SiftPattern(List=angle_2, SiftPattern=and_2)  # -> Output0, Output1
clean_2 = CleanTree(RemoveNulls=True, RemoveInvalid=False, RemoveEmpty=True, Tree=sift_2.Output1)  # -> simplify(Tree)
tstat_4 = TreeStatistics(Tree=clean_2)  # -> Paths, Length, Count
branch = TreeBranch(Tree=dedomain_2.Start, Path=tstat_4.Paths, MaintainPaths=True)
subtraction = Subtraction(A=clean_2, B=branch)
num_4 = Number(clean_2)
eval = Evaluate(F="round(x,4)", x=subtraction)
flatten_4 = FlattenTree(Tree=eval, Path="{0}")
cset_2 = CreateSet(List=flatten_4)  # -> Set, Map
sort_2 = SortList(Keys=cset_2.Set)  # -> Keys, ValuesA
mindex = MemberIndex(Set=sort_2.Keys, Member=eval)  # -> Index, Count
pshift_3 = ShiftPaths(Data=mindex.Index, Offset=-1)
flatten_5 = FlattenTree(Tree=mindex.Index, Path="{0}")
tstat_5 = TreeStatistics(Tree=pshift_3)  # -> Paths, Length, Count
dpath_2 = DeconstructPath(Branch=tstat_5.Paths)
graft_9 = GraftTree(Tree=flatten_5, IncludeEmptyLists=True, IncludeNullItems=True)  # -> simplify(Tree)
stack_4 = StackData(Data=dpath_2, Stack=graft(tstat_5.Length))
graft_10 = GraftTree(Tree=angle_2, IncludeEmptyLists=True, IncludeNullItems=True)
flatten_6 = FlattenTree(Tree=stack_4, Path="{0}")
graft_11 = GraftTree(Tree=flatten_6, IncludeEmptyLists=True, IncludeNullItems=True)  # -> simplify(Tree)
merge_2 = Merge(Data1=graft_11, Data2=graft_9)
path_3 = ConstructPath(Indices=merge_2)
graft_12 = GraftTree(Tree=num_4, IncludeEmptyLists=True, IncludeNullItems=True)
flatten_7 = FlattenTree(Tree=path_3, Path="{0}")
flatten_8 = FlattenTree(Tree=graft_12, Path="{0}")
viewer_3 = ParamViewer(graft_12)
keysearch_2 = KeyValueSearch(Keys=flatten_8, Values=flatten_7, Search=graft_10)  # -> simplify(Result)
replace_3 = ReplacePaths(Data=graft_12, Search=viewer_3, Replace=flatten_7)
panel_12 = Panel(replace_3)
panel_13 = Panel(keysearch_2)

stack_5 = StackData(Data=item_3.Item, Stack=initialparascounts_2)
stack_6 = StackData(Data=item_3.Item1, Stack=initialparascounts_2)
graft_13 = GraftTree(Tree=stack_6, IncludeEmptyLists=True, IncludeNullItems=True)
graft_14 = GraftTree(Tree=stack_5, IncludeEmptyLists=True, IncludeNullItems=True)
panel_14 = Panel(data)
int_5 = Integer(simplify(graft_14))
int_6 = Integer(simplify(item_4.Item))
int_7 = Integer(simplify(graft_13))
merge_3 = Merge(Data1=int_5, Data2=int_7, Data3=int_6)
path_4 = ConstructPath(Indices=merge_3)
flatten_9 = FlattenTree(Tree=path_4, Path="{0}")
panel_15 = Panel("""2.5838678
Pi
1.6421
3.212896
1.5*Pi""")
initialparaspaths_2 = DataPath(path_4)
viewer_4 = ParamViewer(split_8)

# ----
# log:
# 20161010
# 应该是插入不是替换：
# 连一个新电池，是True就插入，False就不插入
# 简短的并不需要连接电池
# 插入的应该是一个Null值，而不是正交角度
# instance
panel_16 = Panel("0")
item_6 = ListItem(List=clean, Index=panel_16, Wrap=True)
equals_2 = Equality(FirstNumber=item_6, SecondNumber=simplify(dedomain.Start))  # -> Equality, Inequality
num_5 = Number(clean)
neg_2 = Negative(Value=equals_2.Inequality)
ins_4 = InsertItems(List=num_5, Indices=graft("0"), Wrap=True)
cull_i_2 = CullIndex(List=ins_4, Indices=neg_2, Wrap=False)  # -> simplify(List)

replace_4 = ReplacePaths(Data=split_8, Search=viewer_4, Replace=flatten_9)
data_2 = Data(replace_4)

# ----
# log:
# 20161010
# 插入的应该是一个Null值，而不是正交角度:
# 先保留空值，后根据boolean删除Null
# 插入一个空值的方法：
# 运用cull index运算器本身的性质，对布尔值进行negetive后删除不需要的空值
toggle = BooleanToggle(False)
series_3 = Series(Start=0, Step=1, Count=3)  # -> simplify(graft(Series))
graft_15 = GraftTree(Tree="0", IncludeEmptyLists=True, IncludeNullItems=True)  # -> graft(Tree)
panel_17 = Panel([Toggle(False), Toggle(True), toggle])
bool = Boolean(panel_17)
ins_5 = InsertItems(List=series_3, Indices=graft_15, Wrap=True)  # -> simplify(List)
# log:
# 20161010
# 设计向量方向与数据结构之间的映射关系
# 数据结构用集合运算然后替换
# 替换树形结构的时候需要拍平
# 无论什么情况都留出0123正交的位置为Null
# 如果0123存在，没关系，不存在，插入一个空值
# 20161011
# 角度和path之间的映射关系，以及角度的识别:
# 分解basic line的path得到位置位置关系
# 先正交的位置关系，后自由的位置关系
# 考虑先组合line还是先分解path在配对
# 如何识别path知道非正交的相反的向量
# 增强path的排序的算法前馈，可通过path运算直接得到向量关系
# 运用path提取相应的两条交线
# 20161012
# debug时候replacePath爆红
# 精度问题导致set不能去掉原本偏差相同的角度
# 20161017
# 找到了两根交线的关系，先把他放在这，具体怎么用不继续做下去，先考虑其他的大的情况
# 先罗列出方程对应的算法
# 建立数据库，对数据结构进行设计，让每一个数据都有对应的位置
# 给定相应的数据，去匹配相应的算法
# 考虑是否要反馈数据
int_8 = Integer(bool)
neg_3 = Negative(Value=int_8)
cull_i_3 = CullIndex(List=ins_5, Indices=graft(neg_3), Wrap=False)
panel_18 = Panel(cull_i_3)

panel_19 = Panel(data_2)
databasemapping_3 = Panel("""0,1,2
3,6,7
4,5
3,5
6,7,8,9
10,11,12,13,14,15,16
6,7,17,18,19
20,21
22,23
24,25""")
# log:
# 20161010
# 发现前馈需要一大堆的运算器，先做成后馈
# 如果需要前反馈，可能需要修改标签运算的算法，所以先后馈，至少能做下去
# 重新Partition
# 还是回到前馈
# log:
# 20161010
# 还是回到前馈：
# 用set运算器自带的index记录，与boolean值进行相加，对path运算得到新的path
# log:
# 20161010
# 设计向量方向与数据结构之间的映射关系
# 数据结构用集合运算然后替换
# 替换树形结构的时候需要拍平
# 无论什么情况都留出0123正交的位置为Null
# 如果0123存在，没关系，不存在，插入一个空值
# 20161011
# 角度和path之间的映射关系，以及角度的识别:
# 先正交的位置关系，后自由的位置关系
# 如何识别path知道非正交的相反的向量
# 增强path的排序的算法前馈，可通过path运算直接得到向量关系
panel_20 = Panel(clean)
databasemapping_4 = Panel("""0,1,2
3,6
4,5
3,5
6,7
8,9,10
6,11
12,13
6,14
6,15""")
initialparasdepathlist_3 = Integer(initialparasdepathlist_2)
split_9 = TextSplit(Text=databasemapping_3, Separators=",")  # -> simplify(Result)
functionparasdepathlist = Integer(split_9)
split_10 = TextSplit(Text=databasemapping_4, Separators=",")  # -> simplify(Result)

functionparasdepathlist_2 = Integer(split_10)
initialparasdepathlist_4 = Integer(initialparasdepathlist)

dataparameterspath = Panel(initialparasdepathlist_4)
functionpath = Panel(functionparasdepathlist_2)
tstat_6 = TreeStatistics(Tree=functionparasdepathlist)  # -> Paths, Length, Count
tstat_7 = TreeStatistics(Tree=functionparasdepathlist_2)  # -> Paths, Length, Count
initialparascounts_3 = Integer(initialparascounts_2)
flatten_10 = FlattenTree(Tree=functionparasdepathlist, Path="{0}")
initialparascounts_4 = Integer(initialparascounts)
functionsmatchparascounts = Integer(tstat_6.Length)
initiallinecount_3 = Integer(initiallinecount_2)
flatten_11 = FlattenTree(Tree=functionparasdepathlist_2, Path="{0}")
panel_21 = Panel(functionparasdepathlist)
functionscount = Integer(tstat_6.Count)

# ----
# sample_treeStatistics
cset_3 = CreateSet(List=num_2)  # -> Set, Map
tstat_8 = TreeStatistics(Tree=cset_3.Map)  # -> Paths, Length, Count
dpath_3 = DeconstructPath(Branch=tstat_8.Paths)
stack_7 = StackData(Data=dpath_3, Stack=graft(tstat_8.Length))
graft_16 = GraftTree(Tree=cset_3.Map, IncludeEmptyLists=True, IncludeNullItems=True)
graft_17 = GraftTree(Tree=stack_7, IncludeEmptyLists=True, IncludeNullItems=True)  # -> simplify(Tree)
ins_6 = InsertItems(List=graft_17, Item=graft_16, Indices="-1", Wrap=True)
path_5 = ConstructPath(Indices=ins_6)  # -> simplify(Branch)
flatten_12 = FlattenTree(Tree=path_5, Path="{0}")

functionsmatchparascounts_2 = Integer(tstat_7.Length)
initiallinecount_4 = Integer(initiallinecount)
functionscount_2 = Integer(tstat_7.Count)
lng = ListLength(List=flatten_10)
multiplication = Multiplication(A=initialparascounts_3, B=functionscount)
lng_2 = ListLength(List=flatten_11)
multiplication_2 = Multiplication(A=initiallinecount_3, B=lng)
multiplication_3 = Multiplication(A=initialparascounts_4, B=functionscount_2)
panel_23 = Panel(initialparascounts_4)
multiplication_4 = Multiplication(A=initiallinecount_4, B=lng_2)
repeat = RepeatData(Data=initialparasdepathlist_3, Length=multiplication)  # -> simplify(Data)
repeat_2 = RepeatData(Data=flatten_10, Length=multiplication_2)
repeat_3 = RepeatData(Data=initialparasdepathlist_4, Length=multiplication_3)  # -> simplify(Data)
repeat_4 = RepeatData(Data=flatten_11, Length=multiplication_4)
partition = PartitionList(List=repeat, Size=initialparascounts_3)  # -> simplify(Chunks)
partition_2 = PartitionList(List=repeat_2, Size=lng)
partition_3 = PartitionList(List=partition_2, Size=functionsmatchparascounts)  # -> simplify(Chunks)
partition_4 = PartitionList(List=repeat_3, Size=initialparascounts_4)  # -> simplify(Chunks)
partition_5 = PartitionList(List=repeat_4, Size=lng_2)
partition_6 = PartitionList(List=partition_5, Size=functionsmatchparascounts_2)  # -> simplify(Chunks)
# path{x;y}表示，索引为x的线可以匹配索引为y算法。
# 如果是相同x下有多个，说明算法上有多个选择
int_9 = Integer(partition_3)
int_10 = Integer(partition)
mindex_2 = MemberIndex(Set=int_9, Member=int_10)  # -> Index, Count
lng_3 = ListLength(List=int_9)
# path{x;y}表示，索引为x的线可以匹配索引为y算法。
# 如果是相同x下有多个，说明算法上有多个选择
int_11 = Integer(partition_6)
int_12 = Integer(partition_4)
mindex_3 = MemberIndex(Set=int_11, Member=int_12)  # -> Index, Count
lng_4 = ListLength(List=int_11)
ma = MassAddition(Input=mindex_2.Count)  # -> Result, PartialResults
equals_3 = Equality(FirstNumber=lng_3, SecondNumber=ma.Result)  # -> Equality, Inequality
ma_2 = MassAddition(Input=mindex_3.Count)  # -> Result, PartialResults
equals_4 = Equality(FirstNumber=lng_4, SecondNumber=ma_2.Result)  # -> Equality, Inequality
panel_25 = Panel("""2
3""")
panel_26 = Panel("""2
2""")
panel_27 = Panel("""1
3
5""")
panel_28 = Panel("""1
0
4""")
panel_29 = Panel("""7
2
2""")
panel_30 = Panel("""2,3,1
4,2,3
1,3,2""")
panel_31 = Panel("""3,2,2
2,3,2
4,1,3""")
panel_32 = Panel("""3
2
1""")
panel_33 = Panel("""3,2,2
1,3,4
4,1,3""")
panel_34 = Panel("""3.22133
1.3229
pi""")
panel_35 = Panel("""3.42
5.33
1.44""")
sift_3 = SiftPattern(List=int_9, SiftPattern=equals_3.Equality)  # -> Output0, Output1
panel_36 = Panel("""3,2
1,3
0,1""")
panel_37 = Panel("""2,3
4,0
1,3""")
panel_38 = Panel("""1
3""")
sift_4 = SiftPattern(List=int_11, SiftPattern=equals_4.Equality)  # -> Output0, Output1
clean_3 = CleanTree(RemoveNulls=True, RemoveInvalid=True, RemoveEmpty=True, Tree=sift_3.Output1)
tstat_9 = TreeStatistics(Tree=clean_3)  # -> Paths, Length, Count
clean_4 = CleanTree(RemoveNulls=True, RemoveInvalid=True, RemoveEmpty=True, Tree=sift_4.Output1)
# each line choose first function
path_6 = DataPath(tstat_9.Paths)
tstat_10 = TreeStatistics(Tree=clean_4)  # -> Paths, Length, Count
A = Number(panel_25)
B = Number(panel_26)
C = Number(panel_38)
k = Number(panel_27)
a = Number(panel_28)
b = Number(panel_29)
pt0 = Point([Point(-8, -7, 0), Point(-5, 0, 0), Point(-16, -3, 0)])
pt1 = Point([Point(-8, -10, 0), Point(3, -7, 0), Point(-4, -2, 0)])
intersection_line0_a0_b0_c0 = Vector(panel_30)
intersection_line0_a1_b1_c1 = Vector(panel_31)
intersection_m = Number(panel_32)
parallel_line_a2_b2_c2 = Vector(panel_33)
angle_3 = Number(panel_34)
distance_p = Number(panel_35)
vector_u_v = Vector(panel_36)
normal_vector_nu_nv = Vector(panel_37)
dpath_4 = DeconstructPath(Branch=tstat_9.Paths)
dpath_5 = DeconstructPath(Branch=tstat_10.Paths)
pi_7 = Pi(Factor=1)
item_7 = ListItem(List=dpath_4, Index=0, Wrap=True)
flatten_13 = FlattenTree(Tree=item_7, Path="{0}")
cset_4 = CreateSet(List=flatten_13)  # -> Set, Map
item_8 = ListItem(List=path_6, Index=cset_4.Set, Wrap=False)
complex = ComplexComponents(Complex=pt0)  # -> Real, Imaginary
complex_2 = ComplexComponents(Complex=pt1)  # -> Real, Imaginary
item_9 = ListItem(List=dpath_5, Index=0, Wrap=True)

# ----
# path{x;y}
# x         --> line index
# y         --> function index
# value  -->  parameters index
# each line choose first function
flatten_14 = FlattenTree(Tree=item_9, Path="{0}")
path_7 = DataPath(tstat_10.Paths)
cset_5 = CreateSet(List=flatten_14)  # -> Set, Map
item_10 = ListItem(List=path_7, Index=cset_5.Set, Wrap=False)
branch_2 = TreeBranch(Tree=clean_4, Path=item_10, MaintainPaths=True)
int_13 = Integer(branch_2)

division_3 = Division(A=angle_3, B=pi_7)
int_14 = Integer(division_3)
# path{x;y}
# x         --> line index
# y         --> function index
# value  -->  parameters index
branch_3 = TreeBranch(Tree=clean_3, Path=item_8, MaintainPaths=True)
complex_3 = ComplexComponents(Complex=vector_u_v)  # -> Real, Imaginary
x0 = Number(complex.Real)
y0 = Number(complex.Imaginary)
x1 = Number(complex_2.Real)
y1 = Number(complex_2.Imaginary)
subtraction_2 = Subtraction(A=division_3, B=int_14)
equals_5 = Equality(FirstNumber=A, SecondNumber="0")  # -> Equality, Inequality
equals_6 = Equality(FirstNumber=B, SecondNumber="0")  # -> Equality, Inequality
abs = Absolute(Value=subtraction_2)
merge_4 = Merge(Data1=graft(A), Data2=graft(B), Data3=graft(C))
equals_7 = Equality(FirstNumber=a, SecondNumber="0")  # -> Equality, Inequality
equals_8 = Equality(FirstNumber=b, SecondNumber="0")  # -> Equality, Inequality
pdecon = Deconstruct(Point=intersection_line0_a0_b0_c0)  # -> XComponent, YComponent, ZComponent
pdecon_2 = Deconstruct(Point=intersection_line0_a1_b1_c1)  # -> XComponent, YComponent, ZComponent
complex_4 = ComplexComponents(Complex=normal_vector_nu_nv)  # -> Real, Imaginary
int_15 = Integer(branch_3)
and_3 = GateAnd(A=graft(equals_5.Inequality), B=graft(equals_6.Inequality))
equals_9 = Equality(FirstNumber=complex_3.Real, SecondNumber="0")  # -> Equality, Inequality
equals_10 = Equality(FirstNumber=complex_3.Imaginary, SecondNumber="0")  # -> Equality, Inequality
larger_3 = LargerThan(FirstNumber=abs, SecondNumber="0.000001")  # -> LargerThan, OrEqualTo
and_4 = GateAnd(A=equals_7.Inequality, B=equals_8.Inequality)
panel_39 = Panel(int_13)
equals_11 = Equality(FirstNumber=complex_4.Real, SecondNumber="0")  # -> Equality, Inequality
equals_12 = Equality(FirstNumber=complex_4.Imaginary, SecondNumber="0")  # -> Equality, Inequality
and_5 = GateAnd(A=equals_9.Inequality, B=equals_10.Inequality)
pdecon_3 = Deconstruct(Point=parallel_line_a2_b2_c2)  # -> XComponent, YComponent, ZComponent
sift_5 = SiftPattern(List=merge_4, SiftPattern=and_3)  # -> Output0, Output1
sift_6 = SiftPattern(List=angle_3, SiftPattern=larger_3.LargerThan)  # -> Output0, Output1
sift_7 = SiftPattern(List=distance_p, SiftPattern=larger_3.LargerThan)  # -> Output0, Output1
and_6 = GateAnd(A=equals_11.Inequality, B=equals_12.Inequality)
sift_8 = SiftPattern(List=complex_4.Imaginary, SiftPattern=and_6)  # -> Output0, Output1
sift_9 = SiftPattern(List=complex_4.Real, SiftPattern=and_6)  # -> Output0, Output1
sift_10 = SiftPattern(List=complex_3.Imaginary, SiftPattern=and_5)  # -> Output0, Output1
sift_11 = SiftPattern(List=complex_3.Real, SiftPattern=and_5)  # -> Output0, Output1
tstat_11 = TreeStatistics(Tree=int_15)  # -> Paths, Length, Count
dpath_6 = DeconstructPath(Branch=tstat_11.Paths)
sift_12 = SiftPattern(List=a, SiftPattern=and_4)  # -> Output0, Output1
sift_13 = SiftPattern(List=b, SiftPattern=and_4)  # -> Output0, Output1
item_11 = ListItem(List=sift_5.Output1, Index=0, Wrap=True)  # -> Item, Item1, Item2
data_3 = Data(data_2)
functionsmatchparascounts_3 = Integer(functionsmatchparascounts)

tstat_12 = TreeStatistics(Tree=int_13)  # -> Paths, Length, Count
dpath_7 = DeconstructPath(Branch=tstat_12.Paths)
data_4 = Data(data)
functionsmatchparascounts_4 = Integer(functionsmatchparascounts_2)
viewer_5 = ParamViewer(dpath_7)
replace_5 = ReplacePaths(Data=dpath_7, Search=viewer_5, Replace=tstat_12.Paths)
item_12 = ListItem(List=replace_5, Index=0, Wrap=True)  # -> Item, Item1
item_13 = ListItem(List=functionsmatchparascounts_4, Index=item_12.Item1, Wrap=False)
stack_8 = StackData(Data=item_12.Item, Stack=item_13)
stack_9 = StackData(Data=item_12.Item1, Stack=item_13)
graft_18 = GraftTree(Tree=int_13, IncludeEmptyLists=True, IncludeNullItems=True)
graft_19 = GraftTree(Tree=stack_8, IncludeEmptyLists=True, IncludeNullItems=True)
graft_20 = GraftTree(Tree=stack_9, IncludeEmptyLists=True, IncludeNullItems=True)
merge_5 = Merge(Data1=graft_19, Data3=graft_18)
ins_7 = InsertItems(List=merge_5, Item="0", Indices="1", Wrap=True)  # -> simplify(List)
path_8 = ConstructPath(Indices=ins_7)
branch_4 = TreeBranch(Tree=data_4, Path=path_8, MaintainPaths=True)

panel_41 = Panel(int_15)
viewer_6 = ParamViewer(dpath_6)
eval_2 = Evaluate(F="{cos(angle),sin(angle),-p}", angle=sift_6.Output1, p=sift_7.Output1)
eval_3 = Evaluate(
    F="{m*A0+A1,m*B0+B1,m*C0+C1}",
    A0=pdecon.XComponent,
    B0=pdecon.YComponent,
    C0=pdecon.ZComponent,
    A1=pdecon_2.XComponent,
    B1=pdecon_2.YComponent,
    C1=pdecon_2.ZComponent,
    m=intersection_m)
eval_4 = Evaluate(F="{A2,B2,-A2*x0-B2*y0}", A2=pdecon_3.XComponent, B2=pdecon_3.YComponent, C2=pdecon_3.ZComponent, x0=x0, y0=y0)
eval_5 = Evaluate(F="{nu,nv,-nu*x0-nv*y0}", x0=x0, y0=y0, nu=sift_9.Output1, nv=sift_8.Output1)
eval_6 = Evaluate(F="{k,-1,y0-k*x0}", k=k, x0=x0, y0=y0)
eval_7 = Evaluate(F="{x0-x1,y1-y0,x0*x1-y0*y1-x0*x0+y0*y0}", x0=x0, y0=y0, x1=x1, y1=y1)
eval_8 = Evaluate(F="{v,-u,-v*x0+u*y0}", x0=x0, y0=y0, u=sift_11.Output1, v=sift_10.Output1)
eval_9 = Evaluate(F="{A,B,C}", A=item_11.Item, B=item_11.Item1, C=item_11.Item2)
eval_10 = Evaluate(F="{b,a,-a*b}", a=sift_12.Output1, b=sift_13.Output1)
eval_11 = Evaluate(F="{k,-1,b}", k=k, b=b)
replace_6 = ReplacePaths(Data=dpath_6, Search=viewer_6, Replace=tstat_11.Paths)
item_14 = ListItem(List=replace_6, Index=0, Wrap=True)  # -> Item, Item1
panel_42 = Panel(eval_9)
panel_43 = Panel(eval_6)
panel_44 = Panel(eval_10)
panel_45 = Panel(eval_11)
panel_46 = Panel(eval_7)
panel_47 = Panel(eval_3)
panel_48 = Panel(eval_4)
panel_49 = Panel(eval_2)
panel_50 = Panel(eval_8)
panel_51 = Panel(eval_5)
item_15 = ListItem(List=functionsmatchparascounts_3, Index=item_14.Item1, Wrap=False)
functionindex = Integer(item_14.Item1)
lineindex = Integer(item_14.Item)
graft_21 = GraftTree(Tree=int_15, IncludeEmptyLists=True, IncludeNullItems=True)
stack_10 = StackData(Data=lineindex, Stack=item_15)
stack_11 = StackData(Data=functionindex, Stack=item_15)
panel_52 = Panel("""{A,B,C}
{k,-1,y0-k*x0}
{b,a,-a*b}
{k,-1,b}
{x0-x1,y1-y0,x0*x1-y0*y1-x0*x0+y0*y0}
{m*A0+A1,m*B0+B1,m*C0+C1}
{A2,B2,-A2*x0-B2*y0}
{cos(angle),sin(angle),-p}
{v,-u,-v*x0+u*y0}
{nu,nv,-nu*x0-nv*y0}""")
parametersindex = Integer(graft_21)
graft_22 = GraftTree(Tree=stack_10, IncludeEmptyLists=True, IncludeNullItems=True)
graft_23 = GraftTree(Tree=stack_11, IncludeEmptyLists=True, IncludeNullItems=True)
merge_6 = Merge(Data1=graft_22, Data3=parametersindex)
panel_53 = Panel("""{A,B,C}
{k,-1,y0-k*x0}
{b,a,-a*b}
{k,-1,b}
{x0-x1,y1-y0,x0*x1-y0*y1-x0*x0+y0*y0}
{m*A0+A1,m*B0+B1,m*C0+C1}
{A2,B2,-A2*x0-B2*y0}
{cos(angle),sin(angle),-p}
{v,-u,-v*x0+u*y0}
{nu,nv,-nu*x0-nv*y0}""")
ins_8 = InsertItems(List=merge_6, Item="0", Indices="1", Wrap=True)  # -> simplify(List)
item_16 = ListItem(List=panel_52, Index=functionindex, Wrap=True)
path_9 = ConstructPath(Indices=ins_8)
branch_5 = TreeBranch(Tree=data_3, Path=path_9, MaintainPaths=True)
panel_54 = Panel("""0
0.4
1
1.5
1.5
1.92
2
2.05
2.1
2.4
2.3
2.3
2.1
3
3.12
3.11
3.12""")
num_6 = Number(branch_5)
panel_55 = Panel("""0
1
2
3
2
2
3
1
2
1
0
0
2
0
1
3""")
panel_56 = Panel("""0
1
2
1.3
3
2.3
2""")
line = Line(Line((119.3393443, -60.78584412, 0), (119.6525493, -60.78584412, 0)))
panel_57 = Panel("""0
1
0
1.3
3
1
2.3
2""")
line_2 = Line(Line((119.8096632, -60.78584412, 0), (119.4931182, -60.78584412, 0)))
panel_58 = Panel("运算器存在bug")
sift_14 = SiftPattern(List=num_6, SiftPattern=parametersindex)  # -> Output0, Output1, Output2, Output3, Output4, Output5, Output6, Output7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
ccx = CurveCurve(CurveA=line, CurveB=line_2)  # -> Points, ParamsA, ParamsB
sift_15 = SiftPattern(List=branch_4, SiftPattern=graft_20)  # -> Output0, Output1, Output2, Output3, Output4, Output5, Output6, Output7, Output8, Output9

clean_5 = CleanTree(RemoveNulls=True, RemoveInvalid=True, RemoveEmpty=True, Tree=sift_14.Output0)
clean_6 = CleanTree(RemoveNulls=True, RemoveInvalid=True, RemoveEmpty=True, Tree=sift_14.Output1)
clean_7 = CleanTree(RemoveNulls=True, RemoveInvalid=True, RemoveEmpty=True, Tree=sift_14.Output2)
clean_8 = CleanTree(RemoveNulls=True, RemoveInvalid=True, RemoveEmpty=True, Tree=sift_14.Output3)
clean_9 = CleanTree(RemoveNulls=True, RemoveInvalid=True, RemoveEmpty=True, Tree=sift_14.Output4)
clean_10 = CleanTree(RemoveNulls=True, RemoveInvalid=True, RemoveEmpty=True, Tree=sift_14.Output5)
clean_11 = CleanTree(RemoveNulls=True, RemoveInvalid=True, RemoveEmpty=True, Tree=sift_14.Output6)
clean_12 = CleanTree(RemoveNulls=True, RemoveInvalid=True, RemoveEmpty=True, Tree=sift_14.Output7)
clean_13 = CleanTree(RemoveNulls=True, RemoveInvalid=True, RemoveEmpty=True, Tree=sift_14.Output8)
clean_14 = CleanTree(RemoveNulls=True, RemoveInvalid=True, RemoveEmpty=True, Tree=sift_14.Output9)
clean_15 = CleanTree(RemoveNulls=True, RemoveInvalid=True, RemoveEmpty=True, Tree=sift_14.Output10)
clean_16 = CleanTree(RemoveNulls=True, RemoveInvalid=True, RemoveEmpty=True, Tree=sift_14.Output11)
clean_17 = CleanTree(RemoveNulls=True, RemoveInvalid=True, RemoveEmpty=True, Tree=sift_14.Output12)
clean_18 = CleanTree(RemoveNulls=True, RemoveInvalid=True, RemoveEmpty=True, Tree=sift_14.Output13)
clean_19 = CleanTree(RemoveNulls=True, RemoveInvalid=True, RemoveEmpty=True, Tree=sift_14.Output14)
clean_20 = CleanTree(RemoveNulls=True, RemoveInvalid=True, RemoveEmpty=True, Tree=sift_14.Output15)
clean_21 = CleanTree(RemoveNulls=True, RemoveInvalid=True, RemoveEmpty=True, Tree=sift_14.Output16)
clean_22 = CleanTree(RemoveNulls=True, RemoveInvalid=True, RemoveEmpty=True, Tree=sift_14.Output17)
clean_23 = CleanTree(RemoveNulls=True, RemoveInvalid=True, RemoveEmpty=True, Tree=sift_14.Output18)
clean_24 = CleanTree(RemoveNulls=True, RemoveInvalid=True, RemoveEmpty=True, Tree=sift_14.Output19)
clean_25 = CleanTree(RemoveNulls=True, RemoveInvalid=True, RemoveEmpty=True, Tree=sift_14.Output20)
clean_26 = CleanTree(RemoveNulls=True, RemoveInvalid=True, RemoveEmpty=True, Tree=sift_14.Output21)
clean_27 = CleanTree(RemoveNulls=True, RemoveInvalid=True, RemoveEmpty=True, Tree=sift_14.Output22)
clean_28 = CleanTree(RemoveNulls=True, RemoveInvalid=True, RemoveEmpty=True, Tree=sift_14.Output23)
clean_29 = CleanTree(RemoveNulls=True, RemoveInvalid=True, RemoveEmpty=True, Tree=sift_14.Output24)
clean_30 = CleanTree(RemoveNulls=True, RemoveInvalid=True, RemoveEmpty=True, Tree=sift_14.Output25)
pshift_4 = ShiftPaths(Data=clean_5, Offset=-1)
pshift_5 = ShiftPaths(Data=clean_6, Offset=-1)
pshift_6 = ShiftPaths(Data=clean_7, Offset=-1)
pshift_7 = ShiftPaths(Data=clean_8, Offset=-1)
pshift_8 = ShiftPaths(Data=clean_9, Offset=-1)
pshift_9 = ShiftPaths(Data=clean_10, Offset=-1)
pshift_10 = ShiftPaths(Data=clean_11, Offset=-1)
pshift_11 = ShiftPaths(Data=clean_12, Offset=-1)
pshift_12 = ShiftPaths(Data=clean_13, Offset=-1)
pshift_13 = ShiftPaths(Data=clean_14, Offset=-1)
pshift_14 = ShiftPaths(Data=clean_15, Offset=-1)
pshift_15 = ShiftPaths(Data=clean_16, Offset=-1)
pshift_16 = ShiftPaths(Data=clean_17, Offset=-1)
pshift_17 = ShiftPaths(Data=clean_18, Offset=-1)
pshift_18 = ShiftPaths(Data=clean_19, Offset=-1)
pshift_19 = ShiftPaths(Data=clean_20, Offset=-1)
pshift_20 = ShiftPaths(Data=clean_21, Offset=-1)
pshift_21 = ShiftPaths(Data=clean_22, Offset=-1)
pshift_22 = ShiftPaths(Data=clean_23, Offset=-1)
pshift_23 = ShiftPaths(Data=clean_24, Offset=-1)
pshift_24 = ShiftPaths(Data=clean_25, Offset=-1)
pshift_25 = ShiftPaths(Data=clean_26, Offset=-1)
pshift_26 = ShiftPaths(Data=clean_27, Offset=-1)
pshift_27 = ShiftPaths(Data=clean_28, Offset=-1)
pshift_28 = ShiftPaths(Data=clean_29, Offset=-1)
pshift_29 = ShiftPaths(Data=clean_30, Offset=-1)

item_17 = ListItem(List=panel_53, Index=item_12.Item1, Wrap=True)

# ----
# mapping between angle and path
# {0;0} --> 0
# {1;0} --> 1/2*pi
# {2;0} --> pi
# {3;0} --> 3/2*pi
# 无所谓正交向量存不存在
jitter_2 = Jitter(List=panel_56, Jitter=1, Seed=2)  # -> Values, Indices
pi_8 = Pi(Factor=1)
pi_9 = Pi(Factor="2")
division_4 = Division(A=pi_8, B="2")
num_7 = Number(jitter_2.Values)
# log:
# 20161011
# 增强path的排序的算法前馈，可通过path运算直接得到向量关系:
# 排序前后问题：
# 先精确控制还是先离散问题
remap_3 = RemapNumbers(Value=num_7, Source="4", Target=pi_9)  # -> Mapped, Clipped
series_4 = Series(Start=0, Step=division_4, Count="5")
consec_3 = ConsecutiveDomains(Numbers=series_4, Additive=False)  # -> simplify(Domains)
angle_4 = Number(remap_3.Mapped)
domain_3 = Domain(graft(consec_3))
dedomain_3 = DeconstructDomain(Domain=domain_3)  # -> simplify(Start), simplify(End)
# log:
# 20161012
# debug时候replacePath爆红:
# 删除空的树形数据结构，merge的时候数据结构对应
# 精度问题导致set不能去掉原本偏差相同的角度：
# 用round函数取到小数点后几位，关键是排序，这样做就不会对原来的数据产生什么影响，是标签改对了
larger_4 = LargerThan(FirstNumber=angle_4, SecondNumber=dedomain_3.Start)  # -> LargerThan, OrEqualTo
smaller_3 = SmallerThan(FirstNumber=angle_4, SecondNumber=dedomain_3.End)  # -> SmallerThan, OrEqualTo
and_7 = GateAnd(A=larger_4.OrEqualTo, B=smaller_3.SmallerThan)
sift_16 = SiftPattern(List=angle_4, SiftPattern=and_7)  # -> Output0, Output1
clean_31 = CleanTree(RemoveNulls=True, RemoveInvalid=False, RemoveEmpty=True, Tree=sift_16.Output1)  # -> simplify(Tree)
tstat_13 = TreeStatistics(Tree=clean_31)  # -> Paths, Length, Count
branch_6 = TreeBranch(Tree=dedomain_3.Start, Path=tstat_13.Paths, MaintainPaths=True)
subtraction_3 = Subtraction(A=clean_31, B=branch_6)
num_8 = Number(clean_31)
eval_12 = Evaluate(F="round(x,4)", x=subtraction_3)
flatten_15 = FlattenTree(Tree=eval_12, Path="{0}")
cset_6 = CreateSet(List=flatten_15)  # -> Set, Map
sort_3 = SortList(Keys=cset_6.Set)  # -> Keys, ValuesA
mindex_4 = MemberIndex(Set=sort_3.Keys, Member=eval_12)  # -> Index, Count
pshift_30 = ShiftPaths(Data=mindex_4.Index, Offset=-1)
flatten_16 = FlattenTree(Tree=mindex_4.Index, Path="{0}")
tstat_14 = TreeStatistics(Tree=pshift_30)  # -> Paths, Length, Count
dpath_8 = DeconstructPath(Branch=tstat_14.Paths)
graft_24 = GraftTree(Tree=flatten_16, IncludeEmptyLists=True, IncludeNullItems=True)  # -> simplify(Tree)
stack_12 = StackData(Data=dpath_8, Stack=graft(tstat_14.Length))
graft_25 = GraftTree(Tree=angle_4, IncludeEmptyLists=True, IncludeNullItems=True)
flatten_17 = FlattenTree(Tree=stack_12, Path="{0}")
graft_26 = GraftTree(Tree=flatten_17, IncludeEmptyLists=True, IncludeNullItems=True)  # -> simplify(Tree)
merge_7 = Merge(Data1=graft_26, Data2=graft_24)
path_10 = ConstructPath(Indices=merge_7)
graft_27 = GraftTree(Tree=num_8, IncludeEmptyLists=True, IncludeNullItems=True)
flatten_18 = FlattenTree(Tree=path_10, Path="{0}")
flatten_19 = FlattenTree(Tree=graft_27, Path="{0}")
viewer_7 = ParamViewer(graft_27)
keysearch_3 = KeyValueSearch(Keys=flatten_19, Values=flatten_18, Search=graft_25)  # -> simplify(Result)
replace_7 = ReplacePaths(Data=graft_27, Search=viewer_7, Replace=flatten_18)
path_11 = DataPath(keysearch_3)
# log:
# 20161010
# 设计向量方向与数据结构之间的映射关系
# 数据结构用集合运算然后替换
# 替换树形结构的时候需要拍平
# 无论什么情况都留出0123正交的位置为Null
# 如果0123存在，没关系，不存在，插入一个空值
# 20161011
# 角度和path之间的映射关系，以及角度的识别:
# 分解basic line的path得到位置位置关系
# 先正交的位置关系，后自由的位置关系
# 考虑先组合line还是先分解path在配对
# 如何识别path知道非正交的相反的向量
# 增强path的排序的算法前馈，可通过path运算直接得到向量关系
# 运用path提取相应的两条交线
# 20161012
# debug时候replacePath爆红
# 精度问题导致set不能去掉原本偏差相同的角度
# 20161017
# 找到了两根交线的关系，先把他放在这，具体怎么用不继续做下去，先考虑其他的大的情况
# 20161023
# 对线的识别方法以及数据的缺省情况
# 数据分流的方法是否合适
ultimateangle_afterelection = Number(replace_7)

clean_32 = CleanTree(RemoveNulls=True, RemoveInvalid=True, RemoveEmpty=True, Tree=sift_15.Output0)
clean_33 = CleanTree(RemoveNulls=True, RemoveInvalid=True, RemoveEmpty=True, Tree=sift_15.Output1)
clean_34 = CleanTree(RemoveNulls=True, RemoveInvalid=True, RemoveEmpty=True, Tree=sift_15.Output2)
clean_35 = CleanTree(RemoveNulls=True, RemoveInvalid=True, RemoveEmpty=True, Tree=sift_15.Output3)
clean_36 = CleanTree(RemoveNulls=True, RemoveInvalid=True, RemoveEmpty=True, Tree=sift_15.Output4)
clean_37 = CleanTree(RemoveNulls=True, RemoveInvalid=True, RemoveEmpty=True, Tree=sift_15.Output5)
clean_38 = CleanTree(RemoveNulls=True, RemoveInvalid=True, RemoveEmpty=True, Tree=sift_15.Output6)
clean_39 = CleanTree(RemoveNulls=True, RemoveInvalid=True, RemoveEmpty=True, Tree=sift_15.Output7)
clean_40 = CleanTree(RemoveNulls=True, RemoveInvalid=True, RemoveEmpty=True, Tree=sift_15.Output8)
clean_41 = CleanTree(RemoveNulls=True, RemoveInvalid=True, RemoveEmpty=True, Tree=sift_15.Output9)
line_bug_commonline = Line([Line((119.3540923, -60.56923774, 0), (119.5008735, -60.56923774, 0)), Line((119.5919791, -60.56923774, 0), (119.7404475, -60.56923774, 0))])
# debug:之前判断是实交和虚交的方法是判断交点point的x坐标是否在两线段的值域范围内，但是当上述情况的时候，直线会虚交被误判成实际交点
line_bug_insectiononextend = Line([Line((119.0174668, -60.28107794, 0), (119.4638718, -60.28107794, 0)), Line((119.2255633, -60.35451331, 0), (119.2255633, -61.15203638, 0))])
# log:
# 20161010
# 设计向量方向与数据结构之间的映射关系
# 分离对应的算法，让算法之间有通过也有分离
# 线线重合的问题解决后先放在一旁
# 数据结构的替换，在最后做
line_3 = Line([Line((119.5723897, -60.99532941, 0), (119.5723897, -61.13933165, 0)), Line((119.5723897, -60.99532941, 0), (119.7626783, -60.99532941, 0))])
tstat_15 = TreeStatistics(Tree=clean_40)  # -> Paths, Length, Count
panel_59 = Panel(clean_34)
panel_60 = Panel("把正交和斜交的情况分离开来，同时组织数据结构")
panel_61 = Panel(branch_5)
panel_62 = Panel(pshift_4)
eval_13 = Evaluate(
    F=item_16,
    A=pshift_4,
    B=pshift_5,
    C=pshift_6,
    k=pshift_7,
    a=pshift_8,
    b=pshift_9,
    x0=pshift_10,
    y0=pshift_11,
    x1=pshift_12,
    y1=pshift_13,
    A0=pshift_14,
    B0=pshift_15,
    C0=pshift_16,
    A1=pshift_17,
    B1=pshift_18,
    C1=pshift_19,
    m=pshift_20,
    A2=pshift_21,
    B2=pshift_22,
    C2=pshift_23,
    angle=pshift_24,
    p=pshift_25,
    u=pshift_26,
    v=pshift_27,
    nu=pshift_28,
    nv=pshift_29)
panel_63 = Panel(eval_13)
panel_64 = Panel(item_16)
databasemapping_6 = Panel("""0,1,2;(0!=zero)and(1!=zero)
3,6,7;
4,5;(4!=zero)and(5!=zero)
3,5;
6,7,8,9;(6!=8)and(7!=9)
10,11,12,13,14,15;
6,7,17,18,19;
20,21;20=!k*pi,k=1,2,3..
22,23;(22!=zero)and(23!=zero)
24,25;(24!=zero)and(25!=zero)""")
# foolish!
# foolish!
# foolish!
tstat_16 = TreeStatistics(Tree=int_13)  # -> Paths, Length, Count
num_9 = Number()
pshift_31 = ShiftPaths(Data=tstat_16.Paths, Offset=-1)
dpath_9 = DeconstructPath(Branch=pshift_31)
panel_65 = Panel(num_9)
viewer_8 = ParamViewer(dpath_9)
replace_8 = ReplacePaths(Data=dpath_9, Search=viewer_8, Replace=item_10)
item_18 = ListItem(List=replace_8, Index=0, Wrap=True)  # -> Item, Item1
panel_66 = Panel(replace_8)

# ----
# f(x) revise beta1
panel_67 = Panel("""4
3
7""")
graft_28 = GraftTree(Tree=panel_67, IncludeEmptyLists=True, IncludeNullItems=True)
panel_68 = Panel("""9
6
3""")
panel_69 = Panel("""4
2
7""")
panel_70 = Panel("""x+y
x+2*y
x*y""")
path_12 = ConstructPath(Indices=graft_28)
graft_29 = GraftTree(Tree=panel_68, IncludeEmptyLists=True, IncludeNullItems=True)
graft_30 = GraftTree(Tree=panel_69, IncludeEmptyLists=True, IncludeNullItems=True)
item_19 = ListItem(List=panel_70, Index=graft_28, Wrap=True)
flatten_20 = FlattenTree(Tree=path_12, Path="{0}")
viewer_9 = ParamViewer(graft_29)
viewer_10 = ParamViewer(graft_30)
viewer_11 = ParamViewer(item_19)
replace_9 = ReplacePaths(Data=graft_29, Search=viewer_9, Replace=flatten_20)
replace_10 = ReplacePaths(Data=graft_30, Search=viewer_10, Replace=flatten_20)
replace_11 = ReplacePaths(Data=item_19, Search=viewer_11, Replace=flatten_20)
eval_14 = Evaluate(F=replace_11, x=replace_10, y=replace_9)
panel_71 = Panel(replace_11)
panel_72 = Panel(eval_14)

# ----
# f(x) revise beta 02
panel_73 = Panel("""4
3
7
1
3""")
panel_74 = Panel("""4
3
7""")
int_16 = Integer(panel_74)
int_17 = Integer(panel_73)
graft_31 = GraftTree(Tree=int_16, IncludeEmptyLists=True, IncludeNullItems=True)
graft_32 = GraftTree(Tree=int_17, IncludeEmptyLists=True, IncludeNullItems=True)
panel_75 = Panel("""9
6
3
4
2""")
panel_76 = Panel("""x+y
x+2*y
x*y""")
panel_77 = Panel("""4
2
7
4
3""")
path_13 = ConstructPath(Indices=graft_31)
path_14 = ConstructPath(Indices=graft_32)
graft_33 = GraftTree(Tree=panel_75, IncludeEmptyLists=True, IncludeNullItems=True)
graft_34 = GraftTree(Tree=panel_77, IncludeEmptyLists=True, IncludeNullItems=True)
graft_35 = GraftTree(Tree=panel_76, IncludeEmptyLists=True, IncludeNullItems=True)
flatten_21 = FlattenTree(Tree=path_13, Path="{0}")
flatten_22 = FlattenTree(Tree=path_14, Path="{0}")
viewer_12 = ParamViewer(graft_34)
viewer_13 = ParamViewer(graft_33)
viewer_14 = ParamViewer(graft_35)
replace_12 = ReplacePaths(Data=graft_34, Search=viewer_12, Replace=flatten_22)
replace_13 = ReplacePaths(Data=graft_33, Search=viewer_13, Replace=flatten_22)
replace_14 = ReplacePaths(Data=graft_35, Search=viewer_14, Replace=flatten_21)
branch_7 = TreeBranch(Tree=replace_13, Path=flatten_21, MaintainPaths=True)
branch_8 = TreeBranch(Tree=replace_12, Path=flatten_21, MaintainPaths=True)
panel_78 = Panel(graft_35)
eval_15 = Evaluate(F=replace_14, x=branch_8, y=branch_7)
panel_79 = Panel(replace_14)
panel_80 = Panel(branch_8)
panel_81 = Panel(eval_15)
panel_82 = Panel(branch_7)

int_18 = Integer(item_18.Item)
int_19 = Integer(item_18.Item1)

# ----
# {a;b;c;d;e}
# a --> line index
# b --> line type
# c --> line parameter index
# d --> line function mapping
lng_5 = ListLength(List=int_13)
flatten_23 = FlattenTree(Tree=item.Item1, Path="{0}")
stack_13 = StackData(Data=int_18, Stack=lng_5)
item_20 = ListItem(List=flatten_23, Index=stack_13, Wrap=True)
stack_14 = StackData(Data=int_19, Stack=lng_5)
graft_36 = GraftTree(Tree=int_13, IncludeEmptyLists=True, IncludeNullItems=True)
graft_37 = GraftTree(Tree=stack_13, IncludeEmptyLists=True, IncludeNullItems=True)
graft_38 = GraftTree(Tree=item_20, IncludeEmptyLists=True, IncludeNullItems=True)
graft_39 = GraftTree(Tree=stack_14, IncludeEmptyLists=True, IncludeNullItems=True)
merge_8 = Merge(Data1=graft_37, Data2=graft_38, Data3=graft_36)
merge_9 = Merge(Data1=graft_37, Data2=graft_38, Data3=graft_36, Data4=graft_39)
path_15 = ConstructPath(Indices=merge_8)
path_16 = ConstructPath(Indices=merge_9)
data_5 = Data(data)
flatten_24 = FlattenTree(Tree=path_15, Path="{0}")
flatten_25 = FlattenTree(Tree=path_16, Path="{0}")
branch_9 = TreeBranch(Tree=data_5, Path=flatten_24, MaintainPaths=True)
viewer_15 = ParamViewer(branch_9)
replace_15 = ReplacePaths(Data=branch_9, Search=viewer_15, Replace=flatten_25)

eval_16 = Evaluate(
    F="{A,B,C}",
    A=num_9,
    B=num_9,
    C=num_9,
    k=num_9,
    x0=num_9,
    y0=num_9,
    a=num_9,
    b=num_9,
    x1=num_9,
    y1=num_9,
    A0=num_9,
    B0=num_9,
    C0=num_9,
    A1=num_9,
    B1=num_9,
    C1=num_9,
    m=num_9,
    A2=num_9,
    B2=num_9,
    C2=num_9,
    angle=num_9,
    p=num_9,
    u=num_9,
    v=num_9,
    nu=num_9,
    nv=num_9)
panel_83 = Panel(eval_16)
int_20 = Integer(tstat_7.Length)
panel_84 = Panel("""0;0;0_3.2/1_1.0/3_2.2/5_4.0
1;0;2_2.5/3_4.0/4_8.2/5_1.2/7_2,3.2
2;0;1_2.2/7_2,1.9/11_3.222
3;0;4_8.2/6_4,2.2/14_2.442,3.442
4;0;4_8.2/6_1.2,4.2/14_3.56,4.23
5;0;3_3.2/6_1.2,4.2
6;0;0_2/2_2.3/1_3.2
7;0;6_3.2,1.2/7_1.2,3.2
8;0;8_3.2,2.2,1.2/9_3.4,1.3,1.2/10_2
9;0;6_2.2,3.1/11_4,3,2.2
10;0;12_3.221/13_4
11;0;6_3.21,2.22/15_4.23,5.43""")
int_21 = Integer(graft_39)
data_6 = Data(replace_15)
panel_85 = Panel(data_6)
panel_86 = Panel(replace_15)
item_21 = ListItem(List=int_20, Index=0, Wrap=False)  # -> Item, Item1, Item2, Item3, Item4, Item5, Item6, Item7, Item8, Item9
num_10 = Number(item_21.Item8)
series_5 = Series(Start=0, Step=1, Count=num_10)
sift_17 = SiftPattern(List=tstat_15.Paths, SiftPattern=series_5)  # -> Output0, Output1
branch_10 = TreeBranch(Tree=clean_40, Path=sift_17.Output1, MaintainPaths=True)
branch_11 = TreeBranch(Tree=clean_40, Path=sift_17.Output0, MaintainPaths=True)
item_22 = ListItem(List=branch_11, Index=0, Wrap=False)  # -> Item, Item1
item_23 = ListItem(List=branch_10, Index=0, Wrap=False)  # -> Item, Item1

u = Number(item_23.Item)
v = Number(item_23.Item1)
y0_2 = Number(item_22.Item1)
x0_2 = Number(item_22.Item)
equals_13 = Equality(FirstNumber=u, SecondNumber="0")  # -> Equality, Inequality
equals_14 = Equality(FirstNumber=v, SecondNumber="0")  # -> Equality, Inequality
and_8 = GateAnd(A=equals_13.Inequality, B=equals_14.Inequality)
sift_18 = SiftPattern(List=v, SiftPattern=and_8)  # -> Output0, Output1
sift_19 = SiftPattern(List=u, SiftPattern=and_8)  # -> Output0, Output1
eval_17 = Evaluate(F="{v,-u,-v*x0+u*y0}", x0=x0_2, y0=y0_2, u=sift_19.Output1, v=sift_18.Output1)
panel_87 = Panel(eval_17)
path_mapper = PathMapper(eval_17, source="{A;B;C;D}", target="{A;B;0}")
panel_88 = Panel(path_mapper)

sift_20 = SiftPattern(List=data_6, SiftPattern=int_21)  # -> Output0, Output1, Output2, Output3, Output4, Output5, Output6, Output7, Output8, Output9
clean_42 = CleanTree(RemoveNulls=True, RemoveInvalid=True, RemoveEmpty=True, Tree=sift_20.Output0)
clean_43 = CleanTree(RemoveNulls=True, RemoveInvalid=True, RemoveEmpty=True, Tree=sift_20.Output1)
clean_44 = CleanTree(RemoveNulls=True, RemoveInvalid=True, RemoveEmpty=True, Tree=sift_20.Output2)
clean_45 = CleanTree(RemoveNulls=True, RemoveInvalid=True, RemoveEmpty=True, Tree=sift_20.Output3)
clean_46 = CleanTree(RemoveNulls=True, RemoveInvalid=True, RemoveEmpty=True, Tree=sift_20.Output4)
clean_47 = CleanTree(RemoveNulls=True, RemoveInvalid=True, RemoveEmpty=True, Tree=sift_20.Output5)
clean_48 = CleanTree(RemoveNulls=True, RemoveInvalid=True, RemoveEmpty=True, Tree=sift_20.Output6)
clean_49 = CleanTree(RemoveNulls=True, RemoveInvalid=True, RemoveEmpty=True, Tree=sift_20.Output7)
clean_50 = CleanTree(RemoveNulls=True, RemoveInvalid=True, RemoveEmpty=True, Tree=sift_20.Output8)
clean_51 = CleanTree(RemoveNulls=True, RemoveInvalid=True, RemoveEmpty=True, Tree=sift_20.Output9)
tstat_17 = TreeStatistics(Tree=clean_49)  # -> Paths, Length, Count
tstat_18 = TreeStatistics(Tree=clean_47)  # -> Paths, Length, Count
tstat_19 = TreeStatistics(Tree=clean_48)  # -> Paths, Length, Count
tstat_20 = TreeStatistics(Tree=clean_46)  # -> Paths, Length, Count

# ----
# 00 common parallel
# 10 vectical
# 20 reverse parallel
# 30 vectical
path_17 = DataPath(path_11)
flatten_26 = FlattenTree(Tree=path_17, Path="{0}")
tstat_21 = TreeStatistics(Tree=path_17)  # -> Paths, Length, Count
tstat_22 = TreeStatistics(Tree=path_17)  # -> Paths, Length, Count
ma_3 = MassAddition(Input=tstat_21.Length)  # -> Result, PartialResults
series_6 = Series(Start=0, Step=1, Count=tstat_22.Count)
stack_15 = StackData(Data=ma_3.PartialResults, Stack=tstat_21.Length)
shift = ShiftList(List=series_6, Shift=stack_15, Wrap=False)
item_24 = ListItem(List=flatten_26, Index=shift, Wrap=True)  # -> simplify(Item)
lng_6 = ListLength(List=item_24)
# log:
# 20161011
# 如何识别path知道非正交的相反的向量
# 增强path的排序的算法前馈，可通过path运算直接得到向量关系
# 运用path提取相应的两条交线；
# 索引交线，并保留原有树形结构
stack_16 = StackData(Data=path_17, Stack=lng_6)
secondpath = DataPath(item_24)
firstpath = DataPath(stack_16)
dpath_10 = DeconstructPath(Branch=firstpath)
dpath_11 = DeconstructPath(Branch=secondpath)
subtraction_4 = Subtraction(A=dpath_10, B=dpath_11)
abs_2 = Absolute(Value=subtraction_4)
item_25 = ListItem(List=abs_2, Index=0, Wrap=True)  # -> Item, Item1
panel_89 = Panel("""00
10
20
30""")
ultimateangle_afterelection_2 = Number(ultimateangle_afterelection)
concat = Concatenate(FragmentA=item_25.Item, FragmentB=item_25.Item1)
mindex_5 = MemberIndex(Set=panel_89, Member=concat)  # -> simplify(Index), Count
graft_40 = GraftTree(Tree=secondpath, IncludeEmptyLists=True, IncludeNullItems=True)
graft_41 = GraftTree(Tree=firstpath, IncludeEmptyLists=True, IncludeNullItems=True)

tstat_23 = TreeStatistics(Tree=clean_51)  # -> Paths, Length, Count
tstat_24 = TreeStatistics(Tree=clean_45)  # -> Paths, Length, Count
tstat_25 = TreeStatistics(Tree=clean_42)  # -> Paths, Length, Count
num_11 = Number(item_21.Item7)
num_12 = Number(item_21.Item5)
num_13 = Number(item_21.Item6)
num_14 = Number(item_21.Item4)
num_15 = Number(item_21.Item)
tstat_26 = TreeStatistics(Tree=clean_44)  # -> Paths, Length, Count
num_16 = Number(item_21.Item3)
num_17 = Number(item_21.Item9)
tstat_27 = TreeStatistics(Tree=clean_43)  # -> Paths, Length, Count
series_7 = Series(Start=0, Step=1, Count=num_11)
num_18 = Number(item_21.Item1)
num_19 = Number(item_21.Item2)
series_8 = Series(Start=0, Step=1, Count=num_12)
series_9 = Series(Start=0, Step=1, Count=num_13)
series_10 = Series(Start=0, Step=1, Count=num_15)
series_11 = Series(Start=0, Step=1, Count=num_14)
num_20 = Number(item_21.Item8)
tstat_28 = TreeStatistics(Tree=clean_50)  # -> Paths, Length, Count
series_12 = Series(Start=0, Step=1, Count=num_17)
series_13 = Series(Start=0, Step=1, Count=num_16)
series_14 = Series(Start=0, Step=1, Count=num_18)
series_15 = Series(Start=0, Step=1, Count=num_19)
sift_21 = SiftPattern(List=tstat_17.Paths, SiftPattern=series_7)  # -> Output0, Output1
sift_22 = SiftPattern(List=tstat_18.Paths, SiftPattern=series_8)  # -> Output0, Output1, Output2
sift_23 = SiftPattern(List=tstat_19.Paths, SiftPattern=series_9)  # -> Output0, Output1
series_16 = Series(Start=0, Step=1, Count=num_20)
sift_24 = SiftPattern(List=tstat_25.Paths, SiftPattern=series_10)  # -> Output0, Output1, Output2
sift_25 = SiftPattern(List=tstat_20.Paths, SiftPattern=series_11)  # -> Output0, Output1
sift_26 = SiftPattern(List=tstat_23.Paths, SiftPattern=series_12)  # -> Output0, Output1
sift_27 = SiftPattern(List=tstat_24.Paths, SiftPattern=series_13)  # -> Output0, Output1
sift_28 = SiftPattern(List=tstat_27.Paths, SiftPattern=series_14)  # -> Output0, Output1
sift_29 = SiftPattern(List=tstat_26.Paths, SiftPattern=series_15)  # -> Output0, Output1
sift_30 = SiftPattern(List=tstat_28.Paths, SiftPattern=series_16)  # -> Output0, Output1
branch_12 = TreeBranch(Tree=clean_47, Path=sift_22.Output1, MaintainPaths=True)
branch_13 = TreeBranch(Tree=clean_47, Path=sift_22.Output0, MaintainPaths=True)
branch_14 = TreeBranch(Tree=clean_47, Path=sift_22.Output2, MaintainPaths=True)
branch_15 = TreeBranch(Tree=clean_48, Path=sift_23.Output0, MaintainPaths=True)
branch_16 = TreeBranch(Tree=clean_46, Path=sift_25.Output0, MaintainPaths=True)
branch_17 = TreeBranch(Tree=clean_48, Path=sift_23.Output1, MaintainPaths=True)
branch_18 = TreeBranch(Tree=clean_46, Path=sift_25.Output1, MaintainPaths=True)
branch_19 = TreeBranch(Tree=clean_49, Path=sift_21.Output0, MaintainPaths=True)
branch_20 = TreeBranch(Tree=clean_49, Path=sift_21.Output1, MaintainPaths=True)
branch_21 = TreeBranch(Tree=clean_51, Path=sift_26.Output0, MaintainPaths=True)
branch_22 = TreeBranch(Tree=clean_45, Path=sift_27.Output0, MaintainPaths=True)
branch_23 = TreeBranch(Tree=clean_51, Path=sift_26.Output1, MaintainPaths=True)
branch_24 = TreeBranch(Tree=clean_45, Path=sift_27.Output1, MaintainPaths=True)
branch_25 = TreeBranch(Tree=clean_42, Path=sift_24.Output0, MaintainPaths=True)
branch_26 = TreeBranch(Tree=clean_42, Path=sift_24.Output1, MaintainPaths=True)
branch_27 = TreeBranch(Tree=clean_42, Path=sift_24.Output1, MaintainPaths=True)
branch_28 = TreeBranch(Tree=clean_44, Path=sift_29.Output1, MaintainPaths=True)
branch_29 = TreeBranch(Tree=clean_44, Path=sift_29.Output0, MaintainPaths=True)
branch_30 = TreeBranch(Tree=clean_43, Path=sift_28.Output1, MaintainPaths=True)
branch_31 = TreeBranch(Tree=clean_43, Path=sift_28.Output0, MaintainPaths=True)
branch_32 = TreeBranch(Tree=clean_50, Path=sift_30.Output1, MaintainPaths=True)
branch_33 = TreeBranch(Tree=clean_50, Path=sift_30.Output0, MaintainPaths=True)
item_26 = ListItem(List=branch_13, Index=0, Wrap=True)  # -> Item, Item1, Item2
item_27 = ListItem(List=branch_12, Index=0, Wrap=True)  # -> Item, Item1, Item2
item_28 = ListItem(List=branch_16, Index=0, Wrap=True)  # -> Item, Item1
item_29 = ListItem(List=branch_18, Index=0, Wrap=True)  # -> Item, Item1
item_30 = ListItem(List=branch_15, Index=0, Wrap=True)  # -> Item, Item1
item_31 = ListItem(List=branch_17, Index=0, Wrap=False)  # -> Item, Item1, Item2
item_32 = ListItem(List=branch_23, Index=0, Wrap=False)  # -> Item, Item1
item_33 = ListItem(List=branch_21, Index=0, Wrap=False)  # -> Item, Item1

A_2 = Number(branch_25)
B_2 = Number(branch_27)
C_2 = Number(branch_26)
equals_15 = Equality(FirstNumber=A_2, SecondNumber="0")  # -> Equality, Inequality
equals_16 = Equality(FirstNumber=B_2, SecondNumber="0")  # -> Equality, Inequality
and_9 = GateAnd(A=equals_15.Inequality, B=equals_16.Inequality)
sift_31 = SiftPattern(List=A_2, SiftPattern=and_9)  # -> Output0, Output1
sift_32 = SiftPattern(List=B_2, SiftPattern=and_9)  # -> Output0, Output1
sift_33 = SiftPattern(List=C_2, SiftPattern=and_9)  # -> Output0, Output1
eval_18 = Evaluate(F="{A,B,C}", A=sift_31.Output1, B=sift_32.Output1, C=sift_33.Output1)
panel_90 = Panel(eval_18)

item_34 = ListItem(List=branch_33, Index=0, Wrap=False)  # -> Item, Item1

k_2 = Number(branch_22)
b_2 = Number(branch_24)
eval_19 = Evaluate(F="{k,-1,b}", k=k_2, b=b_2)
panel_91 = Panel(eval_19)

item_35 = ListItem(List=branch_32, Index=0, Wrap=False)  # -> Item, Item1
panel_92 = Panel(item_26.Item2)

eval_20 = Evaluate(
    F="{m*A0+A1,m*B0+B1,m*C0+C1}",
    A0=item_26.Item,
    B0=item_26.Item1,
    C0=item_26.Item2,
    A1=item_27.Item,
    B1=item_27.Item1,
    C1=item_27.Item2,
    m=branch_14)
panel_93 = Panel(eval_20)

item_36 = ListItem(List=branch_30, Index=0, Wrap=True)  # -> Item, Item1
k_3 = Number(branch_31)
x0_3 = Number(item_36.Item)
y0_3 = Number(item_36.Item1)
eval_21 = Evaluate(F="{k,-1,y0-k*x0}", k=k_3, x0=x0_3, y0=y0_3)
panel_94 = Panel(eval_21)

x0_4 = Number(item_28.Item)
y0_4 = Number(item_28.Item1)
x1_2 = Number(item_29.Item)
y1_2 = Number(item_29.Item1)
eval_22 = Evaluate(F="{x0-x1,y1-y0,x0*x1-y0*y1-x0*x0+y0*y0}", x0=x0_4, y0=y0_4, x1=x1_2, y1=y1_2)
panel_95 = Panel(eval_22)

y0_5 = Number(item_30.Item1)
a2 = Number(item_31.Item)
x0_5 = Number(item_30.Item)
b2 = Number(item_31.Item1)
c2 = Number(item_31.Item2)
eval_23 = Evaluate(F="{A2,B2,-A2*x0-B2*y0}", A2=a2, B2=b2, C2=c2, x0=x0_5, y0=y0_5)
panel_96 = Panel(eval_23)

angle_5 = Number(branch_19)
distance_p_2 = Number(branch_20)
pi_10 = Pi(Factor=1)
division_5 = Division(A=angle_5, B=pi_10)
int_22 = Integer(division_5)
subtraction_5 = Subtraction(A=division_5, B=int_22)
abs_3 = Absolute(Value=subtraction_5)
larger_5 = LargerThan(FirstNumber=abs_3, SecondNumber="0.000001")  # -> LargerThan, OrEqualTo
sift_34 = SiftPattern(List=angle_5, SiftPattern=larger_5.LargerThan)  # -> Output0, Output1
sift_35 = SiftPattern(List=distance_p_2, SiftPattern=larger_5.LargerThan)  # -> Output0, Output1
eval_24 = Evaluate(F="{cos(angle),sin(angle),-p}", angle=sift_34.Output1, p=sift_35.Output1)
panel_97 = Panel(eval_24)

a_2 = Number(branch_29)
b_3 = Number(branch_28)
equals_17 = Equality(FirstNumber=b_3, SecondNumber="0")  # -> Equality, Inequality
equals_18 = Equality(FirstNumber=a_2, SecondNumber="0")  # -> Equality, Inequality
and_10 = GateAnd(A=equals_18.Inequality, B=equals_17.Inequality)
sift_36 = SiftPattern(List=a_2, SiftPattern=and_10)  # -> Output0, Output1
sift_37 = SiftPattern(List=b_3, SiftPattern=and_10)  # -> Output0, Output1
eval_25 = Evaluate(F="{b,a,-a*b}", a=sift_36.Output1, b=sift_37.Output1)
panel_98 = Panel(eval_25)

x0_6 = Number(item_34.Item)
y0_6 = Number(item_34.Item1)
u_2 = Number(item_35.Item)
v_2 = Number(item_35.Item1)
equals_19 = Equality(FirstNumber=u_2, SecondNumber="0")  # -> Equality, Inequality
equals_20 = Equality(FirstNumber=v_2, SecondNumber="0")  # -> Equality, Inequality
and_11 = GateAnd(A=equals_19.Inequality, B=equals_20.Inequality)
sift_38 = SiftPattern(List=v_2, SiftPattern=and_11)  # -> Output0, Output1
sift_39 = SiftPattern(List=u_2, SiftPattern=and_11)  # -> Output0, Output1
eval_26 = Evaluate(F="{v,-u,-v*x0+u*y0}", x0=x0_6, y0=y0_6, u=sift_39.Output1, v=sift_38.Output1)
panel_99 = Panel(eval_26)

x0_7 = Number(item_33.Item)
y0_7 = Number(item_33.Item1)
nu2 = Number(item_32.Item1)
nu1 = Number(item_32.Item)
equals_21 = Equality(FirstNumber=nu2, SecondNumber="0")  # -> Equality, Inequality
equals_22 = Equality(FirstNumber=nu1, SecondNumber="0")  # -> Equality, Inequality
and_12 = GateAnd(A=equals_22.Inequality, B=equals_21.Inequality)
sift_40 = SiftPattern(List=nu2, SiftPattern=and_12)  # -> Output0, Output1
sift_41 = SiftPattern(List=nu1, SiftPattern=and_12)  # -> Output0, Output1
eval_27 = Evaluate(F="{nu,nv,-nu*x0-nv*y0}", x0=x0_7, y0=y0_7, nu=sift_41.Output1, nv=sift_40.Output1)

path_mapper_2 = PathMapper(eval_20, source="{A;B;C;D}", target="{A;B;0}")
path_mapper_3 = PathMapper(eval_25, source="{A;B;C;D}", target="{A;B;0}")
path_mapper_4 = PathMapper(eval_19, source="{A;B;C;D}", target="{A;B;0}")
panel_100 = Panel(mindex_5.Index)
path_mapper_5 = PathMapper(eval_22, source="{A;B;C;D}", target="{A;B;0}")
path_mapper_6 = PathMapper(eval_21, source="{A;B;C;D}", target="{A;B;0}")
pshift_32 = ShiftPaths(Data=eval_18, Offset=-1)
path_mapper_7 = PathMapper(eval_23, source="{A;B;C;D}", target="{A;B;0}")
panel_101 = Panel(eval_27)
path_mapper_8 = PathMapper(eval_26, source="{A;B;C;D}", target="{A;B;0}")
panel_102 = Panel(pshift_32)
pdecon_4 = Deconstruct(Point=pshift_32)  # -> XComponent, YComponent, ZComponent
graft_42 = GraftTree(Tree=pshift_32, IncludeEmptyLists=True, IncludeNullItems=True)
panel_103 = Panel(path_mapper_6)
path_mapper_9 = PathMapper(eval_24, source="{A;B;C;D}", target="{A;B;0}")
path_mapper_10 = PathMapper(pdecon_4.XComponent, source="{A;B;C}", target="{A;B;0}")
path_mapper_11 = PathMapper(pdecon_4.YComponent, source="{A;B;C}", target="{A;B;1}")
path_mapper_12 = PathMapper(pdecon_4.ZComponent, source="{A;B;C}", target="{A;B;2}")
path_mapper_13 = PathMapper(eval_18, source="{A;B;C;D}", target="{A;B;0;0;0}")
panel_104 = Panel(path_mapper_8)
panel_105 = Panel(path_mapper_12)
panel_106 = Panel(path_mapper_13)
panel_107 = Panel("描述方法只是数据结构的不同，先用几何代表抽象的数据结构")
panel_108 = Panel("""x0,y0;0,1,2,3
x1,y0;0,3,2""")
panel_109 = Panel("""多条线且含有多折线连线组织数据结构问题
得到交点
交点的path替换""")
crv = Curve([<curve referenced from the Rhino model> x3])
crv_2 = Curve([<curve referenced from the Rhino model> x3])
explode = Explode(Curve=crv_2, Recursive=True)  # -> Segments, Vertices
end = EndPoints(Curve=crv_2)  # -> Start, End
neg_4 = Negative(Value="1")
shift_2 = ShiftList(List=explode.Vertices, Shift="1", Wrap=False)
shift_3 = ShiftList(List=explode.Vertices, Shift=neg_4, Wrap=False)

panel_110 = Panel("""1,0
0,1
-1,0
0,-1""")
vec = Vector(panel_110)

# ----
# describe space by (point;index) of vector
md_slider = MDSlider(
    slider_value=Point(0.5591201782, 0.4691162109, 0.5),
    SliderMode=0,
    x_domain=Domain(-1000, 1000),
    y_domain=Domain(-1000, 1000),
    z_domain=Domain(0, 1))
panel_111 = Panel("""0
1
2
3""")
line_length = Panel("""3.2
5.1
3.2
5.1""")
line_length_2 = Number(line_length)
int_23 = Integer(panel_111)
lng_7 = ListLength(List=int_23)
series_17 = Series(Start=0, Step=1, Count=lng_7)
item_37 = ListItem(List=vec, Index=int_23, Wrap=True)
item_38 = ListItem(List=line_length_2, Index=series_17, Wrap=True)
basicvectorunit = Vector(item_37)
amp = Amplitude(Vector=basicvectorunit, Amplitude=item_38)
ma_4 = MassAddition(Input=amp)  # -> Result, PartialResults
addition_2 = Addition(A=md_slider, B=ma_4.PartialResults)
pt = Point(addition_2)
shift_4 = ShiftList(List=ma_4.PartialResults, Shift=-1, Wrap=True)
complex_5 = ComplexComponents(Complex=shift_4)  # -> Real, Imaginary
concat_2 = Concatenate(FragmentA=complex_5.Real, FragmentB=complex_5.Imaginary, JoinSeparator=",")
pline = PolyLine(Vertices=pt, Closed=True)
concat_3 = Concatenate(FragmentA=concat_2, FragmentB=int_23, JoinSeparator=";")

subtraction_6 = Subtraction(A=shift_2, B=shift_3)

graft_43 = GraftTree(Tree=end.Start, IncludeEmptyLists=True, IncludeNullItems=True)  # -> simplify(Tree)
subtraction_7 = Subtraction(A=graft_43, B="{0,0,0}")  # -> flatten(Result)
item_39 = ListItem(List=subtraction_7, Index="0", Wrap=True)
subtraction_8 = Subtraction(A=graft_43, B=item_39)

unit = UnitVector(Vector=subtraction_6)
vec_2 = Vector(subtraction_6)
len = Length(Curve=explode.Segments)  # -> simplify(Length)
pshift_33 = ShiftPaths(Data=unit, Offset=-1)
mindex_6 = MemberIndex(Set=vec, Member=pshift_33)  # -> Index, Count
vdis = VectorDisplay(Anchor=shift_3, Vector=vec_2)
pshift_34 = ShiftPaths(Data=mindex_6.Index, Offset=-1)  # -> simplify(Data)

vecdirection = Integer(pshift_34)
veclength = Number(len)
pt_2 = Point(graft_43)

panel_112 = Panel(vec)
item_40 = ListItem(List=vec, Index=vecdirection, Wrap=True)
amp_2 = Amplitude(Vector=item_40, Amplitude=veclength)
ma_5 = MassAddition(Input=amp_2)  # -> Result, PartialResults
addition_3 = Addition(A=pt_2, B=ma_5.PartialResults)
pt_3 = Point(addition_3)
ins_9 = InsertItems(List=addition_3, Item=pt_2, Indices="0", Wrap=True)
neg_5 = Negative(Value="1")
panel_113 = Panel(pt_2)
panel_114 = Panel(concat_3)
panel_115 = Panel(amp)
shift_5 = ShiftList(List=ins_9, Shift=neg_5, Wrap=False)  # -> simplify(List)

# ----
# tree data trial
# first point 和 end point 的数据结构组织的方式是同一种的
# 
# 先手工傻做，再寻找规律
# 
# 先不管结构如何，把他们放在一起，结构在外部运算，在替换成对的树形数据
# 上升数据结构后手工或者数列
# 上升后全部拍平处理
# 用stack+listItem对拍平的数据处理
# 
# 留下来的问题是数据结构的替换
# 手工
pt_4 = Point(shift_5)
graft_44 = GraftTree(Tree=pt_4, IncludeEmptyLists=True, IncludeNullItems=True)

flatten_27 = FlattenTree(Tree=graft_44, Path="{0}")
tstat_29 = TreeStatistics(Tree=pt_4)  # -> Paths, Length, Count
tstat_30 = TreeStatistics(Tree=graft_44)  # -> Paths, Length, Count
ma_6 = MassAddition(Input=tstat_29.Length)  # -> Result, PartialResults
series_18 = Series(Start=0, Step=1, Count=tstat_30.Count)
stack_17 = StackData(Data=ma_6.PartialResults, Stack=tstat_29.Length)
shift_6 = ShiftList(List=series_18, Shift=stack_17, Wrap=False)
item_41 = ListItem(List=flatten_27, Index=shift_6, Wrap=True)  # -> simplify(Item)

lng_8 = ListLength(List=item_41)

bang = ExplodeTree(Data=graft_44)  # -> Branch0, Branch1, Branch2, Branch3, Branch4, Branch5
merge_10 = Merge(Data1=bang.Branch1, Data2=bang.Branch2, Data3=bang.Branch3, Data4=bang.Branch4, Data5=bang.Branch5)
entwine = Entwine(
    Branch00=merge_10,
    Branch01=bang.Branch5,
    Branch02=bang.Branch5,
    Branch03=bang.Branch5,
    Branch04=bang.Branch5,
    FlattenInputs=True)

stack_18 = StackData(Data=graft_44, Stack=lng_8)
shift_7 = ShiftList(List=ins_9, Shift="1", Wrap=False)  # -> simplify(List)
graft_45 = GraftTree(Tree=stack_18, IncludeEmptyLists=True, IncludeNullItems=True)
graft_46 = GraftTree(Tree=shift_5, IncludeEmptyLists=True, IncludeNullItems=True)

flatten_28 = FlattenTree(Tree=graft_46, Path="{0}")
tstat_31 = TreeStatistics(Tree=shift_5)  # -> Paths, Length, Count
tstat_32 = TreeStatistics(Tree=graft_46)  # -> Paths, Length, Count
ma_7 = MassAddition(Input=tstat_31.Length)  # -> Result, PartialResults
series_19 = Series(Start=0, Step=1, Count=tstat_32.Count)
stack_19 = StackData(Data=ma_7.PartialResults, Stack=tstat_31.Length)
shift_8 = ShiftList(List=series_19, Shift=stack_19, Wrap=False)
viewer_16 = ParamViewer()
item_42 = ListItem(List=flatten_28, Index=shift_8, Wrap=True)  # -> simplify(Item)
replace_16 = ReplacePaths(Data=item_42, Search=viewer_16)

graft_47 = GraftTree(Tree=shift_7, IncludeEmptyLists=True, IncludeNullItems=True)

# ----
# kernel tree data
flatten_29 = FlattenTree(Tree=graft_47, Path="{0}")
tstat_33 = TreeStatistics(Tree=shift_7)  # -> Paths, Length, Count
tstat_34 = TreeStatistics(Tree=graft_47)  # -> Paths, Length, Count
ma_8 = MassAddition(Input=tstat_33.Length)  # -> Result, PartialResults
series_20 = Series(Start=0, Step=1, Count=tstat_34.Count)
stack_20 = StackData(Data=ma_8.PartialResults, Stack=tstat_33.Length)
shift_9 = ShiftList(List=series_20, Shift=stack_20, Wrap=False)
item_43 = ListItem(List=flatten_29, Index=shift_9, Wrap=True)  # -> simplify(Item)
viewer_17 = ParamViewer()
replace_17 = ReplacePaths(Data=item_43, Search=viewer_17)

addition_4 = Addition(A=pt_2)

viewer_18 = ParamViewer()
replace_18 = ReplacePaths(Data=item_41, Search=viewer_18)

firstpt_line0 = Point(graft_46)
firstpt_line1 = Point(item_42)
endpt_line0 = Point(graft_47)
endpt_line1 = Point(item_43)

graft_48 = GraftTree(Tree=item_41, IncludeEmptyLists=True, IncludeNullItems=True)

# ----
# explore a point position in space
line_4 = Line([Line((120.4046894, -60.83579072, 0), (120.4046894, -60.79145643, 0)), Line((120.3917346, -60.82485109, 0), (120.420811, -60.82485109, 0))])
panel_116 = Panel("""处理k不存在的情况

写成函数
把坐标在相减后就分开来算

对实交和虚交的算法 不够缜密""")
# debug:可以做，但是要改动很多，先放放，出现问题了再来
linelist = Curve(line_4)
end_2 = EndPoints(Curve=linelist)  # -> Start, End
subtraction_9 = Subtraction(A=end_2.End, B=end_2.Start)
xy = XYPlane(Origin=Point(0, 0, 0))

startpoint = Point(end_2.Start)
vec_3 = Vector(subtraction_9)

addition_5 = Addition(A=startpoint, B=vec_3)
endpoint = Point(addition_5)
lng_9 = ListLength(List=addition_5)
lng_10 = ListLength(List=startpoint)
subtraction_10 = Subtraction(A=lng_9, B="1")
subtraction_11 = Subtraction(A=lng_10, B="1")
series_21 = Series(Start=0, Step=1, Count=subtraction_11)
series_22 = Series(Start=0, Step=1, Count=subtraction_10)
addition_6 = Addition(A=series_21, B="1")
addition_7 = Addition(A=series_22, B="1")
item_44 = ListItem(List=startpoint, Index=series_21, Wrap=False)  # -> simplify(graft(Item))
item_45 = ListItem(List=addition_5, Index=series_22, Wrap=False)  # -> simplify(graft(Item))
shift_10 = ShiftList(List=addition_5, Shift=addition_7, Wrap=False)  # -> simplify(List)
shift_11 = ShiftList(List=startpoint, Shift=addition_6, Wrap=False)  # -> simplify(List)

firstpt_line0_2 = Point(item_44)
firstpt_line1_2 = Point(shift_11)
endpt1_line1 = Point(shift_10)
endpt_line0_2 = Point(item_45)

points = PointList(Points=flatten(firstpt_line0_2), Size=Slider(6, range=0..100))

complex_6 = ComplexComponents(Complex=firstpt_line0_2)  # -> Real, Imaginary
complex_7 = ComplexComponents(Complex=endpt_line0_2)  # -> Real, Imaginary
complex_8 = ComplexComponents(Complex=firstpt_line1_2)  # -> Real, Imaginary
complex_9 = ComplexComponents(Complex=endpt1_line1)  # -> Real, Imaginary
subtraction_12 = Subtraction(A=complex_8.Imaginary, B=complex_9.Imaginary)
subtraction_13 = Subtraction(A=complex_8.Real, B=complex_9.Real)
subtraction_14 = Subtraction(A=complex_6.Real, B=complex_7.Real)
subtraction_15 = Subtraction(A=complex_6.Imaginary, B=complex_7.Imaginary)
division_6 = Division(A=subtraction_12, B=subtraction_13)
division_7 = Division(A=subtraction_15, B=subtraction_14)
k1 = Number(division_7)
k2 = Number(division_6)
multiplication_5 = Multiplication(A=k2, B=complex_8.Real)
subtraction_16 = Subtraction(A=complex_8.Imaginary, B=multiplication_5)
b2_2 = Number(subtraction_16)
subtraction_17 = Subtraction(A=k1, B=k2)

multiplication_6 = Multiplication(A=k1, B=complex_6.Real)
subtraction_18 = Subtraction(A=complex_6.Imaginary, B=multiplication_6)

equals_23 = Equality(FirstNumber=subtraction_13, SecondNumber="0")  # -> Equality, Inequality
equals_24 = Equality(FirstNumber=subtraction_14, SecondNumber="0")  # -> Equality, Inequality
sift_42 = SiftPattern(List=complex_9.Real, SiftPattern=equals_23.Equality)  # -> Output0, Output1
sift_43 = SiftPattern(List=complex_6.Real, SiftPattern=equals_24.Equality)  # -> Output0, Output1
or = GateOr(A=equals_24.Equality, B=equals_23.Equality)
combine = CombineData(Input0=sift_43.Output1, Input1=sift_42.Output1)  # -> Result, Index
sift_44 = SiftPattern(List=k2, SiftPattern=equals_23.Equality)  # -> Output0, Output1
sift_45 = SiftPattern(List=b2_2, SiftPattern=equals_23.Equality)  # -> Output0, Output1
sift_46 = SiftPattern(List=k1, SiftPattern=equals_24.Equality)  # -> Output0, Output1
combine_2 = CombineData(Input0=sift_46.Output0, Input1=sift_44.Output0)  # -> Result, Index
a_3 = Number(combine.Result)
k_4 = Number(combine_2.Result)
multiplication_7 = Multiplication(A=a_3, B=k_4)
intersection_x = Number(a_3)

b1 = Number(subtraction_18)
subtraction_19 = Subtraction(A=b2_2, B=b1)
division_8 = Division(A=subtraction_19, B=subtraction_17)
multiplication_8 = Multiplication(A=division_8, B=k2)
addition_8 = Addition(A=multiplication_8, B=b2_2)
sift_47 = SiftPattern(List=addition_8, SiftPattern=or)  # -> Output0, Output1

sift_48 = SiftPattern(List=b1, SiftPattern=equals_24.Equality)  # -> Output0, Output1
combine_3 = CombineData(Input0=sift_48.Output0, Input1=sift_45.Output0)  # -> Result, Index
b_4 = Number(combine_3.Result)
sift_49 = SiftPattern(List=b_4, SiftPattern=or)  # -> Output0, Output1
addition_9 = Addition(A=multiplication_7, B=sift_49.Output1)
intersection_y = Number(addition_9)

combine_4 = CombineData(Input0=sift_47.Output0, Input1=intersection_y)  # -> Result, Index
combine_5 = CombineData(Input0=division_8, Input1=intersection_x)  # -> Result, Index

panel_117 = Panel(equals_24.Equality)
intersection_x_2 = Number(combine_5.Result)
intersection_y_2 = Number(combine_4.Result)
pt_5 = PointOriented(BasePlane=xy, UComponent=intersection_x_2, VComponent=intersection_y_2, WComponent=0)

# ----
# true --> real insection
# false --> extend
# 10,11 --> real insection
# 01       --> extend one line
# 00       --> extend two lines
# true   -- > extend one line
# false -->  extend two lines
dom = ConstructDomain(DomainStart=complex_6.Imaginary, DomainEnd=complex_7.Imaginary)
dom_2 = ConstructDomain(DomainStart=complex_6.Real, DomainEnd=complex_7.Real)
dom_3 = ConstructDomain(DomainStart=complex_8.Real, DomainEnd=complex_9.Real)
dom_4 = ConstructDomain(DomainStart=complex_8.Imaginary, DomainEnd=complex_9.Imaginary)
firstpty_domain = Domain(dom)
firstptx_domain = Domain(dom_2)
endpty_domain = Domain(dom_4)
endptx_domain = Domain(dom_3)
inc = Includes(Value=intersection_y_2, Domain=firstpty_domain)  # -> Includes, Deviation
inc_2 = Includes(Value=intersection_x_2, Domain=endptx_domain)  # -> Includes, Deviation
inc_3 = Includes(Value=intersection_y_2, Domain=endpty_domain)  # -> Includes, Deviation
inc_4 = Includes(Value=intersection_x_2, Domain=firstptx_domain)  # -> Includes, Deviation
or_2 = GateOr(A=inc_4.Includes, B=inc.Includes, C=inc_2.Includes, D=inc_3.Includes)
and_13 = GateAnd(A=inc_4.Includes, B=inc.Includes, C=inc_2.Includes, D=inc_3.Includes)
int_24 = Integer(or_2)
int_25 = Integer(and_13)
concat_4 = Concatenate(FragmentA=int_25, FragmentB=int_24)
panel_118 = Panel("""10
11
01
00""")
panel_119 = Panel("""0
0
1
2""")
keysearch_4 = KeyValueSearch(Keys=panel_118, Values=panel_119, Search=concat_4)
extendlinecount = Integer(keysearch_4)

sift_50 = SiftPattern(List=pt_5, SiftPattern=extendlinecount)  # -> Output0, Output1, Output2
intersectionontwolines = Point(sift_50.Output0)
intersectionononeline = Point(sift_50.Output1)
intersectiononextend = Point(sift_50.Output2)
panel_120 = Panel(intersectionontwolines)

firstpt0 = Point(firstpt_line0)
firstpt1 = Point(firstpt_line1)
endpt0 = Point(endpt_line0)
endpt1 = Point(endpt_line1)
points_2 = PointList(Points=flatten(firstpt0), Size=Slider(0.109, range=0..3))
complex_10 = ComplexComponents(Complex=firstpt0)  # -> Real, Imaginary
complex_11 = ComplexComponents(Complex=firstpt1)  # -> Real, Imaginary
complex_12 = ComplexComponents(Complex=endpt1)  # -> Real, Imaginary
complex_13 = ComplexComponents(Complex=endpt0)  # -> Real, Imaginary
subtraction_20 = Subtraction(A=complex_11.Imaginary, B=complex_12.Imaginary)
subtraction_21 = Subtraction(A=complex_11.Real, B=complex_12.Real)
equals_25 = Equality(FirstNumber=subtraction_21, SecondNumber="0")  # -> Equality, Inequality
sift_51 = SiftPattern(List=complex_12.Real, SiftPattern=equals_25.Equality)  # -> Output0, Output1
subtraction_22 = Subtraction(A=complex_10.Imaginary, B=complex_13.Imaginary)
subtraction_23 = Subtraction(A=complex_10.Real, B=complex_13.Real)
equals_26 = Equality(FirstNumber=subtraction_23, SecondNumber="0")  # -> Equality, Inequality
sift_52 = SiftPattern(List=complex_10.Real, SiftPattern=equals_26.Equality)  # -> Output0, Output1
or_3 = GateOr(A=equals_26.Equality, B=equals_25.Equality)
combine_6 = CombineData(Input0=sift_52.Output1, Input1=sift_51.Output1)  # -> Result, Index
division_9 = Division(A=subtraction_20, B=subtraction_21)
division_10 = Division(A=subtraction_22, B=subtraction_23)
panel_121 = Panel("""处理k不存在的情况

写成函数
把坐标在相减后就分开来算""")
k1_2 = Number(division_10)
multiplication_9 = Multiplication(A=k1_2, B=complex_10.Real)
sift_53 = SiftPattern(List=k1_2, SiftPattern=equals_26.Equality)  # -> Output0, Output1
subtraction_24 = Subtraction(A=complex_10.Imaginary, B=multiplication_9)
b1_2 = Number(subtraction_24)
sift_54 = SiftPattern(List=b1_2, SiftPattern=equals_26.Equality)  # -> Output0, Output1
k2_2 = Number(division_9)
multiplication_10 = Multiplication(A=k2_2, B=complex_11.Real)
sift_55 = SiftPattern(List=k2_2, SiftPattern=equals_25.Equality)  # -> Output0, Output1
subtraction_25 = Subtraction(A=complex_11.Imaginary, B=multiplication_10)
combine_7 = CombineData(Input0=sift_53.Output0, Input1=sift_55.Output0)  # -> Result, Index
b2_3 = Number(subtraction_25)
sift_56 = SiftPattern(List=b2_3, SiftPattern=equals_25.Equality)  # -> Output0, Output1
combine_8 = CombineData(Input0=sift_54.Output0, Input1=sift_56.Output0)  # -> Result, Index
subtraction_26 = Subtraction(A=b2_3, B=b1_2)
b_5 = Number(combine_8.Result)
a_4 = Number(combine_6.Result)
k_5 = Number(combine_7.Result)
subtraction_27 = Subtraction(A=k1_2, B=k2_2)
sift_57 = SiftPattern(List=b_5, SiftPattern=or_3)  # -> Output0, Output1
multiplication_11 = Multiplication(A=a_4, B=k_5)
division_11 = Division(A=subtraction_26, B=subtraction_27)
multiplication_12 = Multiplication(A=division_11, B=k2_2)
addition_10 = Addition(A=multiplication_12, B=b2_3)
sift_58 = SiftPattern(List=addition_10, SiftPattern=or_3)  # -> Output0, Output1
addition_11 = Addition(A=multiplication_11, B=sift_57.Output1)
intersection_x_3 = Number(a_4)
intersection_y_3 = Number(addition_11)
combine_9 = CombineData(Input0=sift_58.Output0, Input1=intersection_y_3)  # -> Result, Index
combine_10 = CombineData(Input0=division_11, Input1=intersection_x_3)  # -> Result, Index
intersection_x_4 = Number(combine_10.Result)
intersection_y_4 = Number(combine_9.Result)
xy_2 = XYPlane(Origin=Point(0, 0, 0))
pt_6 = PointOriented(BasePlane=xy_2, UComponent=intersection_x_4, VComponent=intersection_y_4, WComponent=0)

# ----
# true --> real insection
# false --> extend
# 10,11 --> real insection
# 01       --> extend one line
# 00       --> extend two lines
# true   -- > extend one line
# false -->  extend two lines
dom_5 = ConstructDomain(DomainStart=complex_10.Imaginary, DomainEnd=complex_13.Imaginary)
dom_6 = ConstructDomain(DomainStart=complex_10.Real, DomainEnd=complex_13.Real)
dom_7 = ConstructDomain(DomainStart=complex_11.Real, DomainEnd=complex_12.Real)
dom_8 = ConstructDomain(DomainStart=complex_11.Imaginary, DomainEnd=complex_12.Imaginary)
firstpty_domain_2 = Domain(dom_5)
firstptx_domain_2 = Domain(dom_6)
endpty_domain_2 = Domain(dom_8)
endptx_domain_2 = Domain(dom_7)
inc_5 = Includes(Value=intersection_y_4, Domain=firstpty_domain_2)  # -> Includes, Deviation
inc_6 = Includes(Value=intersection_x_4, Domain=endptx_domain_2)  # -> Includes, Deviation
inc_7 = Includes(Value=intersection_y_4, Domain=endpty_domain_2)  # -> Includes, Deviation
inc_8 = Includes(Value=intersection_x_4, Domain=firstptx_domain_2)  # -> Includes, Deviation
or_4 = GateOr(A=inc_8.Includes, B=inc_5.Includes, C=inc_6.Includes, D=inc_7.Includes)
and_14 = GateAnd(A=inc_8.Includes, B=inc_5.Includes, C=inc_6.Includes, D=inc_7.Includes)
int_26 = Integer(or_4)
int_27 = Integer(and_14)
concat_5 = Concatenate(FragmentA=int_27, FragmentB=int_26)
panel_122 = Panel("""10
11
01
00""")
panel_123 = Panel("""0
0
1
2""")
keysearch_5 = KeyValueSearch(Keys=panel_122, Values=panel_123, Search=concat_5)
extendlinecount_2 = Integer(keysearch_5)

sift_59 = SiftPattern(List=pt_6, SiftPattern=extendlinecount_2)  # -> Output0, Output1, Output2
intersectionontwolines_2 = Point(sift_59.Output0)
intersectionononeline_2 = Point(sift_59.Output1)
intersectiononextend_2 = Point(sift_59.Output2)

# ----
# 计算点到边界的垂直向量
# describe space by (point;index) of vector
# 问题在于，当某一path缺少时，替换的内容仍然会配对，造成数据多余错误
# 要探测出缺少的路径
# statistics-->DePath
# 最后拍平后替换路径
line_length_3 = Panel("""3.2
5.1
3.2
5.1
6.4
10.2""")
panel_124 = Panel("""0
1
0
1
2
3""")
md_slider_2 = MDSlider(
    slider_value=Point(0.4899997711, 0.4549980164, 0.5),
    SliderMode=0,
    x_domain=Domain(0, 1),
    y_domain=Domain(0, 1),
    z_domain=Domain(0, 1))
panel_125 = Panel("""0
1
2
3""")
line_length_4 = Panel("""3.2
5.1
3.2
5.1""")
panel_126 = Panel("""用字符串的方法表示还差最后一步，那么先拆开来用判断的方法做
拆开的方法很繁琐，索性还是用字符串替换的方法
检查目前的替换方法是否可以简化
并且找出到各个边的距离最近点""")
line_length_5 = Number(line_length_4)
panel_127 = Panel("""1,0
0,1
-1,0
0,-1""")
vec_4 = Vector(panel_127)
int_28 = Integer(panel_125)
lng_11 = ListLength(List=int_28)
series_23 = Series(Start=0, Step=1, Count=lng_11)
item_46 = ListItem(List=vec_4, Index=int_28, Wrap=True)
panel_128 = Panel(item_46)
item_47 = ListItem(List=line_length_5, Index=series_23, Wrap=True)
basicvectorunit_2 = Vector(item_46)
amp_3 = Amplitude(Vector=basicvectorunit_2, Amplitude=item_47)
ma_9 = MassAddition(Input=amp_3)  # -> Result, PartialResults
addition_12 = Addition(A=md_slider_2, B=ma_9.PartialResults)
shift_12 = ShiftList(List=ma_9.PartialResults, Shift=-1, Wrap=True)
complex_14 = ComplexComponents(Complex=shift_12)  # -> Real, Imaginary
concat_6 = Concatenate(FragmentA=complex_14.Real, FragmentB=complex_14.Imaginary, JoinSeparator=",")
item_48 = ListItem(List=amp_3, Index=graft(series_23), Wrap=True)
panel_129 = Panel(ma_9.PartialResults)
concat_7 = Concatenate(FragmentA=concat_6, FragmentB=int_28, JoinSeparator=";")
item_49 = ListItem(List=concat_7, Index=series_23, Wrap=True)
split_11 = TextSplit(Text=item_49, Separators=";")  # -> simplify(Result)
item_50 = ListItem(List=split_11, Index=0, Wrap=True)  # -> Item, Item1
pt_7 = Point(item_50.Item)
addition_13 = Addition(A=pt_7, B=item_48)
firstpt0_2 = Point(item_50.Item)
endpt0_2 = Point(addition_13)
panel_130 = Panel(concat_7)
complex_15 = ComplexComponents(Complex=endpt0_2)  # -> Real, Imaginary
complex_16 = ComplexComponents(Complex=firstpt0_2)  # -> Real, Imaginary
pt_8 = Point(Point(1.488717773, 12.13872048, 0))
subtraction_28 = Subtraction(A=complex_16.Imaginary, B=complex_15.Imaginary)
subtraction_29 = Subtraction(A=complex_16.Real, B=complex_15.Real)
complex_17 = ComplexComponents(Complex=pt_8)  # -> Real, Imaginary
division_12 = Division(A=subtraction_28, B=subtraction_29)
k1_3 = Number(division_12)
multiplication_13 = Multiplication(A=k1_3, B=complex_15.Real)
subtraction_30 = Subtraction(A=complex_15.Imaginary, B=multiplication_13)
b1_3 = Number(subtraction_30)
panel_131 = Panel("abs(k*x0-y0+b)/sqrt(k*k+1)")
panel_132 = Panel("(k*x0-y0+b)/sqrt(k*k+1)")
panel_133 = Panel("-(k*x0-y0+b)/sqrt(k*k+1)")

y = Number(complex_17.Imaginary)
x = Number(complex_17.Real)
larger_6 = LargerThan(FirstNumber=complex_16.Real, SecondNumber=x)  # -> LargerThan, OrEqualTo
larger_7 = LargerThan(FirstNumber=complex_16.Imaginary, SecondNumber=y)  # -> LargerThan, OrEqualTo
int_29 = Integer(larger_6.LargerThan)
int_30 = Integer(larger_7.LargerThan)
concat_8 = Concatenate(FragmentA=int_29, FragmentB=int_30)

# ---- group: vector match concept Error
panel_134 = Panel("""010
012
110
112""")
panel_135 = Panel("""101
103
111
113""")
panel_136 = Panel("""001
003
011
013""")
panel_137 = Panel("""000
002
100
102""")
merge_11 = Merge(Data1=panel_135, Data2=panel_134, Data3=panel_136, Data4=panel_137)
entwine_2 = Entwine(Branch00=panel_135, Branch01=panel_134, Branch02=panel_136, Branch03=panel_137, FlattenInputs=True)  # -> simplify(Result)
concat_9 = Concatenate(FragmentA=concat_8, FragmentB=item_50.Item1)
flatten_30 = FlattenTree(Tree=concat_9, Path="{0}")
mindex_7 = MemberIndex(Set=merge_11, Member=flatten_30)  # -> Index, Count
division_13 = Division(A=mindex_7.Index, B="4")
int_31 = Integer(division_13)
item_51 = ListItem(List=vec_4, Index=int_31, Wrap=True)

# ----
pt_9 = Point(ma_9.PartialResults)
pline_2 = PolyLine(Vertices=pt_9, Closed=True)

# ---- group: vector match concept Error
mindex_8 = MemberIndex(Set=entwine_2, Member=flatten_30)  # -> Index, Count
clean_52 = CleanTree(RemoveNulls=True, RemoveInvalid=True, RemoveEmpty=True, Tree=mindex_8.Index)
tstat_35 = TreeStatistics(Tree=clean_52)  # -> Paths, Length, Count
split_12 = TextSplit(Text=tstat_35.Paths, Separators=";")
item_52 = ListItem(List=split_12, Index="0", Wrap=True)
split_13 = TextSplit(Text=item_52, Separators="{")
item_53 = ListItem(List=split_13, Index="1", Wrap=True)  # -> simplify(Item)

equals_27 = Equality(FirstNumber=graft(flatten_30), SecondNumber=merge_11)  # -> Equality, Inequality
mindex_9 = MemberIndex(Set=equals_27.Equality, Member=Toggle(True))  # -> Index, Count

# ----
# distances between points and space boundary
null = NullItem(Item=k1_3)  # -> NullFlags, InvalidFlags, Description
sift_60 = SiftPattern(List=pt_7, SiftPattern=null.NullFlags)  # -> Output0, Output1
complex_18 = ComplexComponents(Complex=sift_60.Output1)  # -> Real, Imaginary
eval_28 = Evaluate(F="abs(k*x0-y0+b)/sqrt(k*k+1)", k=k1_3, b=b1_3, x0=complex_17.Real, y0=complex_17.Imaginary)
subtraction_31 = Subtraction(A=complex_17.Real, B=complex_18.Real)  # -> simplify(Result)
distance = Number(eval_28)
abs_4 = Absolute(Value=subtraction_31)  # -> simplify(Result)
combine_11 = CombineData(Input0=distance, Input1=abs_4)  # -> Result, Index

# ---- group: vector match method 1
concat_10 = Concatenate(FragmentA=concat_8, FragmentB=item_50.Item1)
flatten_31 = FlattenTree(Tree=concat_10, Path="{0}")
panel_138 = Panel("""000
002
100
102""")
panel_139 = Panel("""010
012
110
112""")
panel_140 = Panel("""101
103
111
113""")
panel_141 = Panel("""001
003
011
013""")
mindex_10 = MemberIndex(Set=panel_141, Member=flatten_31)  # -> Index, Count
mindex_11 = MemberIndex(Set=panel_138, Member=flatten_31)  # -> Index, Count
mindex_12 = MemberIndex(Set=panel_140, Member=flatten_31)  # -> Index, Count
mindex_13 = MemberIndex(Set=panel_139, Member=flatten_31)  # -> Index, Count
clean_53 = CleanTree(RemoveNulls=True, RemoveInvalid=True, RemoveEmpty=True, Tree=mindex_13.Index)
clean_54 = CleanTree(RemoveNulls=True, RemoveInvalid=True, RemoveEmpty=True, Tree=mindex_11.Index)
clean_55 = CleanTree(RemoveNulls=True, RemoveInvalid=True, RemoveEmpty=True, Tree=mindex_12.Index)
clean_56 = CleanTree(RemoveNulls=True, RemoveInvalid=True, RemoveEmpty=True, Tree=mindex_10.Index)
replace_19 = ReplaceItems(List=clean_55, Item="0", Indices="0", Wrap=False)
replace_20 = ReplaceItems(List=clean_53, Item="1", Indices="0", Wrap=False)
replace_21 = ReplaceItems(List=clean_56, Item="2", Indices="0", Wrap=False)
replace_22 = ReplaceItems(List=clean_54, Item="3", Indices="0", Wrap=False)
merge_12 = Merge(Data1=replace_19, Data2=replace_20, Data3=replace_21, Data4=replace_22)
item_54 = ListItem(List=vec_4, Index=merge_12, Wrap=True)
amp_4 = Amplitude(Vector=item_54, Amplitude=combine_11.Result)
vdis_2 = VectorDisplay(Anchor=pt_8, Vector=amp_4)

# ---- group: vector match method 0 Error
# left-down;x-axis
# left-up;y-axis
a_5 = Number(complex_16.Real)
b_6 = Number(complex_16.Imaginary)
y_2 = Number(complex_17.Imaginary)
x_2 = Number(complex_17.Real)
item_55 = ListItem(List=vec_4, Index=item_50.Item1, Wrap=True)
smaller_4 = SmallerThan(FirstNumber=b_6, SecondNumber=y_2)  # -> SmallerThan, OrEqualTo
not = GateNot(A=smaller_4.SmallerThan)
smaller_5 = SmallerThan(FirstNumber=a_5, SecondNumber=x_2)  # -> SmallerThan, OrEqualTo
and_15 = GateAnd(A=smaller_5.SmallerThan, B=not)
equals_28 = Equality(FirstNumber="0", SecondNumber=graft(int_28))  # -> Equality, Inequality
equals_29 = Equality(FirstNumber="2", SecondNumber=graft(int_28))  # -> Equality, Inequality
and_16 = GateAnd(A=smaller_5.SmallerThan, B=smaller_4.SmallerThan)
equals_30 = Equality(FirstNumber="1", SecondNumber=graft(int_28))  # -> Equality, Inequality
equals_31 = Equality(FirstNumber="3", SecondNumber=graft(int_28))  # -> Equality, Inequality
or_5 = GateOr(A=equals_28.Equality, B=equals_29.Equality)
or_6 = GateOr(A=equals_30.Equality, B=equals_31.Equality)
and_17 = GateAnd(A=or_6, B=and_16)
and_18 = GateAnd(A=or_5, B=and_15)
or_7 = GateOr(A=and_17, B=and_18)
sift_61 = SiftPattern(List=item_55, SiftPattern=or_7)  # -> Output0, Output1
pi_11 = Pi(Factor="0.5")
Z = UnitZ(Factor=1)
neg_6 = Negative(Value=pi_11)
vrot = Rotate(Vector=sift_61.Output0, Axis=Z, Angle=neg_6)
vrot_2 = Rotate(Vector=sift_61.Output1, Axis=Z, Angle=pi_11)
combine_12 = CombineData(Input0=vrot, Input1=vrot_2)  # -> Result, Index
amp_5 = Amplitude(Vector=combine_12.Result, Amplitude=combine_11.Result)
vdis_3 = VectorDisplay(Anchor=pt_8, Vector=amp_5)

# ----
# vectors between points and space boundary
panel_142 = Panel("0.5")  # disabled
item_56 = ListItem(List=vec_4, Index=item_50.Item1, Wrap=True)  # disabled
pi_12 = Pi(Factor=panel_142)  # disabled
neg_7 = Negative(Value=pi_12)  # disabled
Z_2 = UnitZ(Factor=1)  # disabled
vrot_3 = Rotate(Vector=item_56, Axis=Z_2, Angle=neg_7)  # disabled
amp_6 = Amplitude(Vector=vrot_3, Amplitude=combine_11.Result)  # disabled

panel_143 = Panel(eval_28)
panel_144 = Panel(combine_11.Result)

# ---- group: vector match method 1 simplify
entwine_3 = Entwine(Branch00=panel_135, Branch01=panel_134, Branch02=panel_136, Branch03=panel_137, FlattenInputs=True)  # -> simplify(Result)
flatten_32 = FlattenTree(Tree=concat_10, Path="{0}")
mindex_14 = MemberIndex(Set=entwine_3, Member=flatten_32)  # -> Index, Count
clean_57 = CleanTree(RemoveNulls=True, RemoveInvalid=True, RemoveEmpty=True, Tree=mindex_14.Index)
pshift_35 = ShiftPaths(Data=clean_57, Offset=-1)
viewer_19 = ParamViewer(clean_57)

tstat_36 = TreeStatistics(Tree=pshift_35)  # -> Paths, Length, Count
dpath_12 = DeconstructPath(Branch=tstat_36.Paths)  # -> simplify(Indices)

graft_49 = GraftTree(Tree=tstat_36.Length, IncludeEmptyLists=True, IncludeNullItems=True)
series_24 = Series(Start=0, Step=1, Count=graft_49)
int_32 = Integer(simplify(series_24))
replace_23 = ReplaceItems(List=pshift_35, Item=dpath_12, Indices=int_32, Wrap=False)
graft_50 = GraftTree(Tree=flatten(replace_23), IncludeEmptyLists=True, IncludeNullItems=True)
viewer_20 = ParamViewer(graft_50)
replace_24 = ReplacePaths(Data=graft_50, Search=viewer_20, Replace=viewer_19)
pshift_36 = ShiftPaths(Data=replace_24, Offset="1")
item_57 = ListItem(List=vec_4, Index=pshift_36, Wrap=True)
amp_7 = Amplitude(Vector=item_57, Amplitude=combine_11.Result)
vdis_4 = VectorDisplay(Anchor=pt_8, Vector=amp_7)
