# Grasshopper definition 20170301_tim_weight_list.gh (Grasshopper 0.9.76)
# plug-ins: Python Interpreter

python = PythonScript(a_index=Slider(0, range=0..10), change_a=Slider(0, range=0..100))  # -> out, P, L
# ---------- python: Python ----------
def main(P,a_index,change_a):
    #P = [5,4,6,8,7,9]
    #a_index = 0
    #change_a = 30
    n = len(P)
    min_list = [3,3,3,3,3,3]
    toggle = True
    
    #//product weight list
    weight_i = n-1
    weight_list = [0 for wl in range(n-1)]
    weight_list.append(1)

    L = [P[i]for i in range(n)]
    original_sum = sum(L)
    #// give the input to change the L[a_index]
    L[a_index] += change_a
    #//sorted the list and match the weight index
    sortL = sorted(L)
    #sortIndex = [ sortL.index(L[i]) for i in range(n)]         #//maybe [L.index(sortL[i]) for i in range(n)]
    sortIndex = [L.index(sortL[i]) for i in range(n)]
    
    #dt = sum(L) - original_sum                        #//original_sum - sum(L)
    dt = original_sum - sum(L)
    while toggle:                                     #//when toggle off indicate dt=0 and each value > value's min
        #//distributeWeight
        #dt = sum(L) - original_sum
        for j in range(n):
            #L[sortIndex[j]] += dt * weight_list[j]    #//multiply list as sort order  
            L[j] += dt * weight_list[j]                #//multiply list as origianl order
        dt = original_sum - sum(L)
        if dt == 0  :                                   #// maybe needn\'t
            toggle = False

        #//testBelowMin
        for k in range(n):
            if L[k] - min_list[k] < 0 :               #//Error maybe L[sortIndex[i]] - min_list[sortIndex[i]] < 0 // or sortL[sortIndex[i]] - min_list[sortIndex[i]] < 0
                L[k] = min_list[k]
                dt = original_sum - sum(L)             #// compute sum of list after supplyment the minimum
                #if (dt < 0):                          #// when other items are minimum ,reduce first one
                if (dt < 0) :          #// ( weight_i > 1 )survive the condition reduce first item,and then continue add first item
                    weight_i -= 1                      #//recontribute weight after supplyment  ex:00001 ---> 00010                     
                    weight_list = [0 for wl in range(n-1)]
                    weight_list.insert(weight_i,1)
                    toggle = True                          #//toggle is on to multiply list as weight which has been revised
    print 'P:',P
    print 'L:',L

    #//test
    if sum(L) == original_sum:
        print 'True'
    else:
        print 'False'
    return L
P=[5,4,6,8,7,9]
a_index = int(a_index)
change_a = int(change_a)
L = main(P,a_index,change_a)
# ---------- end python ----------
merge = Merge(Data1=flatten("0"), Data2=flatten(python.L))
merge_2 = Merge(Data1=flatten("0"), Data2=flatten(python.P))
ma = MassAddition(Input=merge_2)  # -> Result, PartialResults
ma_2 = MassAddition(Input=merge)  # -> Result, PartialResults
pt = PointOriented(BasePlane=PlaneXY(0, 0, 0), UComponent=ma.PartialResults, VComponent=0, WComponent=0)
pt_2 = PointOriented(BasePlane=PlaneXY(0, 0, 0), UComponent=ma_2.PartialResults, VComponent=Slider(2, range=0..10), WComponent=0)
pline = PolyLine(Vertices=pt_2, Closed=False)
pline_2 = PolyLine(Vertices=pt, Closed=False)
panel = Panel(pt_2)
